# Dynamo custom node GIS2BIM_CreateBoundingBox.dyf (Dynamo 2.19.3.6394)
# category: GIS2BIM.Coordinates
# create boundingboxstring for webrequests based on coördinates and dimensions

CoordinateX = Input(CoordinateX: double)
BoxWidth = Input(BoxWidth: double)  # width of the boundingbox
number = DoubleInput(0.5)  # graph input
mul = BoxWidth * number
x_linksonder = CoordinateX - mul
round = Math.Round(number=x_linksonder)
toString = Python(IN[0]=round)  # "Springs.Number.ToString"; IronPython2
# ---------- toString.python (21 lines) ----------
#Copyright(c) 2016, Dimitar Venkov
# @5devene, dimitar.ven@gmail.com

import clr

def tolist(obj1):
	if hasattr(obj1,"__iter__"): return obj1
	else: return [obj1]

def output1(l1):
	if len(l1) == 1: return l1[0]
	else: return l1

num1 = tolist(IN[0])
out1 = []
for i in xrange(len(num1)):
	s1 = str(num1[i])
	if s1[-2:] == ".0": out1.append(s1[:-2])
	else: out1.append(s1)

OUT = output1(out1)
# ----------------------------------------
string = StringInput(",")  # graph input
CoordinateY = Input(CoordinateY: double)
BoxHeight = Input(BoxHeight: double)  # height of the boundingbox
number_2 = DoubleInput(0.5)  # graph input
mul_2 = BoxHeight * number_2
y_linksonder = CoordinateY - mul_2
round_2 = Math.Round(number=y_linksonder)
toString_2 = Python(IN[0]=round_2)  # "Springs.Number.ToString"; IronPython2; same code as toString
x_rechtsboven = mul + CoordinateX
round_3 = Math.Round(number=x_rechtsboven)
toString_3 = Python(IN[0]=round_3)  # "Springs.Number.ToString"; IronPython2; same code as toString
y_rechtsboven = mul_2 + CoordinateY
round_4 = Math.Round(number=y_rechtsboven)
toString_4 = Python(IN[0]=round_4)  # "Springs.Number.ToString"; IronPython2; same code as toString
concat = String.Concat(string0=toString, string1=string, string2=toString_2, string3=string, string4=toString_3, string5=string, string6=toString_4)
Boxstring = Output(concat)  # "Boxstring: string"
string_2 = StringInput("\"xmin\":")  # graph input
toString_5 = Python(IN[0]=x_linksonder)  # "Springs.Number.ToString"; IronPython2; same code as toString
string_3 = StringInput(",\"ymin\":")  # graph input
toString_6 = Python(IN[0]=y_linksonder)  # "Springs.Number.ToString"; IronPython2; same code as toString
string_4 = StringInput(",\"xmax\":")  # graph input
toString_7 = Python(IN[0]=x_rechtsboven)  # "Springs.Number.ToString"; IronPython2; same code as toString
string_5 = StringInput(",\"ymax\":")  # graph input
toString_8 = Python(IN[0]=y_rechtsboven)  # "Springs.Number.ToString"; IronPython2; same code as toString
concat_2 = String.Concat(string0=string_2, string1=toString_5, string2=string_3, string3=toString_6, string4=string_4, string5=toString_7, string6=string_5, string7=toString_8)
code_block = CodeBlock { "%2C"; }
concat_3 = String.Concat(string0=toString_5, string1=code_block, string2=toString_6, string3=code_block, string4=toString_7, string5=code_block, string6=toString_8)
Boxstring2 = Output(concat_3)  # "Boxstring2: string"
Xmin = Output(toString_5)  # "Xmin: string"
Xmax = Output(toString_7)  # "Xmax: string"
Ymin = Output(toString_6)  # "Ymin: string"
Ymax = Output(toString_8)  # "Ymax: string"
code_block_2 = CodeBlock { "("; ")"; " "; ","; }
code_block_3 = CodeBlock(xmin=toString_5, ymin=toString_6, xmax=toString_7, ymax=toString_8) { xmin; ymin; xmax; ymax; }
concat_4 = String.Concat(string0=code_block_2.out0, string1=code_block_3.xmin, string2=code_block_2.out2, string3=code_block_3.ymax, string4=code_block_2.out3, string5=code_block_2.out2, string6=code_block_3.xmax, string7=code_block_2.out2, string8=code_block_3.ymax, string9=code_block_2.out3, string10=code_block_2.out2, string11=code_block_3.xmax, string12=code_block_2.out2, string13=code_block_3.ymin, string14=code_block_2.out3, string15=code_block_2.out2, string16=code_block_3.xmin, string17=code_block_2.out2, string18=code_block_3.ymin, string19=code_block_2.out3, string20=code_block_2.out2, string21=code_block_3.xmin, string22=code_block_2.out2, string23=code_block_3.ymax, string24=code_block_2.out1)
PolygonString = Output(concat_4)  # "PolygonString: string"
