# Dynamo custom node GIS2BIM_GetLocationdataNetherlands_DESKTOP-BUREAU_Jan-07-121224-2026_Conflict.dyf "GIS2BIM_GetLocationdataNetherlands" (Dynamo 3.3.0.6316)
# category: GIS2BIM.DutchGEO
# Gives locationdata based on an adress in the Netherlands
# packages: LunchBox for Dynamo 2018.7.6

code_block = CodeBlock { "test"; }
Housenumber = Input(Housenumber: string)  # housenumber
Postcode = Input(Postcode: string)  # housenumber
code_block_2 = CodeBlock(city=code_block, street=code_block, number=Housenumber, pc=Postcode)
# ---------- code_block_2.designscript (10 lines) ----------
"https://api.pdok.nl/bzk/locatieserver/search/v3_1/free?&wt=xml&q="+
city+
" and "+
street+
" and "+
number;
"https://api.pdok.nl/bzk/locatieserver/search/v3_1/free?&wt=xml&q="+
pc+
"+and+"+
number;
# ----------------------------------------
web_request = WebRequest(url=code_block_2.out1)
code_block_3 = CodeBlock { "str"; }
getXMLNode = Lists.DataSets.GetXMLNode(XML=web_request, TagName=code_block_3)
code_block_4 = CodeBlock(pdoklocatieserver=getXMLNode, url=code_block_2.out1)
# ---------- code_block_4.designscript (28 lines) ----------
//rd
pdoklocatieserver[28];
RDXY=String.Remove(pdoklocatieserver[27],0,6);
RDXYl=String.Split(RDXY, " ");
RDX=String.ToNumber(RDXYl[0]);
RDY=String.ToNumber(String.Remove(RDXYl[1],-1,1));
//postcode
pdoklocatieserver[21];
//sectiekadaster
kadastraal=String.Split(pdoklocatieserver[13],"-");
kadastraal[1];
//perceelkadaster
kadastraal[2];
//longitude / lattitude
LL=String.Remove(pdoklocatieserver[23],0,6);
LLl=String.Split(LL, " ");
lon=String.ToNumber(LLl[0]);
lat=String.ToNumber(String.Remove(LLl[1],-1,1));
//url
url;
//gemeentecode
pdoklocatieserver[8];
//kadaster
//provincie
pdoklocatieserver[22];
//windgebied
//waterschap;
pdoklocatieserver[19];
# ----------------------------------------
RDcoordinateXmeters = Output(code_block_4.RDX)  # "RDcoordinateXmeters:double"
RDcoordinateYmeters = Output(code_block_4.RDY)  # "RDcoordinateYmeters:double"
GemeenteCodeKadaster = Output(code_block_4.out14)  # "GemeenteCodeKadaster:string"
SectieKadaster = Output(code_block_4.out8)  # "SectieKadaster:string"
SectieKadaster_2 = Output(code_block_4.out7)  # "SectieKadaster:string"
Longitude = Output(code_block_4.lon)  # "Longitude:string"
URLWebrequest = Output(code_block_4.url)
Latitude = Output(code_block_4.lat)  # "Latitude:string"
Postcode_2 = Output(code_block_4.out5)  # "Postcode:string"
Waterschap = Output(code_block_4.out16)  # "Waterschap:string"
Provincie = Output(code_block_4.out15)  # "Provincie:string"

# group: WINDGEBIED&PROVINCIE
code_block_5 = CodeBlock { "2"; "1_2"; "2"; "3"; "3"; "3"; "3"; "2"; "3"; "2"; "2"; }
create = List.Create(item0=code_block_5.out0, item1=code_block_5.out1, item2=code_block_5.out2, item3=code_block_5.out3, item4=code_block_5.out4, item5=code_block_5.out5, item6=code_block_5.out6, item7=code_block_5.out7, item8=code_block_5.out8, item9=code_block_5.out9, item10=code_block_5.out10)
code_block_6 = CodeBlock()
# ---------- code_block_6.designscript (11 lines) ----------
"Zuid-Holland";
"Noord-Holland";
"Zeeland";
"Noord-Brabant";
"Limburg";
"Gelderland";
"Utrecht";
"Flevoland";
"Overijssel";
"Friesland";
"Groningen";
# ----------------------------------------
create_2 = List.Create(item0=code_block_6.out0, item1=code_block_6.out1, item2=code_block_6.out2, item3=code_block_6.out3, item4=code_block_6.out4, item5=code_block_6.out5, item6=code_block_6.out6, item7=code_block_6.out7, item8=code_block_6.out8, item9=code_block_6.out9, item10=code_block_6.out10)
indexOf = List.IndexOf(list=create_2, element=code_block_4.out15)
getItemAtIndex = List.GetItemAtIndex(list=create, index=indexOf)
eq = getItemAtIndex == code_block_5.out1
toNumber = String.ToNumber(string=code_block_4.LLl)
code_block_7 = CodeBlock { 52.5; }
lt = toNumber < code_block_7
code_block_8 = CodeBlock { 1; 2; }
if_ = RefactoredIf(test=lt, true=code_block_8.out1, false=code_block_8.out0)
if_2 = RefactoredIf(test=eq, true=if_, false=getItemAtIndex)

Windgebied = Output(if_2)  # "Windgebied:double"
watch = Watch(getXMLNode)
list_create = List.Create(item0=code_block_4.RDX, item1=code_block_4.RDY, item2=code_block_4.out5, item3=code_block_4.kadastraal, item4=code_block_4.out7, item5=code_block_4.lon, item6=code_block_4.lat, item7=code_block_4.url, item8=code_block_4.out14, item9=code_block_4.out15, item10=code_block_4.out16)
ListOutput = Output(list_create)
