# Dynamo custom node GIS2BIM_GetSharedCoordinate.dyf (Dynamo 2.19.3.6394)
# category: GIS2BIM.Coordinates
# Get the current shared coordinate

categories = Categories("OST_ProjectBasePoint")  # graph input
all_elements_of_category = ElementsOfCategory(Category=categories)
code_block = CodeBlock { ["E/W","N/S","Elev","Angle to True North"]; }
getParameterValueByName = Element.GetParameterValueByName(element=all_elements_of_category, parameterName=code_block, lacing=Longest)
code_block_2 = CodeBlock { -1; }
dropItems = List.DropItems(list=getParameterValueByName, amount=code_block_2)
Scale = Input(Scale: double = 1000)  # GIS units are usually in meters
code_block_3 = CodeBlock(list=dropItems, scale=Scale) { DSCore.List.Flatten(list/scale); }
code_block_4 = CodeBlock(x=code_block_3) { x[0]; x[1]; x[2]; }
EastWest = Output(code_block_4.out0)  # "EastWest: double"
NorthSouth = Output(code_block_4.out1)  # "NorthSouth: double"
Elevation = Output(code_block_4.out2)  # "Elevation: double"
lastItem = List.LastItem(list=getParameterValueByName)
Angle_to_True_North = Output(lastItem)
