# Dynamo custom node GIS2BIM_ImageMakeTransparant.dyf (Dynamo 2.19.3.6394)
# category: GIS2BIM.Image
# Makes a System.Drawing.Bitmap transparant

Bitmap = Input(Bitmap: var[]..[])
python_script = Python(IN[0]=Bitmap)  # IronPython2
# ---------- python_script.python (17 lines) ----------
import sys
sys.path.append("C:\Program Files (x86)\IronPython 2.7\Lib")

import clr
import Pillow

clr.AddReference("System.Drawing")
clr.AddReference("System")
from System.Drawing import Image
from System.Drawing import Bitmap
from System.Drawing import Graphics
img= IN[0]

bmp2 = Bitmap(img)
bmp2.MakeTransparent()

OUT = bmp2
# ----------------------------------------
Bitmap_2 = Output(python_script)  # "Bitmap"
