# Dynamo custom node GIS2BIM_ImageToFile.dyf (Dynamo 3.3.0.6316)
# category: GIS2BIM.Image
# Write Image to file

ImageObject = Input(ImageObject: var[]..[])
FileNamePath = Input(FileNamePath: var[]..[])
python_script = Python(IN[0]=ImageObject, IN[1]=FileNamePath)  # CPython3
# ---------- python_script.python (23 lines) ----------
import sys

sys.path.append("C:\Program Files (x86)\IronPython 2.7\Lib")
from math import *
import itertools
from itertools import islice

import clr

clr.AddReference("System.Drawing")
from System.Drawing import Image
from System.Drawing import Bitmap
from System.Drawing import Graphics
from System.Drawing.Imaging import ImageFormat
from System.IO import Path
from os import listdir

bmp = IN[0]
filoc=IN[1]

bmp.Save(filoc, ImageFormat.Jpeg)

OUT = filoc
# ----------------------------------------
FileNamePath_2 = Output(python_script)  # "FileNamePath"
