# Dynamo custom node GIS2BIM_KadasterHouseNumbers.dyf (Dynamo 3.3.0.6316)
# category: GIS2BIM.DutchGEO
# Draw propertylines and place streetnames and housenumbers from the dutch kadaster
# packages: GIS2BIM for Dynamo 2.x 0.11.10, GIS2BIM for Dynamo 2.x 0.12.1

view = Input(view: var[]..[])
UrlWebrequestKadasterAnnotation = Input(UrlWebrequestKadasterAnnotation: var[]..[])
code_block = CodeBlock(a=UrlWebrequestKadasterAnnotation) { a[0]; a[1]; }
web_request = WebRequest(url=code_block.out0)
DeltaX = Input(DeltaX: var[]..[])  # X-value of transformation of points and polygons
DeltaY = Input(DeltaY: var[]..[])  # Y-value of transformation of points and polygons
code_block_2 = CodeBlock { 1000; }
createPointFromGML = Custom[GIS2BIM.CreatePointFromGML](XML=web_request, ModX=DeltaX, ModY=DeltaY, UnitsConversionFactor=code_block_2)  # package GIS2BIM for Dynamo 2.x; Create Points from space seperated GML

# group: GET DATA FOR HOUSENUMBER
string = StringInput(".//{http://kadastralekaart.geonovum.nl}tekst")  # graph input
python_script = Python(IN[0]=web_request, IN[1]=string)  # CPython3
# ---------- python_script.python (53 lines) ----------
import clr
import sys
clr.AddReference('ProtoGeometry')
from Autodesk.DesignScript.Geometry import *
sys.path.append("C:\Program Files (x86)\IronPython 2.7\Lib")
#from xml.parsers.expat import expat -- can't find this
import xml.etree.ElementTree as ET
#The inputs to this node will be stored as a list in the IN variables.
xml = IN[0]
xpathstr = IN[1]

root = ET.fromstring(xml)

xpathfound = root.findall(xpathstr)
#xparentstr = xpathstr + "/.."
#xparentfound = root.findall(xpathstr+"/..")
xtags, xtext, xcountattrib, xattrib, xattvals, xcountiter, xitertags, xitervals, xparents = [], [], [], [], [], [], [], [], []
for x in xpathfound:
	xtags.append(x.tag)
	if x.text:
		try:
			xtext.append(x.text)
		except:
			xtext.append("_none_")
	else:
		xtext.append("_none_")
	if x.keys():
		xcountattrib.append(len(x.items()))
		for name, value in x.items():
			xattrib.append(name)
			xattvals.append(value)
#PARENT CODE BELOW IS TOO SLOW
#			try:
#				xparents.append(root.find(xpathstr + "/" + name + "/.."))
#			except:
#				xparents.append("no parent found")
	else:
		xcountattrib.append(1)
		xattrib.append("_none_")
		xattvals.append("_none_")

#THIS METHOD NOT GREAT
#	if x.iter():
#		xcountiter.append(len(x.iter()))
#		for name, value in x.iter():
#			xitertags.append(name)
#			xitervals.append(value)
#for y in xparentfound:
#	xparents.append(y.tag)

OUT = root, str(root), xpathfound, xtags, xtext, xcountattrib, xattrib, xattvals
#, xparents 
#, xparentfound#, xparents#, xcountiter, xitertags, xitervals
# ----------------------------------------
code_block_3 = CodeBlock { 4; }
getItemAtIndex = List.GetItemAtIndex(list=python_script, index=code_block_3)
flatten = List.Flatten(list=getItemAtIndex)
string_2 = StringInput(".//{http://kadastralekaart.geonovum.nl}hoek")  # graph input
python_script_2 = Python(IN[0]=web_request, IN[1]=string_2)  # CPython3; same code as python_script
code_block_4 = CodeBlock { 4; }
getItemAtIndex_2 = List.GetItemAtIndex(list=python_script_2, index=code_block_4)
flatten_2 = List.Flatten(list=getItemAtIndex_2)

TextTypeHousenumber = Input(TextTypeHousenumber: var[]..[])
byName = TextNoteType.ByName(name=TextTypeHousenumber)

# group: PLACE TEXTNOTE FOR HOUSENUMBER
string_3 = StringInput("Center")  # graph input
toNumber = String.ToNumber(string=flatten_2)

code_block_5 = CodeBlock(a=toNumber) { a*-1; }

# group (continued): PLACE TEXTNOTE FOR HOUSENUMBER
byLocation = TextNote.ByLocation(view=view, location=createPointFromGML, text=flatten, alignment=string_3, type=byName, rotation=code_block_5)

web_request_2 = WebRequest(url=code_block.out1)
code_block_6 = CodeBlock { 1000; }
createPointFromGML_2 = Custom[GIS2BIM.CreatePointFromGML](XML=web_request_2, ModX=DeltaX, ModY=DeltaY, UnitsConversionFactor=code_block_6)

# group: GET DATA FOR OPENBARE RUIMTENAAM
string_4 = StringInput(".//{http://kadastralekaart.geonovum.nl}tekst")  # graph input
python_script_3 = Python(IN[0]=web_request_2, IN[1]=string_4)  # CPython3; same code as python_script
code_block_7 = CodeBlock { 4; }
getItemAtIndex_3 = List.GetItemAtIndex(list=python_script_3, index=code_block_7)
flatten_3 = List.Flatten(list=getItemAtIndex_3)
string_5 = StringInput(".//{http://kadastralekaart.geonovum.nl}hoek")  # graph input
python_script_4 = Python(IN[0]=web_request_2, IN[1]=string_5)  # CPython3; same code as python_script
code_block_8 = CodeBlock { 4; }
getItemAtIndex_4 = List.GetItemAtIndex(list=python_script_4, index=code_block_8)
flatten_4 = List.Flatten(list=getItemAtIndex_4)

TextTypeStreetname = Input(TextTypeStreetname: var[]..[])
byName_2 = TextNoteType.ByName(name=TextTypeStreetname)

# group: PLACE TEXTNOTE FOR STREETNAME
flatten_5 = List.Flatten(list=flatten_3)
boolean = BoolSelector(true)  # graph input
changeCase = String.ChangeCase(string=flatten_5, upper=boolean)
string_6 = StringInput("Center")  # graph input
flatten_6 = List.Flatten(list=flatten_4)
toNumber_2 = String.ToNumber(string=flatten_6)

code_block_9 = CodeBlock(a=toNumber_2) { a*-1; }

# group (continued): PLACE TEXTNOTE FOR STREETNAME
byLocation_2 = TextNote.ByLocation(view=view, location=createPointFromGML_2, text=changeCase, alignment=string_6, type=byName_2, rotation=code_block_9)
