# Dynamo custom node GIS2BIM_TransformCRS_epsg.dyf (Dynamo 2.19.3.6394)
# category: GIS2BIM.Coordinates
# Uses the API of http://epsg.io to transform Coordinate Reference Systems

xCoordinate = Input(xCoordinate: string)  # X-coordinate of the source Coordinate Reference System
yCoordinate = Input(yCoordinate: string)  # Y-coordinate of the source Coordinate Reference System
SourceCRS = Input(SourceCRS: string = "4326")  # EPSG_code of the source Coordinate Reference System
TargetCRS = Input(TargetCRS: string)  # EPSG_code of the target Coordinate Reference System
ApiKey = Input(ApiKey: string)
code_block = CodeBlock(x=xCoordinate, y=yCoordinate, SourceCrs=SourceCRS, TargetCrs=TargetCRS, apikey=ApiKey) { "https://api.maptiler.com/coordinates/transform/"+x+","+y+".json?s_srs="+SourceCrs+"&t_srs="+TargetCrs+"&key="+apikey; }
web_request = WebRequest(url=code_block)
string = StringInput(":")  # graph input
split = String.Split(string=web_request, separator0=string)
code_block_2 = CodeBlock { 3; 4; }
getItemAtIndex = List.GetItemAtIndex(list=split, index=code_block_2.out0)
code_block_3 = CodeBlock { ","; }
split_2 = String.Split(string=getItemAtIndex, separator0=code_block_3)
code_block_4 = CodeBlock(l=split_2) { l[0]; }
toNumber = String.ToNumber(string=code_block_4)
Xtransformed = Output(toNumber)  # "Xtransformed: double"
getItemAtIndex_2 = List.GetItemAtIndex(list=split, index=code_block_2.out1)
split_3 = String.Split(string=getItemAtIndex_2, separator0=code_block_3)
code_block_5 = CodeBlock(l=split_3) { l[0]; }
toNumber_2 = String.ToNumber(string=code_block_5)
Ytransformed = Output(toNumber_2)  # "Ytransformed: double"
URL = Output(code_block)  # "URL: string"
watch = Watch(code_block)
