# Dynamo graph 3BM_RG_UpdateColorsEfficiency.dyn (Dynamo 2.19.3.6394)
# packages: archi-lab.net 2024.217.1024, LunchBox for Dynamo 2018.7.6

# group: filter all masses (remove existing (90) and 1 workset)
categories = Categories("OST_Mass")
all_elements_of_category = ElementsOfCategory(Category=categories)
name = Element.Name(element=all_elements_of_category)
code_block = CodeBlock { "90"; true; }
contains = String.Contains(string=name, searchFor=code_block.out0, ignoreCase=code_block.out1)
code_block_2 = CodeBlock { "Workset"; }
getParameterValueByName = Element.GetParameterValueByName(element=all_elements_of_category, parameterName=code_block_2)
worksets = WorksetUi("mass")
id = archilab.Revit.Elements.Workset.Id(workset=worksets)
contains_2 = List.Contains(list=getParameterValueByName@L1, item=id)
list_create = List.Create(item0=contains, item1=contains_2)
code_block_3 = CodeBlock(t1=list_create) { t2 = List.Transpose(t1); AllFalse(t2<1>) != true; }
filterByBoolMask = List.FilterByBoolMask(list=all_elements_of_category, mask=code_block_3.out1)

# group: select excel file and wait for revit selection
file_path = Filename("LIJSTEN\Residuele grondwaarde berekening_basis.xlsm")
file_from_path = FileObject(path=file_path)
code_block_4 = CodeBlock { "efficientie"; false; false; 1; }
importExcel = Data.ImportExcel(file=file_from_path, sheetName=code_block_4.out0, readAsStrings=code_block_4.out1, showExcel=code_block_4.out2)

# group: filter only typologies from excel and gets parameters
code_block_5 = CodeBlock(l=importExcel) { "typologie"; l[0]; }
getParameterValueByName_2 = Element.GetParameterValueByName(element=filterByBoolMask.in, parameterName=code_block_5.out0, lacing=CrossProduct)
removeNulls = Lists.Manage.RemoveNulls(Data=code_block_5.out1)
contains_3 = Custom[String.Contains](stringList=getParameterValueByName_2, filterList=removeNulls.Cleaned)  # package archi-lab.net; This node takes a list of strings and checks if any string contains a matching string from filter input.
filterByBoolMask_2 = List.FilterByBoolMask(list=filterByBoolMask.in, mask=contains_3)
watch = Watch(filterByBoolMask_2.in)
code_block_6 = CodeBlock { ["typologie","woningen_aantal", "mass_vloeren_aantal", "woningen_beukmaat"]; }
getParameterValueByName_3 = Element.GetParameterValueByName(element=watch, parameterName=code_block_6, lacing=CrossProduct)

# group: revit input
watch_2 = Watch(watch)
code_block_7 = CodeBlock { "efficientie"; }
getParameterValueByName_4 = Element.GetParameterValueByName(element=watch_2, parameterName=code_block_7)
minimumItem = List.MinimumItem(list=getParameterValueByName_4)
sub = getParameterValueByName_4 - minimumItem
round = Math.Round(number=sub)

# group: color select
flatten = List.Flatten(list=round)
color_palette = ColorPalette({R: 0, G: 100, B: 0, A: 255})
color_palette_2 = ColorPalette({R: 255, G: 192, B: 0, A: 255})
list_create_2 = List.Create(item0=color_palette, item1=color_palette_2)
maximumItem = List.MaximumItem(list=round)
code_block_8 = CodeBlock(n=maximumItem) { 0..1..#n+1; }
color_range = ColorRange(colors=list_create_2, indices=code_block_8, value=code_block_8)
python_script = Python(IN[0]=flatten, IN[1]=color_range)  # IronPython2
# ---------- python_script.python (22 lines) ----------
# Enable Python support and load DesignScript library
import clr
clr.AddReference('ProtoGeometry')
from Autodesk.DesignScript.Geometry import *

# The inputs to this node will be stored as a list in the IN variables.
dataEnteringNode = IN

aElements= IN[0]
aColors= IN[1]
aOutput= []


# Place your code below this line
	
for i in aElements:
	index=int(i)-1
	color = aColors[index]
	aOutput.append(color)
	
# Assign your output to the OUT variable.
OUT = [aOutput]
# ----------------------------------------
flatten_2 = List.Flatten(list=python_script)
overrideColorInView = Element.OverrideColorInView(element=watch_2, color=flatten_2)

# group: update efficientie parameters (data from excel)
code_block_9 = CodeBlock { "efficientie"; }
python_script_2 = Python(IN[0]=getParameterValueByName_3, IN[1]=importExcel)  # IronPython2
# ---------- python_script_2.python (55 lines) ----------
import clr
clr.AddReference('ProtoGeometry')
from Autodesk.DesignScript.Geometry import *
dataEnteringNode = IN

aMassesRevit= IN[0]
aExcel= IN[1]
aOUT= []
aOUTDebug= []


def Excelcollumn(sTypologyRevit, sOntsluitingRevit):
	aTypologyExcel = aExcel[0]
	aOntsluitingExcel = aExcel[1]
#	y is de collumn als integer
	for y in range(len(aTypologyExcel)):
		if aTypologyExcel[y] == sTypologyRevit:
			if aOntsluitingExcel[y] == sOntsluitingRevit:
#				aOUTDebug.append(y)
				return  y
			
def ExcelCollumnBeukmatenCheck(iBeukmaat):
	aBeukmaten = aExcel[11]
# 	x is de collomn als integer
	for x in range(len(aBeukmaten)):
#		aOUTDebug.append(aBeukmaten[x])
		if aBeukmaten[x] == iBeukmaat:
			return  x

#	aMasses komt uit het revit bestand en bevat de [typologie, beukmaat]
for mass in aMassesRevit:
	sType= mass[0]
# 	grondgebonden gaat per aantal units:
	if sType == "grondgebonden":
		iBeukmaat = int(mass[3])
# 		mass[1] is aantaal units
		iRow = int(mass[1]) + 11	
		iCollumn = (ExcelCollumnBeukmatenCheck(iBeukmaat))
#		aOUTDebug.append(str(iBeukmaat) + ": " + str(iCollumn) + "," + str(iRow))
		aOUT.append(aExcel[iRow][iCollumn])
#	torens gaan peer aantal lagen
	elif "toren" in sType:
		iCollumn = Excelcollumn(sType, "false")
#		aOUTDebug.append(mass[2])
		iRow = int(mass[2]) + 11
		aOUT.append(aExcel[iRow][iCollumn])
#	De rest heeft een fixed efficiency in rij 12 van het excelblad
	else:
		iCollumn = Excelcollumn(sType, "false")
		if mass[2] is not None:
#			aOUTDebug.append(mass[2])
			iRow = 12
			aOUT.append(aExcel[iRow][iCollumn])

OUT = aOUT
# ----------------------------------------
setParameterByName = Element.SetParameterByName(element=watch, parameterName=code_block_9, value=python_script_2)
flatten_3 = List.Flatten(list=python_script_2)
