# Dynamo graph 3BM_RG_UpdateColorsTypology.dyn (Dynamo 2.19.3.6394)
# packages: Clockwork for Dynamo 2.x 2.6.0, archi-lab.net 2023.213.1523

# group: masses
categories = Categories("OST_Mass")
all_elements_of_category = ElementsOfCategory(Category=categories)
name = Family.Name(family=all_elements_of_category)
code_block = CodeBlock { "90"; true; }
contains = String.Contains(string=name, searchFor=code_block.out0, ignoreCase=code_block.out1)
filterByBoolMask = List.FilterByBoolMask(list=all_elements_of_category, mask=contains)

watch = Watch(filterByBoolMask.out)
file_path = Filename("LIJSTEN\Residuele grondwaarde berekening_basis.xlsm")

# group: get corresponding colors (data from excel)
code_block_2 = CodeBlock { ["typologie","woningen_beukmaat"]; }
getParameterValueByName = Element.GetParameterValueByName(element=watch, parameterName=code_block_2, lacing=CrossProduct)
file_from_path = FileObject(path=file_path)
code_block_3 = CodeBlock { "efficientie"; false; false; }
importExcel = Data.ImportExcel(file=file_from_path, sheetName=code_block_3.out0, readAsStrings=code_block_3.out1, showExcel=code_block_3.out2)
code_block_4 = CodeBlock(l=importExcel) { l[0]; l[10]; l[11]; }
python_script = Python(IN[0]=getParameterValueByName, IN[1]=code_block_4.out0, IN[2]=code_block_4.out1, IN[3]=code_block_4.out2)  # IronPython2
# ---------- python_script.python (53 lines) ----------
# Enable Python support and load DesignScript library
import clr
clr.AddReference('ProtoGeometry')
clr.AddReference('RevitAPI')
from Autodesk.DesignScript.Geometry import *
from Autodesk.Revit.DB import *
import Autodesk

# The inputs to this node will be stored as a list in the IN variables.
dataEnteringNode = IN

aMasses= IN[0]
aExcelTypologie=IN[1]
aExcelColor=IN[2]
aExcelBeukmaat=IN[3]
aOUT=[]
aOUTdebug=[]
iIndex=0
# Place your code below this line

def Excel(sMassTypology):
	for i in range (len(aExcelTypologie)):
		if aExcelTypologie[i] == sMassTypology:
			return  aExcelColor[i]
			
def Excelgrondgebonden(sMassBeukmaat):
	for i in range (len(aExcelBeukmaat)):
#		aOUTdebug.append(aExcelBeukmaat[i])
		if aExcelBeukmaat[i] == int(sMassBeukmaat):
			return  aExcelColor[i]
	
for i in range (len(aMasses)):
	if aMasses[i][0] == "grondgebonden":
		aOUTdebug.append(aMasses[i][1])
		aRGB = []
		sRGB = Excelgrondgebonden(aMasses[i][1])
#		aOUTdebug.append(sRGB)
		aRGB = sRGB.split(",")
		color = Autodesk.Revit.DB.Color(int(aRGB[0]),int(aRGB[1]),int(aRGB[2]))
		aOUT.append(color)
	else:
#		aOUT.append(Excel(aMasses[i][0]))
		aRGB =[]
		sRGB = Excel(aMasses[i][0])
#		aOUTdebug.append(str(aMasses[i][0]) + " - " + str(sRGB))
#		aOUTdebug.append(aMasses[i][0]+ ": " + str(sRGB))
		aRGB = sRGB.split(",")
		color = Autodesk.Revit.DB.Color(int(aRGB[0]),int(aRGB[1]),int(aRGB[2]))
		aOUT.append(color)
		
	
# Assign your output to the OUT variable.
OUT = aOUT
# ----------------------------------------

watch_2 = Watch(python_script)

# group: zonder verkeersruimte en buitenruimte
code_block_5 = CodeBlock { "typologie"; ["erkeersruimte", "uiten"]; }
getParameterValueByName_2 = Element.GetParameterValueByName(element=filterByBoolMask.out, parameterName=code_block_5.out0)
contains_2 = Custom[String.Contains](stringList=getParameterValueByName_2, filterList=code_block_5.out1)  # package archi-lab.net; This node takes a list of strings and checks if any string contains a matching string from filter input.
filterByBoolMask_2 = List.FilterByBoolMask(list=filterByBoolMask.out, mask=contains_2)

flatten = List.Flatten(list=python_script)
toDynamoColor = Custom[Color.ToDynamoColor](RevitColor=flatten, lacing=CrossProduct)  # package Clockwork for Dynamo 2.x; Converts Revit colors into Dynamo colors
overrideColorInView = Element.OverrideColorInView(element=watch, color=toDynamoColor)
code_block_6 = CodeBlock { "Material"; }
code_block_7 = CodeBlock { "Default"; }
byName = Material.ByName(name=code_block_7)
set_type_parameter = Custom[Set Type Parameter](element=overrideColorInView, parameterName=code_block_6, parameterValue=byName)  # frozen; package archi-lab.net; This node will set a type parameter for an element.
