# Dynamo graph GIS2BIM_AHN_PTS2Revit_v7.dyn (Dynamo 3.3.0.6316)
# packages: GIS2BIM for Dynamo 2.x 0.11.15, spring nodes 203.1.0, Genius Loci 2021.2.3

# group: input PTS
file_path = Filename("..\..\..\..\1_3BM_cooperatie\2645 Kantoor Burgemeester de Raadtsingel 31 Dordrecht\70_BIM\GISDATA\ahn\ahn3.pts")

# group: create topo
code_block = CodeBlock { 4; }
GIS2BIM_PTStoPoints = Custom[GIS2BIM_PTStoPoints](PTSFile=file_path, NumberOfColumns=code_block)  # package GIS2BIM for Dynamo 2.x; convert a pts-file(ascii) to dynamo points
code_block_2 = CodeBlock { false; }
ꟿ_points_pruneduplicates = Custom[ꟿ Points.PruneDuplicates+](points=GIS2BIM_PTStoPoints.Points, keepDuplicateZ=code_block_2)  # package spring nodes; An alternative to the built in node, that performs faster at the price of loosing the order of the points. All floating point valies are rounded to the nearest 4 decimal points. You can optionally remove duplicate Z values by setting "keepDuplicateZ" to false.
byPoints = Topography.ByPoints(points=ꟿ_points_pruneduplicates)

# group: background picture
boolean = BoolSelector(false)
ꟿ_document_centralpath = Custom[ꟿ Document.CentralPath](refresh=boolean)  # package spring nodes; If the document is workshared, the node returns the path to the central document as a string. Otherwise a null value will be returned.
directoryName = FileSystem.DirectoryName(path=ꟿ_document_centralpath)
string = StringInput("\GISDATA\bgtachtergrond_cropped_flipped.jpg")
code_block_3 = CodeBlock(path=directoryName, file=string) { path+file; }

# group: create material asset
code_block_4 = CodeBlock { "KC_maaiveld_BGT"; }
byName = Material.ByName(name=code_block_4)
material_change_texture_path = Custom[Material Change Texture Path](material=byName, FilePath=code_block_3)  # package Genius Loci; Works only in Revit 2018.1 and later. The material must already have an assigned texture. Works only with the "main" image.(In the Generic/Wood/Masonry/... Properties tab)

# group: set material
code_block_5 = CodeBlock { "Material"; }
byName_2 = Material.ByName(name=code_block_4)
setParameterByName = Element.SetParameterByName(element=byPoints, parameterName=code_block_5, value=byName_2)
