# Dynamo graph GIS2BIM_BGT_V7.dyn (Dynamo 3.3.0.6316)
# packages: archi-lab.net 2022.210.1022, GIS2BIM for Dynamo 2.x 0.11.24, LunchBox for Dynamo 2018.7.6, Clockwork for Dynamo 2.x 2.6.0

# group: get morton
categories = Categories("OST_ProjectBasePoint")  # graph input
all_elements_of_category = ElementsOfCategory(Category=categories)
code_block = CodeBlock { ["E/W","N/S","Elev","Angle to True North"]; 1000; }
getParameterValueByName = Element.GetParameterValueByName(element=all_elements_of_category, parameterName=code_block.out0, lacing=Longest)
code_block_2 = CodeBlock(l=getParameterValueByName, scale=code_block.out1)
# ---------- code_block_2.designscript (7 lines) ----------
EastWest=l[0]/scale;
NorthSouth=l[1]/scale;
Elevation=l[2]/scale;
AngletoTrueNorth=l[3]/scale;
ModX: double = -100000;
ModY: double = 200000;
TileDimension: double = 2000;
# ----------------------------------------
python_script = Python(IN[0]=code_block_2.EastWest, IN[1]=code_block_2.NorthSouth, IN[2]=code_block_2.ModX, IN[3]=code_block_2.ModY, IN[4]=code_block_2.TileDimension)  # CPython3
# ---------- python_script.python (29 lines) ----------
import clr
clr.AddReference('ProtoGeometry')
from Autodesk.DesignScript.Geometry import *
import sys
sys.path.append("C:\Program Files (x86)\IronPython 2.7\Lib")

import math

#The inputs to this node will be stored as a list in the IN variables.
dataEnteringNode = IN
X = IN[0]
Y = IN[1]
Xmod=IN[2]
Ymod=IN[3]
TILE=IN[4]

x = bin(int(math.floor(((X - Xmod)/TILE))))
y = bin(int(math.floor(((Y - Ymod)/TILE))))

x = str(x[2:])
y = str(y[2:])

res = "".join(i + j for i, j in zip(y, x))
z=(res)

z = int(z, 2)

#Assign your output to the OUT variable.
OUT = z
# ----------------------------------------

# group: path + mortoncode
filePaths = Custom[FilePaths]()  # Gets the filepaths from the model.
string = StringInput("\")
code_block_3 = CodeBlock(path=filePaths.02_central_modeldir, slash=string) { path+slash+"GISDATA"+slash; }
string_from_object = FromObject(obj=python_script)
string_2 = StringInput("\")  # graph input
concat = String.Concat(string0=code_block_3, string1=string_from_object, string2=string_2)

# group: GML INPUT
bgt_lagen = CodeBlock()
# ---------- bgt_lagen.designscript (39 lines) ----------
//regions:
"bgt_begroeidterreindeel";
"bgt_functioneelgebied";
"bgt_onbegroeidterreindeel";
"bgt_openbareruimte";
"bgt_overigbouwwerk";
"bgt_pand";
"bgt_vegetatieobject";
"bgt_waterdeel";
"bgt_wegdeel";
"bgt_overbruggingsdeel";
"bgt_ondersteunendwaterdeel";
"bgt_ondersteunendwegdeel";

//points:
"bgt_vegetatieobject";
"bgt_paal";

//"bgt_bak";
//"bgt_bord";
//"bgt_buurt";
//"bgt_gebouwinstallatie";
//"bgt_installatie";
//"bgt_kast";
//"bgt_kunstwerkdeel";
//"bgt_mast";
//"bgt_ongeclassificeerdobject";
//"bgt_openbareruimtelabel";
//"bgt_overigescheiding";
//"bgt_paal";
//"bgt_put";
//"bgt_scheiding";
//"bgt_sensor";
//"bgt_spoor";
//"bgt_straatmeubilair";
//"bgt_tunneldeel";
//"bgt_waterinrichtingselement";
//"bgt_weginrichtingselement";
//"bgt_wijk";
# ----------------------------------------
create = List.Create(item0=bgt_lagen.out0, item1=bgt_lagen.out1, item2=bgt_lagen.out2, item3=bgt_lagen.out4, item4=bgt_lagen.out5)
create_2 = List.Create(item0=bgt_lagen.out7, item1=bgt_lagen.out8, item2=bgt_lagen.out9, item3=bgt_lagen.out10, item4=bgt_lagen.out11)
join = List.Join(list0=create, list1=create_2)
create_3 = List.Create(item0=bgt_lagen.out12, item1=bgt_lagen.out13)
create_4 = List.Create(item0=bgt_lagen.out0)

code_block_4 = CodeBlock(Listbgtlagen=join) { Listbgtlagen; }
bbox = CodeBlock { 500; }
code_block_5 = CodeBlock(path=concat, file=code_block_4, bbox=bbox) { path + file + ".gml"; bbox; }

# group: filter recent registrations
readText = FileSystem.ReadText(file=code_block_5.out0)
code_block_6 = CodeBlock { "cityObjectMember"; "gml:featureMember"; "imgeo-s:eindRegistratie"; }

getXMLNode = Lists.DataSets.GetXMLNode(XML=readText, TagName=code_block_6.out0)

# group (continued): filter recent registrations
contains = String.Contains(string=getXMLNode, searchFor=code_block_6.out2)
filterByBoolMask = List.FilterByBoolMask(list=getXMLNode, mask=contains)
code_block_7 = CodeBlock(aXml=filterByBoolMask.out, aBGTlagen=code_block_4)
# ---------- code_block_7.designscript (5 lines) ----------
bool1 = DSCore.List.IsEmpty(aXml@@L2<1>);
aXMLsorted=List.FilterByBoolMask(aXml, bool1);
DesignScript.Dictionary.ValueAtKey(aXMLsorted, "out");
aBGTssorted = List.FilterByBoolMask(aBGTlagen, bool1);
DesignScript.Dictionary.ValueAtKey(aBGTssorted, "out");
# ----------------------------------------

# group: filter coords within bbox
code_block_8 = CodeBlock { "gml:posList"; "gml:exterior"; " "; }
getXMLNode_2 = Lists.DataSets.GetXMLNode(XML=code_block_7.out2, TagName=code_block_8.out1)
getXMLNode_3 = Lists.DataSets.GetXMLNode(XML=getXMLNode_2, TagName=code_block_8.out0)
split = String.Split(string=getXMLNode_3, separator0=code_block_8.out2)
code_block_9 = CodeBlock { 2; 1; 0; }
xCoords = List.TakeEveryNthItem(list=split@@L2, n=code_block_9.out0, offset=code_block_9.out1)
string_tonumber_x = String.ToNumber(string=xCoords)
flatten = List.Flatten(list=string_tonumber_x@@L3)
GIS2BIM_GetSharedCoordinate = Custom[GIS2BIM_GetSharedCoordinate]()  # package GIS2BIM for Dynamo 2.x; Get the current shared coordinate
code_block_10 = CodeBlock(eastwest=GIS2BIM_GetSharedCoordinate.EastWest, bbox=code_block_5.bbox, northsouth=GIS2BIM_GetSharedCoordinate.NorthSouth) { xmin=eastwest-bbox/2; xmax=eastwest+bbox/2; ymin=northsouth-bbox/2; ymax=northsouth+bbox/2; }
yCoords = List.TakeEveryNthItem(list=split@@L2, n=code_block_9.out0, offset=code_block_9.out2)
string_tonumber_y = String.ToNumber(string=yCoords)
# note: level 6 = list
# level 5 = gml
# level 4 = featuremember
# level 3 = polygon
# level 2 = linesegments
# level 1 = points
flatten_2 = List.Flatten(list=string_tonumber_y@@L3)
check_coords_within_bbox = CodeBlock(xCoord=flatten, xmin=code_block_10.xmin, xmax=code_block_10.xmax, yCoord=flatten_2, ymin=code_block_10.ymin, ymax=code_block_10.ymax)
# ---------- check_coords_within_bbox.designscript (5 lines) ----------
bool1 = xCoord>xmin && xCoord<xmax
&& yCoord>ymin && yCoord<ymax;
DSCore.List.AnyTrue(bool1@@L3<1>);
"Xmin:"+ xmin + " Xmax:"+ xmax +
" Ymin:"+ ymin + " Ymax:"+ ymax;
# ----------------------------------------

# group: information about the region
code_block_11 = CodeBlock(l=flatten_2, aGML=code_block_7.out4) { aantal=List.Count(l@@L4<1>); List.Cycle(aGML<1>, aantal<1>); }
code_block_12 = CodeBlock { "imgeo:lokaalID"; "imgeo:LV-publicatiedatum"; }
getXMLNode_4 = Lists.DataSets.GetXMLNode(XML=code_block_7.out2, TagName=code_block_12.out0)
getXMLNode_5 = Lists.DataSets.GetXMLNode(XML=code_block_7.out2, TagName=code_block_12.out1)

# group: filter featuremembers with point within bbox
# note: level 6 = list
# level 5 = gml
# level 4 = featuremember
# level 3 = polygon
# level 1 = points
# note: linessegments samengevoegd:
# level 5 = list
# level 4 = gml
# level 3 = featuremember
# level 2 = polygon
# level 1 = points
list_filterbyboolmask_x = List.FilterByBoolMask(list=flatten@L4, mask=check_coords_within_bbox.out1, lacing=Shortest)
code_block_13 = CodeBlock { 0; }
list_filterbyboolmask_y = List.FilterByBoolMask(list=flatten_2@L4, mask=check_coords_within_bbox.out1, lacing=Shortest)
list_filterbyboolmask_ids = List.FilterByBoolMask(list=code_block_11.out1, mask=check_coords_within_bbox.out1)
list_filterbyboolmask_ids_2 = List.FilterByBoolMask(list=getXMLNode_4, mask=check_coords_within_bbox.out1, lacing=Shortest)
list_filterbyboolmask_ids_3 = List.FilterByBoolMask(list=getXMLNode_5, mask=check_coords_within_bbox.out1, lacing=Shortest)

# group: make lists simpler and remove empty ones
flatten_3 = List.Flatten(list=list_filterbyboolmask_x.in@L3, amount=code_block_13)
flatten_4 = List.Flatten(list=list_filterbyboolmask_y.in@L3, amount=code_block_13)
flatten_5 = List.Flatten(list=list_filterbyboolmask_ids.in)
flatten_6 = List.Flatten(list=list_filterbyboolmask_ids_2.in@L4)
flatten_7 = List.Flatten(list=list_filterbyboolmask_ids_3.in@L4)

# group: create coordinates from basepoint
code_block_14 = CodeBlock(x=flatten_3, rdx=GIS2BIM_GetSharedCoordinate.EastWest, y=flatten_4, rdy=GIS2BIM_GetSharedCoordinate.NorthSouth) { xb=x-rdx; yb=y-rdy; Math.Round(xb*1000); Math.Round(yb*1000); }

# group: create polycurve an remove those who arent creatable
code_block_15 = CodeBlock { 0; true; }
byCoordinates = Point.ByCoordinates(x=code_block_14.out2@@L3, y=code_block_14.out3, z=code_block_15.out0, lacing=Longest)
pruneDuplicates = Point.PruneDuplicates(points=byCoordinates@@L2, tolerance=code_block_15.out0)
byPoints = PolyCurve.ByPoints(points=pruneDuplicates@@L3, connectLastToFirst=code_block_15.out1)

# group: output
isNull = Object.IsNull(object=byPoints@@L1)
allFalse = List.AllFalse(list=isNull@L2)
filterByBoolMask_2 = List.FilterByBoolMask(list=byPoints, mask=allFalse)
code_block_16 = CodeBlock(polycurves=filterByBoolMask_2.in) { polycurves; }
filterByBoolMask_3 = List.FilterByBoolMask(list=flatten_6, mask=allFalse)
code_block_17 = CodeBlock(ids=filterByBoolMask_3.in) { ids; }
filterByBoolMask_4 = List.FilterByBoolMask(list=flatten_7, mask=allFalse)
code_block_18 = CodeBlock(tijdstip=filterByBoolMask_4.in) { tijdstip; }

# group: filter empty gml files
isNull_2 = Object.IsNull(object=code_block_16)
allFalse_2 = List.AllFalse(list=isNull_2@L1)
list_filterbyboolmask_polycurves = List.FilterByBoolMask(list=code_block_16, mask=allFalse_2)
list_filterbyboolmask_filled = List.FilterByBoolMask(list=flatten_5, mask=allFalse_2)  # "List.FilterByBoolMask (filled region names)"
list_filterbyboolmask_ids_4 = List.FilterByBoolMask(list=code_block_17, mask=allFalse_2)
list_filterbyboolmask_ids_5 = List.FilterByBoolMask(list=code_block_18, mask=allFalse_2)

# group: create filledregions
views = Views("GIS2BIM_BGT")
curves = PolyCurve.Curves(polyCurve=list_filterbyboolmask_polycurves.in)
byName = FilledRegionType.ByName(name=list_filterbyboolmask_filled.in)
byCurves = FilledRegion.ByCurves(view=views, boundary=curves, regionType=byName, lacing=Longest)

code_block_19 = CodeBlock(l=byCurves) { List.Flatten(l); }

# group: change bounderylines
line_styles = LineStyleUi("bgt_bounderyline")
set_boundery_lines = Python(IN[0]=code_block_19, IN[1]=line_styles)  # CPython3
# ---------- set_boundery_lines.python (32 lines) ----------
import clr
clr.AddReference('ProtoGeometry')
from Autodesk.DesignScript.Geometry import *

# Import DocumentManager and TransactionManager
clr.AddReference("RevitServices")
import RevitServices
from RevitServices.Persistence import DocumentManager
from RevitServices.Transactions import TransactionManager

# Import RevitAPI
clr.AddReference("RevitAPI")
import Autodesk
from Autodesk.Revit.DB import *

doc = DocumentManager.Instance.CurrentDBDocument
uiapp = DocumentManager.Instance.CurrentUIApplication
app = uiapp.Application


region = UnwrapElement(IN[0])
ids = UnwrapElement(IN[1])

TransactionManager.Instance.EnsureInTransaction(doc)
#for region in regions:
for r in region:
    FilledRegion.SetLineStyleId(r, ids.Id)

TransactionManager.Instance.TransactionTaskDone()

#Assign your outputs to the OUT variable
OUT = region
# ----------------------------------------

# group: set parameters comment-ids
code_block_20 = CodeBlock(aIds=list_filterbyboolmask_ids_4.in, aTijd=list_filterbyboolmask_ids_5.in) { "Comments"; List.Flatten(aIds); "afgifte_omschrijving"; List.Flatten(aTijd); }
setParameterByName = Element.SetParameterByName(element=code_block_19, parameterName=code_block_20.out0, value=code_block_20.out1)
setParameterByName_2 = Element.SetParameterByName(element=code_block_19, parameterName=code_block_20.out2, value=code_block_20.out3)

code_block_21 = CodeBlock(path=concat, file=create_3) { path + file + ".gml"; }  # frozen

# group: filter recent registrations
readText_2 = FileSystem.ReadText(file=code_block_21)
code_block_22 = CodeBlock { "cityObjectMember"; "gml:featureMember"; "imgeo-s:eindRegistratie"; "gml:pos"; }
getXMLNode_6 = Lists.DataSets.GetXMLNode(XML=readText_2, TagName=code_block_22.out1)
contains_2 = String.Contains(string=getXMLNode_6, searchFor=code_block_22.out2)
filterByBoolMask_5 = List.FilterByBoolMask(list=getXMLNode_6, mask=contains_2)

getXMLNode_7 = Lists.DataSets.GetXMLNode(XML=filterByBoolMask_5.out, TagName=code_block_22.out3)

# group: Control
watch = Watch(getXMLNode_7)
isEmpty = List.IsEmpty(list=watch@@L2)
filterByBoolMask_6 = List.FilterByBoolMask(list=watch, mask=isEmpty)

code_block_23 = CodeBlock { " "; }
split_2 = String.Split(string=filterByBoolMask_6.out, separator0=code_block_23)
firstItem = List.FirstItem(list=split_2@@L2)
toNumber = String.ToNumber(string=firstItem@@L1)
flatten_8 = List.Flatten(list=toNumber@@L3)
lastItem = List.LastItem(list=split_2@@L2)
toNumber_2 = String.ToNumber(string=lastItem@@L1)
flatten_9 = List.Flatten(list=toNumber_2@@L3)
check_coords_within_bbox_2 = CodeBlock(eastwest=GIS2BIM_GetSharedCoordinate.EastWest, bbox=code_block_5.bbox, northsouth=GIS2BIM_GetSharedCoordinate.NorthSouth, xCoord=flatten_8, yCoord=flatten_9)
# ---------- check_coords_within_bbox_2.designscript (7 lines) ----------
xmin=eastwest-bbox/2;
xmax=eastwest+bbox/2;
ymin=northsouth-bbox/2;
ymax=northsouth+bbox/2;
// check within bbox
bool1 = xCoord>xmin && xCoord<xmax
&& yCoord>ymin && yCoord<ymax;
# ----------------------------------------

# group: Control
code_block_24 = CodeBlock(naam=create_3) { "98_MLA_"+ naam; }
byName_2 = FamilyType.ByName(name=code_block_24)
countTrue = List.CountTrue(list=check_coords_within_bbox_2.bool1@@L2)
cycle = List.Cycle(list=byName_2, amount=countTrue, lacing=Shortest)

filterByBoolMask_7 = List.FilterByBoolMask(list=flatten_8, mask=check_coords_within_bbox_2.bool1, lacing=Shortest)
filterByBoolMask_8 = List.FilterByBoolMask(list=flatten_9, mask=check_coords_within_bbox_2.bool1, lacing=Shortest)
code_block_25 = CodeBlock(x=filterByBoolMask_7.in, rdx=GIS2BIM_GetSharedCoordinate.EastWest, y=filterByBoolMask_8.in, rdy=GIS2BIM_GetSharedCoordinate.NorthSouth) { xb=x-rdx; yb=y-rdy; Math.Round(xb*1000); Math.Round(yb*1000); 0; 1000; }
byCoordinates_2 = FamilyInstance.ByCoordinates(familyType=cycle, x=code_block_25.out2, y=code_block_25.out3, z=code_block_25.out4)

# group: create lines
curves_2 = PolyCurve.Curves(polyCurve=list_filterbyboolmask_polycurves.in)  # frozen
byCurve = ModelCurve.ByCurve(curve=curves_2)
flatten_10 = List.Flatten(list=byCurve)
byElements = Group.ByElements(elements=flatten_10)  # frozen

fromElements = Custom[Group.FromElements](elements=flatten_10, groupName=bgt_lagen.out0)  # package Clockwork for Dynamo 2.x; Creates a group from a list of Revit elements. Unlike the OOTB node, it supports naming the created group directly and also indicates which of the input elements (if any) could not be grouped.
