# Dynamo graph GIS2BIM_BGT_bomen_v7_DESKTOP-BUREAU_Jan-07-113316-2026_Conflict.dyn "GIS2BIM_BGT_bomen_v7" (Dynamo 3.3.0.6316)
# packages: GIS2BIM for Dynamo 2.x 0.12.1

# group: get correct gml
filePaths = Custom[FilePaths]()  # Gets the filepaths from the model.
string = StringInput("\")
code_block = CodeBlock { 1000; }
GIS2BIM_GetSharedCoordinate = Custom[GIS2BIM_GetSharedCoordinate](Scale=code_block)  # package GIS2BIM for Dynamo 2.x; Get the current shared coordinate
getMortonCodeCoordinate = Custom[GIS2BIM.GetMortonCodeCoordinate](X=GIS2BIM_GetSharedCoordinate.EastWest, Y=GIS2BIM_GetSharedCoordinate.NorthSouth)  # package GIS2BIM for Dynamo 2.x; Get mortoncode(bitshifting) given 2 coordinates and tiledimension
string_from_object = FromObject(obj=getMortonCodeCoordinate)
string_2 = StringInput("\bgt_vegetatieobject.gml")
concat = String.Concat(string0=filePaths.03_gisdatadir, string1=string, string2=string_from_object, string3=string_2)

watch = Watch(concat)
GIS2BIM_GetSharedCoordinate_2 = Custom[GIS2BIM_GetSharedCoordinate]()
code_block_2 = CodeBlock { 500; }

# group: PLACE TREES
string_3 = StringInput(".//{http://www.opengis.net/gml}pos")  # graph input
code_block_3 = CodeBlock { true; }
filterGML = Custom[GIS2BIM.FilterGML](GMLFile=watch, xPATH=string_3, CoordinateX=GIS2BIM_GetSharedCoordinate_2.EastWest, CoordinateY=GIS2BIM_GetSharedCoordinate_2.NorthSouth, Boundingbox=code_block_2, Connectpolycurves=code_block_3)  # package GIS2BIM for Dynamo 2.x; filter GML-file based on boundingbox
flatten = List.Flatten(list=filterGML.Points)

# group: PLACE TREES
string_4 = StringInput(".//{http://www.opengis.net/gml}posList")  # graph input
code_block_4 = CodeBlock { true; }
filterGML_2 = Custom[GIS2BIM.FilterGML](GMLFile=watch, xPATH=string_4, CoordinateX=GIS2BIM_GetSharedCoordinate_2.EastWest, CoordinateY=GIS2BIM_GetSharedCoordinate_2.NorthSouth, Boundingbox=code_block_2, Connectpolycurves=code_block_4)
flatten_2 = List.Flatten(list=filterGML_2.Points)

join = List.Join(list0=flatten, list1=flatten_2)

# group: clockwork familyinstance by point in view
family_types = FamilyTypes("98_3BM_loofbomen:98_3BM_loofbomen")
byPoint = FamilyInstance.ByPoint(familyType=family_types, point=join)
