# Dynamo graph GIS2BIM_BGT_bounderylines_V7.dyn (Dynamo 3.3.0.6316)
# packages: archi-lab.net 2022.210.1022

categories = Categories("OST_DetailComponents")
current = Document.Current()
activeView = Document.ActiveView(document=current)
all_elements_of_category_in_view = ElementsOfCategoryInView(Category=categories, View=activeView)
line_styles = LineStyleUi("bgt_bounderyline")

# group: change bounderylines
set_boundery_lines = Python(IN[0]=all_elements_of_category_in_view, IN[1]=line_styles)  # IronPython2
# ---------- set_boundery_lines.python (32 lines) ----------
import clr
clr.AddReference('ProtoGeometry')
from Autodesk.DesignScript.Geometry import *

# Import DocumentManager and TransactionManager
clr.AddReference("RevitServices")
import RevitServices
from RevitServices.Persistence import DocumentManager
from RevitServices.Transactions import TransactionManager

# Import RevitAPI
clr.AddReference("RevitAPI")
import Autodesk
from Autodesk.Revit.DB import *

doc = DocumentManager.Instance.CurrentDBDocument
uiapp = DocumentManager.Instance.CurrentUIApplication
app = uiapp.Application


region = UnwrapElement(IN[0])
ids = UnwrapElement(IN[1])

TransactionManager.Instance.EnsureInTransaction(doc)
#for region in regions:
for r in region:
	FilledRegion.SetLineStyleId(r, ids.Id)

TransactionManager.Instance.TransactionTaskDone()

#Assign your outputs to the OUT variable
OUT = region
# ----------------------------------------
