# Dynamo graph GIS2BIM_BGT_lantaarnpalen_v7_DESKTOP-BUREAU_Jan-07-113321-2026_Conflict.dyn "GIS2BIM_BGT_lantaarnpalen_v7" (Dynamo 2.19.3.6394)
# packages: GIS2BIM for Dynamo 2.x 0.12.1

# group: get correct gml
filePaths = Custom[FilePaths]()  # Gets the filepaths from the model.
string = StringInput("\")
code_block = CodeBlock { 1000; }
GIS2BIM_GetSharedCoordinate = Custom[GIS2BIM_GetSharedCoordinate](Scale=code_block)  # package GIS2BIM for Dynamo 2.x; Get the current shared coordinate
getMortonCodeCoordinate = Custom[GIS2BIM.GetMortonCodeCoordinate](X=GIS2BIM_GetSharedCoordinate.EastWest, Y=GIS2BIM_GetSharedCoordinate.NorthSouth)  # package GIS2BIM for Dynamo 2.x; Get mortoncode(bitshifting) given 2 coordinates and tiledimension
string_from_object = FromObject(obj=getMortonCodeCoordinate)
string_2 = StringInput("\bgt_paal.gml")
concat = String.Concat(string0=filePaths.03_gisdatadir, string1=string, string2=string_from_object, string3=string_2)

GIS2BIM_GetSharedCoordinate_2 = Custom[GIS2BIM_GetSharedCoordinate]()
code_block_2 = CodeBlock { bbox=500; subtype="lichtmast"; }
python_script = Python(IN[0]=concat, IN[1]=GIS2BIM_GetSharedCoordinate_2.EastWest, IN[2]=GIS2BIM_GetSharedCoordinate_2.NorthSouth, IN[3]=code_block_2.bbox, IN[4]=code_block_2.subtype)  # CPython3
# ---------- python_script.python (89 lines) ----------
import sys
sys.path.append("C:\Program Files (x86)\IronPython 2.7\Lib")

import clr
import re
clr.AddReference('ProtoGeometry')
from Autodesk.DesignScript.Geometry import *

import xml.etree.ElementTree as ET

def BGTgetHoofdMembers():
    return Path.split("\\")[-1].replace(".gml","").replace("bgt_","").capitalize()

def BGTGetUniqueMembers(HoofdMember):
    Types=[]
    for CityObjectMember in Root.iter('{http://www.geostandaarden.nl/imgeo/2.1}'+ HoofdMember):
        try:
            Type = CityObjectMember.find('{http://www.geostandaarden.nl/imgeo/2.1}plus-type').text
            if Type not in Types:
                Types.append(Type)
        except:
            continue
    return Types

def BGTFilter(HoofdMember, SubMember):
    MemberPositions=[]
    Count = 0
    for CityObjectMember in Root.iter('{http://www.geostandaarden.nl/imgeo/2.1}'+ HoofdMember):
        try:
            Type = CityObjectMember.find('{http://www.geostandaarden.nl/imgeo/2.1}plus-type').text
            if Type == SubMember:
                Count +=1
                try:
                    Position = CityObjectMember.find('{http://www.geostandaarden.nl/imgeo/2.1}geometrie2d' + HoofdMember + '/{http://www.opengis.net/gml}Point/').text
                    RDCoordinates = Position.split(" ")
                    #print("type: {} / RDX: {} - RDY: {}".format(Type, RDCoordinates[1],RDCoordinates[0]))
                    MemberPositions.append(RDCoordinates)
                except:
                    continue
                    #print("niet gevonden")
        except:
            continue
            #print("paal heeft geen type")
    #print('aantal gevonden: {}'.format(Count))
    return MemberPositions

def PointsInBoundingBox(rdx, rdy, bb_size, points):
    # Bounding box definition
    PointsInBbox = []
    BbSizeHalf = bb_size/2
    min_x = rdx - BbSizeHalf
    min_y = rdy - BbSizeHalf
    max_x = rdx + BbSizeHalf
    max_y = rdy + BbSizeHalf
    for point in ListToFloat(points):
        if point[0] > min_x and point [0] < max_x:
            print("point fits in bbox on the x")
            if point[1] > min_y and point [1] < max_y:
                print("Point also fits in bbox on the y")
                PointsInBbox.append(point)
    return PointsInBbox
 
def ListToFloat(lst):
    for inner in lst:
    	for index, string in enumerate(inner):
        	inner[index] = float(string)
    return lst  

def TransformPoints(rdx, rdy, points, scale):
    PointRelative=[]
    for point in ListToFloat(points):
        x = (point[0]-rdx) * scale
        y = (point[1]-rdy) * scale
        PointRelative.append([x,y])
    return PointRelative  

Path = IN[0]
Tree = ET.parse(Path)
Root = Tree.getroot()

rdx = IN[1]
rdy = IN[2] 
bbox = IN[3]
SubType = IN[4]

pointsrdxrdy = PointsInBoundingBox(rdx, rdy, bbox, BGTFilter("Paal", SubType))
pointsout = TransformPoints(rdx, rdy, pointsrdxrdy, 1000)

OUT = pointsout
# ----------------------------------------
firstItem = List.FirstItem(list=python_script@@L2)
lastItem = List.LastItem(list=python_script@@L2)
byCoordinates = Point.ByCoordinates(x=firstItem, y=lastItem)

# group: clockwork familyinstance by point in view
family_types = FamilyTypes("90_MLA_lichtmast:90_MLA_lichtmast")
byPoint = FamilyInstance.ByPoint(familyType=family_types, point=byCoordinates)
