# Dynamo graph GIS2BIM_CityJSON_parser_v5.dyn (Dynamo 2.16.2.5624)
# packages: spring nodes 210.1.1, GIS2BIM for Dynamo 2.x 0.11.24

# group: Prerequisites
# note: This script needs additional custom nodes from
# W:\Toolbox NL projects\000 Tekenafspraken\DYNAMO\MLA_scripts\GIS\MLA_CustomNode_Helpers
# and uses the materials
# 00_MLA_Env_Buildings
# 00_MLA_Env_Gray
# 00_MLA_Env_Green
# 00_MLA_Env_Blue
# Additionally the pip packages "ijson" and "numpy" need to be installed once using this script:
# W:\Toolbox NL projects\000 Tekenafspraken\DYNAMO\MLA_scripts\00_MLA_pipinstall.dyn
# Lastly, in order to extract metadata, the following Project Parameters should be set for GenericModels:
# year_of_construction -> Integer
# cadastre_id -> Text
# usage_status -> Text
# usage_type -> Text
# To automatically create them you can use the script here:
# W:\Toolbox NL projects\000 Tekenafspraken\DYNAMO\MLA_scripts\GIS\V4\MLA_GIS2BIM_CreateProjectParameters.dyn

# group: File Input
file_path = Filename("..\..\..\..\..\..\DATA\GIS2BIMprojects\VOORSTRAAT_172\GISDATA\JSON\38cn2_01.json")
file_path_2 = Filename("..\..\..\..\..\..\DATA\GIS2BIMprojects\VOORSTRAAT_172\GISDATA\JSON\38cn2_02.json")
file_path_3 = Filename("..\..\..\..\..\..\DATA\GIS2BIMprojects\VOORSTRAAT_172\GISDATA\JSON\38cn2_03.json")
file_path_4 = Filename("..\..\..\..\..\..\DATA\GIS2BIMprojects\VOORSTRAAT_172\GISDATA\JSON\38cn2_04.json")
list_create = List.Create(item0=file_path, item1=file_path_2, item2=file_path_3, item3=file_path_4)

# group: bbox and lods
GIS2BIM_GetSharedCoordinate = Custom[GIS2BIM_GetSharedCoordinate]()  # package GIS2BIM for Dynamo 2.x; Get the current shared coordinate
code_block = CodeBlock(rdx=GIS2BIM_GetSharedCoordinate.EastWest, rdy=GIS2BIM_GetSharedCoordinate.NorthSouth)
# ---------- code_block.designscript (8 lines) ----------
bbox=100;
bboxhalf=bbox/2;
bboxlowcornerx=rdx-bboxhalf;
bboxlowcornery=rdy-bboxhalf;
bboxupcornerx=rdx+bboxhalf;
bboxupcornery=rdy+bboxhalf;
TestBBox = [bboxlowcornerx,bboxlowcornery,bboxupcornerx,bboxupcornery];
ProjectLocationT1 = [rdx,rdy,0];
# ----------------------------------------
code_block_2 = CodeBlock { maximumLoD = 2.2; AllLoDs = []; 1000; }

# group: Parser Code
py = Python(IN[0]=list_create, IN[1]=code_block.TestBBox, IN[2]=code_block.ProjectLocationT1, IN[3]=code_block_2.out2, IN[4]=code_block_2.maximumLoD)  # "ParseCityJSON.py"; CPython3
# ---------- py.python (315 lines) ----------
# Load the Python Standard and DesignScript Libraries
import sys
import clr
clr.AddReference('ProtoGeometry')
from Autodesk.DesignScript.Geometry import *

import ijson

import time
import random

start = time.time()

# The inputs to this node will be stored as a list in the IN variables.
filePaths = IN[0]
bbox = IN[1]
projectLocation = IN[2]
scaleFactor = IN[3]

maximumLoD = IN[4] or float('inf')

if type(filePaths) != list:
    filePaths = [filePaths]

transformedBBox = [
    (bbox[0] - projectLocation[0]) * scaleFactor,
    (bbox[1] - projectLocation[1]) * scaleFactor,
    (bbox[2] - projectLocation[0]) * scaleFactor,
    (bbox[3] - projectLocation[1]) * scaleFactor
] if len(bbox) == 4 else []

print('BBOX', transformedBBox)
print('LoD', maximumLoD)

# Place your code below this line

def translateVertex(vertices, index, transform):
    vertex = list(vertices[index])
    if len(transform.get('scale', [])) == 3 and len(transform.get('translate', [])) == 3:
        vertex[0] = round(((vertex[0] * transform['scale'][0]) + transform['translate'][0] - projectLocation[0]) * scaleFactor)
        vertex[1] = round(((vertex[1] * transform['scale'][1]) + transform['translate'][1] - projectLocation[1]) * scaleFactor)
        vertex[2] = round(((vertex[2] * transform['scale'][2]) + transform['translate'][2] - projectLocation[2]) * scaleFactor)
    else:
        vertex[0] = round((vertex[0] - projectLocation[0]) * scaleFactor)
        vertex[1] = round((vertex[1] - projectLocation[1]) * scaleFactor)
        vertex[2] = round((vertex[2] - projectLocation[2]) * scaleFactor)
    return vertex
    
def sitsInsideBBox(vertex):
    if len(transformedBBox) == 4:
        return transformedBBox[0] < vertex[0] < transformedBBox[2] and transformedBBox[1] < vertex[1] < transformedBBox[3]
    else:
        return True

def parseGeometry(geometries, vertices, decompressionTransform, filterBBox = True, cutGeometries = False, includeHoles = False):
    outVolBoundary = []
    insideBBox = False
    # Find highest lod
    targetLoD = 0;
    targetGeoIndex = -1;
    for index, geometry in enumerate(geometries):
        geoLoD = float(geometry['lod'])
        if targetLoD < geoLoD and geoLoD <= maximumLoD:
            targetLoD = geoLoD
            targetGeoIndex = index 
   
    if targetGeoIndex > -1:
        selectedGeometry = geometries[targetGeoIndex]
        if selectedGeometry['type'] == 'Solid':
            # TODO: Only supports whole solids atm. Inner shells would be defined in following indices
            for faceBoundaries in selectedGeometry['boundaries'][0]:
                boundaryInsideBBox = False
                outSrfBoundary = []
                # If Holes are included they are returned as consecutive arrays in the surface boundary.
                if includeHoles:
                    for boundary in faceBoundaries:
                        outPolyBoundary = []
                        for vertexIndex in boundary:
                            vertex = translateVertex(vertices, vertexIndex, decompressionTransform)
                            outPolyBoundary.append(vertex)
                            if sitsInsideBBox(vertex):
                                insideBBox = True
                                boundaryInsideBBox = True
                        outSrfBoundary.append(outPolyBoundary)
                else:
                    for vertexIndex in faceBoundaries[0]:
                        vertex = translateVertex(vertices, vertexIndex, decompressionTransform)
                        outSrfBoundary.append(vertex)
                        if sitsInsideBBox(vertex):
                            insideBBox = True
                            boundaryInsideBBox = True
                if boundaryInsideBBox or not cutGeometries:
                    outVolBoundary.append(outSrfBoundary)
        if selectedGeometry['type'] == 'MultiSurface':
             for faceBoundaries in selectedGeometry['boundaries']:
                boundaryInsideBBox = False
                outSrfBoundary = []
                # If Holes are included they are returned as consecutive arrays in the surface boundary.
                if includeHoles:
                    for boundary in faceBoundaries:
                        outPolyBoundary = []
                        for vertexIndex in boundary:
                            vertex = translateVertex(vertices, vertexIndex, decompressionTransform)
                            outPolyBoundary.append(vertex)
                            if sitsInsideBBox(vertex):
                                insideBBox = True
                                boundaryInsideBBox = True
                        outSrfBoundary.append(outPolyBoundary)
                else:
                    for vertexIndex in faceBoundaries[0]:
                        vertex = translateVertex(vertices, vertexIndex, decompressionTransform)
                        outSrfBoundary.append(vertex)
                        if sitsInsideBBox(vertex):
                            insideBBox = True
                            boundaryInsideBBox = True
                if boundaryInsideBBox or not cutGeometries:
                    outVolBoundary.append(outSrfBoundary)

        if insideBBox or not filterBBox:
            return outVolBoundary
        else:
            return None
    else:
        return None

def parseAttributes(attributes, objectKey):
    availableKeys = attributes.keys()
    result = {}
    
    # The id might not always be the objecyKey but for the BAG files it seems to be the most reliable
    result['cadastre_id'] = objectKey
    
    # Attributes can be different from file to file: update/extend if-checks to adjust to new ones
    if 'bouwjaar' in availableKeys:
        result['year_of_construction'] = int(attributes['bouwjaar'])
    if 'oorspronkelijkbouwjaar' in availableKeys:
        result['year_of_construction'] = int(attributes['oorspronkelijkbouwjaar'])
    if 'status' in availableKeys:
        result['usage_status'] = attributes['status']
    if 'pandstatus' in availableKeys:
        result['usage_status'] = attributes['pandstatus']
        
    return result

buildings = []
bridges = []
roads = []
railways = []
landuses = []
plantcovers = []
waterways = []
waterbodies = []
generics = []
reliefs = []

decompressionTransform = {}


# Open and Parse JSON file(s)

for filePath in filePaths:
    with open(filePath, 'rb') as f:

        # Step 1: Read Metadata and Transform (if available)
        
        transformParser = ijson.kvitems(f, 'transform', use_float=True)
        for k, v in transformParser:
            decompressionTransform[k] = v
            
        # print('Transform', decompressionTransform)
        
        # also possible to read out: referenceSystem/EPSG, thematicModels (occuring cityObject types), ...
        # metadataParser = ijson.kvitems(f, 'metadata')
        # f.seek(0)
        
        # Reset File Cursor Between parses:
        f.seek(0)
        
        # Step 2: Read Vertices
        vertices = list(ijson.items(f, 'vertices'))[0]
        
        # Reset File Cursor Between parses:
        f.seek(0)

        # Step 3: Read CityObjects and extract and decompress (transform & translate) coordinate, filter LOD and BBox
        cityObjectsParser = ijson.kvitems(f, 'CityObjects')
        
        waitingBuildings = {}
        waitingBuildingParts = {}
        
        for k, v in cityObjectsParser:
            if v['type'] == 'Building':
                geometries = []
                attributes = {}
                missingChildren = []
                if 'children' in v.keys():
                    for child in v['children']:
                        if child in waitingBuildingParts.keys():
                            part = waitingBuildingParts.pop(child)
                            geometries += part['geometry']
                            attributes = { **attributes, **parseAttributes(part['attributes'], child) }
                        else:
                            missingChildren.append(child)
                
                geometries += v['geometry']
                attributes = { **attributes, **parseAttributes(v['attributes'], k) }
                
                if len(missingChildren) == 0:
                    # building complete: parse complete geometry
                    geometry = parseGeometry(geometries, vertices, decompressionTransform, True, False, True)
                    
                    if geometry is not None:
                        buildings.append({
                            'geometry': geometry,
                            'attributes': attributes
                        })
                else:
                    waitingBuildings[k] = {
                        'geometries': geometries,
                        'attributes': attributes,
                        'missingChildren': missingChildren
                    }
                    
            if v['type'] == 'BuildingPart':
                # TODO: Support multiple parents??
                parentId = v['parents'][0] 
                if parentId in waitingBuildings.keys():
                    building = waitingBuildings[parentId]
                    building['geometries'] += v['geometry']
                    building['attributes'] = { **building['attributes'], **parseAttributes(v['attributes'], k) }
                    
                    building['missingChildren'].remove(k)
                    
                    if len(building['missingChildren']) == 0:
                        # building complete: parse complete geometry
                        geometry = parseGeometry(geometries, vertices, decompressionTransform, True, False, True)
                        
                        if geometry is not None:
                            buildings.append({
                                'geometry': geometry,
                                'attributes': attributes
                            })
                    
                    else:
                        waitingBuildingParts[k] = {
                            'geometry': geometry,
                            'attributes': attributes
                        }
        
            if v['type'] == 'Bridge':
                geometry = parseGeometry(v['geometry'], vertices, decompressionTransform)
                if geometry is not None:
                    bridges.append(geometry)
            if v['type'] == 'Road':
                geometry = parseGeometry(v['geometry'], vertices, decompressionTransform, True, True)
                if geometry is not None:
                    roads.append(geometry)
            if v['type'] == 'Railway':
                geometry = parseGeometry(v['geometry'], vertices, decompressionTransform, True, True)
                if geometry is not None:
                    railways.append(geometry)
            if v['type'] == 'LandUse':
                geometry = parseGeometry(v['geometry'], vertices, decompressionTransform, True, True)
                if geometry is not None:
                    landuses.append(geometry)
            if v['type'] == 'PlantCover':
                geometry = parseGeometry(v['geometry'], vertices, decompressionTransform, True, True)
                if geometry is not None:
                    plantcovers.append(geometry)
            if v['type'] == 'Waterway':
                geometry = parseGeometry(v['geometry'], vertices, decompressionTransform, True, True)
                if geometry is not None:
                    waterways.append(geometry)
            if v['type'] == 'WaterBody':
                geometry = parseGeometry(v['geometry'], vertices, decompressionTransform, True, True)
                if geometry is not None:
                    waterbodies.append(geometry)
            if v['type'] == 'GenericCityObject':
                geometry = parseGeometry(v['geometry'], vertices, decompressionTransform)
                if geometry is not None:
                    generics.append(geometry)
            if v['type'] == 'TINRelief':
                geometry = parseGeometry(v['geometry'], vertices, decompressionTransform, True, True)
                if geometry is not None:
                    reliefs.append(geometry)

# Assign your output to the OUT variable.
OUT = buildings, bridges, roads, railways, landuses, plantcovers, waterways, waterbodies, generics, reliefs

# DEBUG and TIMING
end = time.time()
print('Found', 
    len(buildings), 'buildings,', 
    len(bridges), 'bridges,', 
    len(roads), 'roads,', 
    len(railways), 'railways,', 
    len(landuses), 'landuse items,', 
    len(plantcovers), 'plant cover items,',
    len(waterways), 'waterways,',
    len(waterbodies), 'water bodies,', 
    len(generics), 'other items and',
    len(reliefs), 'TIN reliefs.'
) 
print('Execution time:', end - start, 'seconds')

# Object Types in Example
# Building
# Bridge
# Road
# GenericCityObject
# LandUse
# PlantCover
# WaterBody
#
# see here for full schema: https://3d.bk.tudelft.nl/schemas/cityjson/1.1.3/cityobjects.schema.json
# ----------------------------------------
code_block_3 = CodeBlock(result=py)
# ---------- code_block_3.designscript (11 lines) ----------
buildings = result[0];
bridges = result[1];
roads = result[2];
railways = result[3];
landuses = result[4];
plantcovers = result[5];
waterways = result[6];
waterbodies = result[7];
otherObjects = result[8];
topographicReliefs = result[9];
result;
# ----------------------------------------

# group: Extract Buildings
code_block_4 = CodeBlock(buildingData=code_block_3.buildings) { buildingData; coordinates = buildingData["geometry"]; attributes = buildingData["attributes"]; }
string = StringInput("gis2bim_env_building")
code_block_5 = CodeBlock { "NLRS_90_GM_3D_BAG1_Building"; }
coordinatesToMesh = Custom[CoordinatesToMesh](coordinates=code_block_4.coordinates, materialName=string, shapeName=code_block_5)  # Creates a Mesh from a list of Coordinates.
py_2 = Python(IN[0]=code_block_4.attributes)  # "SeparateKeysAndValues.py"; CPython3
# ---------- py_2.python (16 lines) ----------
# Load the Python Standard and DesignScript Libraries
import sys
import clr
clr.AddReference('ProtoGeometry')
from Autodesk.DesignScript.Geometry import *

# The inputs to this node will be stored as a list in the IN variables.
dictionaries = IN[0]

keys = []
values = []
for dictionary in dictionaries:
    keys.append(dictionary.keys())
    values.append(dictionary.values())
    
OUT = [keys, values] 
# ----------------------------------------
code_block_6 = CodeBlock(result=py_2) { keys = result[0]; values = result[1]; }
setParameterByName = Element.SetParameterByName(element=coordinatesToMesh.Element, parameterName=code_block_6.keys, value=code_block_6.values)
geometry = Element.Geometry(element=setParameterByName)
py_3 = Python(IN[0]=code_block_4.coordinates)  # "MeshGeometryFromPoints.py"; CPython3
# ---------- py_3.python (483 lines) ----------
# Load the Python Standard and DesignScript Libraries
import sys
import os
dirName = f'python-{platform.python_version()}-embed-amd64'
localappdatapath = os.getenv(r'LOCALAPPDATA')
dirPath = os.path.join(localappdatapath, dirName)
sys.path.append(os.path.join(localappdatapath, r'python-3.9.3-embed-amd64\Lib\site-packages'))
import clr
clr.AddReference('ProtoGeometry')
from Autodesk.DesignScript.Geometry import *

clr.AddReference('MeshToolkit')
import Autodesk.Dynamo.MeshToolkit as mtk

import System
from System.Collections.Generic import List

import numpy as np

##############
# HELPERS
#############

# ==============================================================================
#
# Double linked list
#
# ==============================================================================

__author__    = 'Nils Olofsson'
__email__     = 'me@nilsolovsson.se'
__copyright__ = 'Copyright 2021, AllSystemsPhenomenal'
__license__   = 'MIT'

class Node:
    """
        Node element in a DoubleLinkedList.
        Each node in a valid list is associated with a value/data element and
        with its left and right neighbor.
        [Prev. node]<--[Node]-->[Next node]
                         |
                       [Data]
    """

    def __init__(self, data):
        self.data = data
        self.prev = None
        self.next = None

class DoubleLinkedList:
    """
        A double linked list. Each element keeps a reference to both left and
        right neighbor. This allows e.g. for easy removal of elements.
        The list is circular and is usually considered traversed when the next element
        is the same element as when when we started.
    """

    def __init__(self):
        self.first = None
        self.size  = 0

    def __str__(self):
        if self.first==None:
            return '[]'
        msg = '['
        msg += str(self.first.data)
        node = self.first.next
        while node != self.first:
            msg += ', ' + str(node.data)
            node = node.next
        msg += ']'
        return msg

    def append(self, data):
        self.size += 1
        if self.first == None:
            self.first = Node(data)
            self.first.prev = self.first
            self.first.next = self.first
            return
        node = Node(data)
        last = self.first.prev
        node.prev = last
        node.next = self.first
        last.next = node
        self.first.prev = node

    def remove(self, item):
        if self.first==None:
            return
        rmv = None
        node = self.first
        if node.data == item:
            rmv = node
        node = node.next
        while not rmv and node != self.first:
            if node.data == item:
                rmv = node
            node = node.next
        if rmv:
            nxt = rmv.next
            prv = rmv.prev
            prv.next = nxt
            nxt.prev = prv
            self.size -= 1
            if rmv == self.first:
                self.first = nxt
            if rmv == self.first:
                self.first = None
        return

    def count(self):
        if self.first==None:
            return 0
        i = 1
        node = self.first.next
        while node != self.first:
            i+=1
            node = node.next
        return i

    def flatten(self):
        if self.first==None:
            return []
        l = []
        node = self.first
        l.append(node.data)
        node = self.first.next
        while node != self.first:
            l.append(node.data)
            node = node.next
        return l


# ==============================================================================
#
# Triangulation Code
# based on Tutorial at https://all-systems-phenomenal.com/articles/ear_clipping_triangulation/index.php
#
# ==============================================================================


def angleCCW(a, b):
    """
        Counter clock wise angle (radians) from normalized 2D vectors a to b
    """
    dot = a[0]*b[0] + a[1]*b[1]
    det = a[0]*b[1] - a[1]*b[0]
    angle = np.arctan2(det, dot)
    if angle<0.0 :
        angle = 2.0*np.pi + angle
    return angle


def isConvex(vertex_prev, vertex, vertex_next):
    """
        Determine if vertex is locally convex.
    """   
    a = vertex_prev - vertex
    b = vertex_next - vertex
    internal_angle = angleCCW(b, a)
    return internal_angle <= np.pi


def insideTriangle(a, b, c, p):
    """
        Determine if a vertex p is inside (or "on") a triangle made of the
        points a->b->c
        http://blackpawn.com/texts/pointinpoly/
    """

    #Compute vectors
    v0 = c - a
    v1 = b - a
    v2 = p - a
 
    # Compute dot products
    dot00 = np.dot(v0, v0)
    dot01 = np.dot(v0, v1)
    dot02 = np.dot(v0, v2)
    dot11 = np.dot(v1, v1)
    dot12 = np.dot(v1, v2)
    
    # Compute barycentric coordinates
    denom = dot00*dot11 - dot01*dot01
    if abs(denom) < 1e-20:
        return True
    invDenom = 1.0 / denom
    u = (dot11*dot02 - dot01*dot12) * invDenom
    v = (dot00*dot12 - dot01*dot02) * invDenom
    
    # Check if point is in triangle
    return (u >= 0) and (v >= 0) and (u + v < 1)


def triangulate(vertices_raw):
    """
        Triangulation of a polygon in 2D.
        Assumption that the polygon is simple, i.e has no holes, is closed and
        has no crossings and also that its vertex order is counter clockwise.
    """

    vertices = np.array(vertices_raw)

    n, m = vertices.shape
    indices = np.zeros([n-2, 3], dtype=int)

    vertlist = DoubleLinkedList()
    for i in range(0, n):
        vertlist.append(i)
    index_counter = 0

    # Simplest possible algorithm. Create list of indexes.
    # Find first ear vertex. Create triangle. Remove vertex from list
    # Do this while number of vertices > 2.
    node = vertlist.first
    full_loop_counter = n
    while vertlist.size > 2:
        i = node.prev.data
        j = node.data
        k = node.next.data

        vert_prev = vertices[i, :]
        vert_current = vertices[j, :]
        vert_next = vertices[k, :]

        is_convex = isConvex(vert_prev, vert_current, vert_next)
        is_ear = True
        if is_convex:
            test_node = node.next.next
            while test_node!=node.prev and is_ear:
                vert_test = vertices[test_node.data, :]
                is_ear = not insideTriangle(vert_prev,
                                            vert_current,
                                            vert_next,
                                            vert_test)
                test_node = test_node.next
        else:
            is_ear = False

        if is_ear:
            indices[index_counter, :] = np.array([i, j, k], dtype=int)
            index_counter += 1
            vertlist.remove(node.data)
            full_loop_counter = n
        node = node.next
        full_loop_counter -= 1

        if full_loop_counter < 0:
            print('CANT FIND MORE EARS - ERROR - CANCELLING TRIANGULATION')
            break

    return indices



################
# ACTUAL SCRIPT
################


# The inputs to this node will be stored as a list in the IN variables.
geometries = IN[0]

# Place your code below this line

def pointInList(point, vertexList):
    for index, vertex in enumerate(vertexList):
        if point.X == vertex.X and point.Y == vertex.Y and point.Z == vertex.Z:
            return index
    return -1

def equalPoints2D(A, B):
    return A[0] == B[0] and A[1] == B[1]
    
def squareDistancePoints2D(A, B):
    return (B[0] - A[0])**2 + (B[1] - A[1])**2
 
def isCounterClockwise(vertices):
    edgeSum = 0
    lastVertex = vertices[-1]
    for vertex in vertices:
        edgeSum += (vertex[0] - lastVertex[0])*(vertex[1] + lastVertex[1])
        lastVertex = vertex

    return edgeSum < 0
    
def getLargestCoordinate(vertexList, index):
    largest = float('-inf')
    for vertex in vertexList:
        if vertex[index] > largest:
            largest = vertex[index]
    return largest

def getLineIntersection(x1, y1, x2, y2, x3, y3, x4, y4):
    denom = (y4 - y3) * (x2 - x1) - (x4 - x3) * (y2 - y1)
    if denom == 0:
        return None  # Parallel.
    ua = ((x4 - x3) * (y1 - y3) - (y4 - y3) * (x1 - x3)) / denom
    ub = ((x2 - x1) * (y1 - y3) - (y2 - y1) * (x1 - x3)) / denom
    if 0.0 <= ua <= 1.0 and 0.0 <= ub <= 1.0:
        return (x1 + ua * (x2 - x1)), (y1 + ua * (y2 - y1))
    return None

def getIntersectionEdge(outerPolygon, innerVertex):
    lastVertex = outerPolygon[-1]
    infiniteLineEnd = getLargestCoordinate(outerPolygon, 0) + 100
    for index, vertex in enumerate(outerPolygon):
        if lastVertex[0] >= innerVertex[0] or vertex[0] >= innerVertex[0]:
            vertexInt = getLineIntersection(innerVertex[0], innerVertex[1], infiniteLineEnd, innerVertex[1], lastVertex[0], lastVertex[1], vertex[0], vertex[1]) 
            if vertexInt is not None:
                return lastVertex, vertex, vertexInt, index
        lastVertex = vertex
    raise Exception('No intersection found... This should not happen - check the code') 


meshGeometries = []
for geometry in geometries:
    vertexList = []
    indexList = []
    
    holesArePossible = type(geometry[0][0]) == list
    
    for surface in geometry:
    
        withHoles = False
        
        if holesArePossible and len(surface) > 1:
            srfOuterBoundVertices = surface[0]
            holes = surface[1:]
            withHoles = True
        elif holesArePossible and len(surface) == 1:
            srfOuterBoundVertices = surface[0]
        else:
            srfOuterBoundVertices = surface
    
        if not withHoles and len(srfOuterBoundVertices) < 3:
            print('Invadlid Surface - only', len(srfOuterBoundVertices), 'Vertexes')
            continue
        elif not withHoles and len(srfOuterBoundVertices) == 3:
            for point in srfOuterBoundVertices:
                geoPoint = Point.ByCoordinates(point[0], point[1], point[2])
                pointIndex = pointInList(geoPoint, vertexList)
                if pointIndex > -1:
                    indexList.append(pointIndex)
                else:
                    vertexList.append(geoPoint)
                    indexList.append(len(vertexList) - 1)
        else:
            # Create Geometry Points
            points = []
            for point in srfOuterBoundVertices:
                points.append(Point.ByCoordinates(point[0], point[1], point[2]))
            
            if withHoles:            
                holesPoints = []
                for hole in holes:
                    holePoints = []
                    for point in hole:
                        holePoints.append(Point.ByCoordinates(point[0], point[1], point[2]))
                    holesPoints.append(holePoints)
            
            # Get plane/coord system of surface
            surfacePlane = Plane.ByBestFitThroughPoints(points)
            
            # Transform points into it
            fromCS = CoordinateSystem.ByOrigin(0,0,0)
            toCS = CoordinateSystem.ByPlane(surfacePlane)
            transformedPoints = []
            for point in points:
                transformedPoint = point.Transform(toCS, fromCS)
                transformedPoints.append([transformedPoint.X, transformedPoint.Y])
                
            if isCounterClockwise(transformedPoints):
                polyPoints = transformedPoints
            else:
                polyPoints = np.flip(transformedPoints, 0)
                points = np.flip(points, 0)
                
            if withHoles:
                transformedHolesPoints = []
                for index, hole in enumerate(holesPoints):
                    transformedHolePoints = []
                    for point in hole:
                        transformedPoint = point.Transform(toCS, fromCS)
                        transformedHolePoints.append([transformedPoint.X, transformedPoint.Y])
                    
                    # Make sure the transforme hole vertices are clockwise and the original points are ordered the same
                    if not isCounterClockwise(transformedHolePoints):
                        transformedHolesPoints.append(transformedHolePoints)
                    else:
                        transformedHolesPoints.append(np.flip(transformedHolePoints, 0))                      
                        holesPoints[index] = np.flip(holesPoints[index], 0)
                    
                # Combine outer (polyPoints) and inner (transformedHolesPoints) boundaries
                largestXs = []
                largestXIndices = []
                for hole in transformedHolesPoints:
                    largestX = float('-inf')
                    largestXIndex = 0
                    for index, point in enumerate(hole):
                        if point[0] > largestX:
                            largestX = point[0]
                            largestXIndex = index
                    largestXs.append(largestX)
                    largestXIndices.append(largestXIndex)
                 
                holeOrder = np.flip(np.argsort(largestXs))
              
                for holeIndex in holeOrder:
                    nextHole = transformedHolesPoints[holeIndex]
                    
                    startVertex = nextHole[largestXIndices[holeIndex]]
                    shiftedHole = np.roll(nextHole, -1 * largestXIndices[holeIndex], 0)
                    shiftedHolePoints = np.roll(holesPoints[holeIndex], -largestXIndices[holeIndex])
                    
                    try:
                        edgeA, edgeB, edgeInt, edgeBIndex = getIntersectionEdge(polyPoints, startVertex)
                    except:
                        print('ERROR connecting hole', polyPoints, startVertex, nextHole)
                        continue
                        
                    if equalPoints2D(edgeInt, edgeA):
                        # Point A is already mutually visible
                        edgeAIndex = edgeBIndex - 1
                        if edgeAIndex < 0:
                            edgeAIndex = len(transformedPoints) - 1
                      
                        polyPoints = np.concatenate((polyPoints[:edgeAIndex + 1], shiftedHole, [shiftedHole[0]], polyPoints[edgeAIndex:]))
                        points = np.concatenate((points[:edgeAIndex + 1], shiftedHolePoints, [shiftedHolePoints[0]], points[edgeAIndex:]))                        
                        continue
                    elif equalPoints2D(edgeInt, edgeB):
                        polyPoints = np.concatenate((polyPoints[:edgeBIndex + 1], shiftedHole, [shiftedHole[0]], polyPoints[edgeBIndex:]))
                        points = np.concatenate((points[:edgeBIndex + 1], shiftedHolePoints, [shiftedHolePoints[0]], points[edgeBIndex:]))
                        continue
                    else:
                        candidatePoint = edgeA if edgeA[0] >= edgeB[0] else edgeB
                        candidateIndex = edgeBIndex - 1 if edgeA[0] >= edgeB[0] else edgeBIndex
                        otherCandidateIndices = []
                        for index, point in enumerate(polyPoints):
                            prevIndex = index - 1
                            nextIndex = index + 1 if index + 1 < len(polyPoints) else 0
                            if not isConvex(np.array(polyPoints[prevIndex]), np.array(point), np.array(polyPoints[nextIndex])) and insideTriangle(np.array(startVertex), np.array(edgeInt), np.array(candidatePoint), np.array(point)):
                                otherCandidateIndices.append(index)
                        
                        distance = 0
                        for index in otherCandidateIndices:
                            point = transformedPoints[index]
                            nextDistance = squareDistancePoints2D(startVertex, point)
                            if nextDistance > distance:
                                distance = nextDistance
                                candidateIndex = index
                        
                        polyPoints = np.concatenate((polyPoints[:candidateIndex + 1], shiftedHole, [shiftedHole[0]], polyPoints[candidateIndex:]))
                        points = np.concatenate((points[:candidateIndex + 1], shiftedHolePoints, [shiftedHolePoints[0]], points[candidateIndex:]))
                        
                        
            # print('TRANSFORM', polyPoints)
            
            # Triangulate
            triangulation = triangulate(polyPoints)
            
            # print('TRIANGULATE', triangulation)
            
            # Piece the mesh together
            for triangle in triangulation:
                for vertex in triangle:
                    threeDPoint = points[vertex]
                    pointIndex = pointInList(threeDPoint, vertexList)
                    if pointIndex > -1:
                        indexList.append(pointIndex)
                    else:
                        vertexList.append(threeDPoint)
                        indexList.append(len(vertexList) - 1)

          
    meshIndices = List[int](indexList) # would fail when using 'indices' directly
    simpleMesh = mtk.Mesh.ByVerticesAndIndices(vertexList, meshIndices)
    improvedMesh = mtk.Mesh.Repair(simpleMesh)    
    meshGeometries.append(improvedMesh)

# Assign your output to the OUT variable.
OUT = meshGeometries
# ----------------------------------------

# group: Option B: Try Creating a Toposurface from flat items
join = List.Join(list0=code_block_3.topographicReliefs)  # frozen
flatten = List.Flatten(list=join)
py_4 = Python(IN[0]=flatten)  # "FlatCoordsToPoints.py"; CPython3
# ---------- py_4.python (27 lines) ----------
# Load the Python Standard and DesignScript Libraries
import sys
import clr
clr.AddReference('ProtoGeometry')
from Autodesk.DesignScript.Geometry import *

# The inputs to this node will be stored as a list in the IN variables.
coordsList = IN[0]

# Place your code below this line
points = []
X = 0
Y = 0
for index,coord in enumerate(coordsList):
    mod = index % 3
    if mod == 0:
        X = coord
    elif mod == 1:
        Y = coord
    elif mod == 2:
        points.append(Point.ByCoordinates(X, Y, coord))
     

# Assign your output to the OUT variable.
OUT = points

print('Found', len(points), 'points')
# ----------------------------------------
boolean = BoolSelector(false)
ꟿ_points_pruneduplicates = Custom[ꟿ Points.PruneDuplicates+](points=py_4, keepDuplicateZ=boolean)  # package spring nodes; An alternative to the built in node, that performs faster at the price of loosing the order of the points. All floating point valies are rounded to the nearest 4 decimal points. You can optionally remove duplicate Z values by setting "keepDuplicateZ" to false.
byPoints = Topography.ByPoints(points=ꟿ_points_pruneduplicates)

# group: Option C: Extract Green Spaces as DS (crashes)
join_2 = List.Join(list0=code_block_3.landuses, list1=code_block_3.plantcovers)  # frozen
string_2 = StringInput("00_MLA_Env_Green")
coordinatesToMesh_2 = Custom[CoordinatesToMesh](coordinates=join_2, materialName=string_2)
geometry_2 = Element.Geometry(element=coordinatesToMesh_2.Element)

# group: Extract Green Spaces: Option A: Create Mesh Directly for triangulated Elements
join_3 = List.Join(list0=code_block_3.landuses, list1=code_block_3.plantcovers)
py_5 = Python(IN[0]=join_3)  # "CreateMeshes.py"; CPython3
# ---------- py_5.python (45 lines) ----------
# Load the Python Standard and DesignScript Libraries
import sys
import clr
clr.AddReference('ProtoGeometry')
from Autodesk.DesignScript.Geometry import *

clr.AddReference('MeshToolkit')
import Autodesk.Dynamo.MeshToolkit as mtk

import System
from System.Collections.Generic import List

# The inputs to this node will be stored as a list in the IN variables.
geometries = IN[0]

# Place your code below this line

def pointInList(point, vertexList):
    for index, vertex in enumerate(vertexList):
        if point.X == vertex.X and point.Y == vertex.Y and point.Z == vertex.Z:
            return index
    return -1

meshGeometries = []
for geometry in geometries:
    vertexList = []
    indexList = []
    for surface in geometry:
        for point in surface:
            geoPoint = Point.ByCoordinates(point[0], point[1], point[2])
            pointIndex = pointInList(geoPoint, vertexList)
            if pointIndex > -1:
                indexList.append(pointIndex)
            else:
                vertexList.append(Point.ByCoordinates(point[0], point[1], point[2]))
                indexList.append(len(vertexList) - 1)
      
    meshIndices = List[int](indexList)
    # would fail when using 'indices' directly 
    meshGeometries.append(mtk.Mesh.ByVerticesAndIndices(vertexList, meshIndices))

# Assign your output to the OUT variable.
OUT = meshGeometries

# TODO: Check (and adjust for) non-triangular surfaces
# ----------------------------------------
ꟿ_tkmesh_tomesh = Custom[ꟿ TkMesh.ToMesh](tkMesh=py_5)  # package spring nodes; Attempts to convert a toolkit mesh to a Dynamo mesh. You obviously need to have the appropriate version of the mesh toolkit package downloaded first.
categories = Categories("OST_GenericModel")
string_3 = StringInput("gis2bim_env_green")
byName = Material.ByName(name=string_3)
code_block_7 = CodeBlock { "NLRS_90_GM_3D_BAG1_Green_Areas"; }
byMesh = DirectShape.ByMesh(mesh=ꟿ_tkmesh_tomesh, category=categories, material=byName, name=code_block_7)
geometry_3 = Element.Geometry(element=byMesh)

# group: WIP
py_6 = Python(IN[0]=file_path, IN[1]=code_block.bbox, IN[2]=code_block_2.maximumLoD)  # "cjioParser.py"; CPython3; frozen
# ---------- py_6.python (39 lines) ----------
# Load the Python Standard and DesignScript Libraries
import sys
import clr
clr.AddReference('ProtoGeometry')
from Autodesk.DesignScript.Geometry import *

# from pathlib import Path
# from copy import deepcopy
from cjio import cityjson

import time

start = time.time()

# The inputs to this node will be stored as a list in the IN variables.
path = IN[0]
bbox = IN[1]
lod = IN[2]

# Place your code below this line

cm = cityjson.load(path)

# filter by bbox
cm.upgrade_version('1.1', 3)
cm = cm.get_subset_bbox(bbox, False)
# filter by lod
# cm.filter_lod(1.3)
# extract geometry
buildings = cm.get_cityobjects(type='Building')
print('BUILDING COUNT', len(buildings))
print(cm)

# Assign your output to the OUT variable.
OUT = 0

# DEBUG and TIMING
end = time.time()
print('Execution time:', end - start, 'seconds')
# ----------------------------------------

# group: Extract Water Bodies
join_4 = List.Join(list0=code_block_3.waterways, list1=code_block_3.waterbodies)
py_7 = Python(IN[0]=join_4)  # "CreateMeshes.py"; CPython3; same code as py_5
ꟿ_tkmesh_tomesh_2 = Custom[ꟿ TkMesh.ToMesh](tkMesh=py_7)
categories_2 = Categories("OST_GenericModel")
string_4 = StringInput("gis2bim_env_blue")
byName_2 = Material.ByName(name=string_4)
code_block_8 = CodeBlock { "NLRS_90_GM_3D_BAG1_Blue_Areas"; }
byMesh_2 = DirectShape.ByMesh(mesh=ꟿ_tkmesh_tomesh_2, category=categories_2, material=byName_2, name=code_block_8)
geometry_4 = Element.Geometry(element=byMesh_2)

# group: Extract infra bodies
join_5 = List.Join(list0=code_block_3.bridges, list1=code_block_3.roads, list2=code_block_3.railways)
py_8 = Python(IN[0]=join_5)  # "CreateMeshes.py"; CPython3; same code as py_5
ꟿ_tkmesh_tomesh_3 = Custom[ꟿ TkMesh.ToMesh](tkMesh=py_8)
categories_3 = Categories("OST_GenericModel")
string_5 = StringInput("gis2bim_env_grey")
byName_3 = Material.ByName(name=string_5)
code_block_9 = CodeBlock { "NLRS_90_GM_3D_BAG1_Grey_Areas"; }
byMesh_3 = DirectShape.ByMesh(mesh=ꟿ_tkmesh_tomesh_3, category=categories_3, material=byName_3, name=code_block_9)
geometry_5 = Element.Geometry(element=byMesh_3)

# group: Set ProjectBasepoint to Coordinates
code_block_10 = CodeBlock(location=code_block.ProjectLocationT1) { location[0]; location[1]; location[2]; }  # frozen
code_block_11 = CodeBlock(targetX=code_block_10.out0, targetY=code_block_10.out1, targetZ=code_block_10.out2) { targetX; targetY; targetZ; }
py_9 = Python(IN[0]=code_block_11.targetX, IN[1]=code_block_11.targetY, IN[2]=code_block_11.targetZ)  # "SetProjectLocationXYZ.py"; CPython3
# ---------- py_9.python (37 lines) ----------
# Load the Python Standard and DesignScript Libraries
import clr
import sys
import System
clr.AddReference("RevitServices")
import RevitServices
from RevitServices.Persistence import DocumentManager 
from RevitServices.Transactions import TransactionManager 

import Autodesk 
from Autodesk.Revit.DB import *
from Autodesk.Revit.UI import *

doc = DocumentManager.Instance.CurrentDBDocument

# The inputs to this node will be stored as a list in the IN variables.
X = IN[0]
Y = IN[1]
Z = IN[2]

# Place your code below this line

def convertMToFt(distance):
    return distance * 3.280839895

originXYZ = XYZ(0,0,0)
targetPosition = ProjectPosition(convertMToFt(X),convertMToFt(Y),convertMToFt(Z),0.0)

TransactionManager.Instance.EnsureInTransaction(doc)

projectLocation = doc.ActiveProjectLocation;
projectLocation.SetProjectPosition(originXYZ, targetPosition)

TransactionManager.Instance.TransactionTaskDone()

# Assign your output to the OUT variable.
OUT = 0
# ----------------------------------------
