# Dynamo graph GIS2BIM_CreateProjectParameters_v7.dyn "GIS2BIM_CreateProjectParameters_v5" (Dynamo 2.19.3.6394)
# packages: Clockwork for Dynamo 2.x 2.4.0

# group: Define Data Parameters & Types
code_block = CodeBlock()
# ---------- code_block.designscript (5 lines) ----------
["year_of_construction",
"cadastre_id",
"usage_status",
"usage_type"
];
# ----------------------------------------
spec_types = SpecTypes("autodesk.spec:spec.int64")
spec_types_2 = SpecTypes("autodesk.spec:spec.string")
code_block_2 = CodeBlock(integerType=spec_types, textType=spec_types_2)
# ---------- code_block_2.designscript (5 lines) ----------
[integerType,
textType,
textType,
textType
];
# ----------------------------------------

projectParameters = Custom[Document.ProjectParameters]()  # package Clockwork for Dynamo 2.x; Retrieves all project parameters and the categories they have been assigned to
py = Python(IN[0]=code_block, IN[1]=projectParameters.paramName, IN[2]=code_block_2)  # "FilterExisting.py"; CPython3
# ---------- py.python (22 lines) ----------
# Load the Python Standard and DesignScript Libraries
import sys
import clr
clr.AddReference('ProtoGeometry')
from Autodesk.DesignScript.Geometry import *

# The inputs to this node will be stored as a list in the IN variables.
possibleItems = IN[0]
existingItems = IN[1]
correspondingTypes = IN[2]

# Place your code below this line

resultNames = []
resultTypes = []
for index, item in enumerate(possibleItems):
    if item not in existingItems:
        resultNames.append(item)
        resultTypes.append(correspondingTypes[index])

# Assign your output to the OUT variable.
OUT = [resultNames, resultTypes]
# ----------------------------------------
code_block_3 = CodeBlock(result=py) { result; names = result[0]; types = result[1]; "tekst"; }
group_types = GroupTypes("autodesk.parameter.group:text")
boolean = BoolSelector(true)
categories = Categories("OST_GenericModel")
list_create = List.Create(item0=categories)
createProjectParameter = Parameter.CreateProjectParameter(parameterName=code_block_3.names, groupName=code_block_3.out3, specType=code_block_3.types, groupType=group_types, instance=boolean, categoryList=list_create)
