# Dynamo graph GIS2BIM_KLIC_createLijntypes_V7.dyn "GIS2BIM_KLIK_createLijntypes_V5" (Dynamo 2.16.2.5624)
# packages: GIS2BIM for Dynamo 2.x 0.11.24

GIS2BIM_filepaths = Custom[GIS2BIM_filepaths]()  # Gets the filepaths from the model.
GIS2BIM_GetSharedCoordinate = Custom[GIS2BIM_GetSharedCoordinate]()  # package GIS2BIM for Dynamo 2.x; Get the current shared coordinate
GIS2BIM_KLICToCurves = Custom[GIS2BIM_KLICToCurves](filepaths=GIS2BIM_filepaths.05_KLICfiles, RDX=GIS2BIM_GetSharedCoordinate.EastWest, RDY=GIS2BIM_GetSharedCoordinate.NorthSouth, lacing=Longest)  # Reads the KLIC json files and filters the lines
flatten = List.Flatten(list=GIS2BIM_KLICToCurves.4_Unique_features)
uniqueItems = List.UniqueItems(list=flatten)
default_linestyle_to_use = CodeBlock { "<Medium Lines>"; }
python_script_get_or_create = Python(IN[0]=uniqueItems, IN[1]=default_linestyle_to_use)  # "Python Script get or create graphicstyles"; CPython3
# ---------- python_script_get_or_create.python (95 lines) ----------
import clr
clr.AddReference('RevitAPI')
import Autodesk
from Autodesk.Revit.DB import *

clr.AddReference('RevitNodes')
import Revit
clr.ImportExtensions(Revit.Elements)

clr.AddReference('RevitServices')
import RevitServices
from RevitServices.Persistence import DocumentManager
from RevitServices.Transactions import TransactionManager

import random

# The inputs to this node will be stored as a list in the IN variables.
dataEnteringNode = IN

KLICfeaturetypes= IN[0]
defaultlinestyle = IN[1]

#get current document and graphic category of graphicstyles
doc = DocumentManager.Instance.CurrentDBDocument
cat = Category.GetCategory(doc, BuiltInCategory.OST_Lines)
gs = cat.GetGraphicsStyle(GraphicsStyleType.Projection)
gscat = gs.GraphicsStyleCategory.SubCategories

#create new linstyle
def createnewlinestyle(name, weight, linePatternElem, color):
    TransactionManager.Instance.EnsureInTransaction(doc)
    print('new linestyle wil be created: ', name, ' weight:', weight, ' ID:', linePatternElem, ' color:', color)
    newLineStyleSubCat = doc.Settings.Categories.NewSubcategory(cat, name)
    newLineStyleSubCat.SetLineWeight(weight,GraphicsStyleType.Projection)
    newLineStyleSubCat.LineColor = color
    newLineStyleSubCat.SetLinePatternId(linePatternElem, GraphicsStyleType.Projection)
    TransactionManager.Instance.TransactionTaskDone()
    return(newLineStyleSubCat.GetGraphicsStyle(GraphicsStyleType.Projection))
  
Linestylenames = []
Linestyles = []
Linegraphicstylepatternids = []

#get all linestyles in document  
for i in gscat:
    #get all linestylenames
    Linestylename = i.Name
    Linestylenames.append(Linestylename)
    #get all grahicstyle of all linestyles
    Linegraphicstyle = i.GetGraphicsStyle(GraphicsStyleType.Projection)
    Linestyles.append(Linegraphicstyle)
    #get all pattern id`s of graphicstyles
    Linegraphicstylepatternid = i.GetLinePatternId(GraphicsStyleType.Projection)
    Linegraphicstylepatternids.append(Linegraphicstylepatternid)

OUTgraphicstyles = []
unique_list = []
unique_list_graphicstyles = []
#get featuretypes from the klicfiles and search corresponding graphicstyles (same name as featuretype)
for featuretype in KLICfeaturetypes:
    KLICLineStyleName = 'KLIC_' + str(featuretype)
    try:
        # check if linestyle is already in the project and get the graphicstyle
        index = Linestylenames.index(KLICLineStyleName)
        graphicstyle = Linestyles[index]
        OUTgraphicstyles.append(graphicstyle)
        print(KLICLineStyleName + ' linestyle found in the project')
        #print(index, graphicstyle, featuretype)
    except:
        #create new lines style with name of featuretype if not already created done (in the uniquelist thus....)
        try: 
            index = unique_list.index(KLICLineStyleName)
            graphicstyle = unique_list_graphicstyles[index]
            OUTgraphicstyles.append(graphicstyle)
            print(KLICLineStyleName + ' already created once by this script')
        except:
            #get patternid from the default linestyle to use for the new lynstyle 
            index = Linestylenames.index(defaultlinestyle)
            graphicstylepatternid = Linegraphicstylepatternids[index]
            #create some new values for the new linestyle
            colorred = random.randrange(0, 255, 10)
            colorgreen = random.randrange(0, 255, 10)
            colorblue = random.randrange(0, 255, 10)
            color = Autodesk.Revit.DB.Color(colorred,colorgreen,colorblue)
            weight = 8
            #create a new linestyle with above parameters
            print(KLICLineStyleName)
            newlinestyle = createnewlinestyle(KLICLineStyleName, weight, graphicstylepatternid, color)
            #add the new linegraphicstyle to the output and to the uniquelist
            OUTgraphicstyles.append(newlinestyle)
            unique_list.append(KLICLineStyleName)
            unique_list_graphicstyles.append(newlinestyle)
            print('new linestyle is created: ', index, ' : ', newlinestyle, ' : ', graphicstylepatternid, ' : ', color)   
            
OUT = OUTgraphicstyles, unique_list, unique_list_graphicstyles
# ----------------------------------------
getAll = Custom[GetAll]()  # Gets all Graphic Styles in the project.
byName = Custom[ByName](LineTypeName=default_linestyle_to_use, LineTypeNamesInProject=getAll.01_Names, GraphicstylesInProject=getAll.02_Graphicstyles)  # Get a Graphic Style by name
