# Dynamo graph GIS2BIM_Luchtfoto_Tijdreis_v7.dyn (Dynamo 2.19.3.6394)
# packages: GIS2BIM for Dynamo 2.x 0.12.1, Genius Loci 2024.5.29

# group: Prerequisites
# note: This script needs the following pip packages:
# - request
# - xmltodict
# They need to be installed once using this script:
# W:\Toolbox NL projects\000 Tekenafspraken\DYNAMO\MLA_scripts\00_MLA_pipinstall.dyn
# Also the sheetname needs to be set to an existing sheet. Currently that's "Timeline".
# add syspath:
# import os
# localapp = os.getenv(r'LOCALAPPDATA')
# sys.path.append(os.path.join(localapp, r'python-3.9.12-embed-amd64\Lib\site-packages'))

# group: BBOX
GIS2BIM_GetSharedCoordinate = Custom[GIS2BIM_GetSharedCoordinate]()  # package GIS2BIM for Dynamo 2.x; Get the current shared coordinate
code_block = CodeBlock(RDx=GIS2BIM_GetSharedCoordinate.EastWest, RDy=GIS2BIM_GetSharedCoordinate.NorthSouth)
# ---------- code_block.designscript (5 lines) ----------
RDx;
RDy;
bbox = 250;
imageSize = 100;
 //in mm;
# ----------------------------------------
GIS2BIM_CreateBoundingBox = Custom[GIS2BIM_CreateBoundingBox](CoordinateX=code_block.RDx, CoordinateY=code_block.RDy, BoxWidth=code_block.bbox, BoxHeight=code_block.bbox)  # create boundingboxstring for webrequests based on coördinates and dimensions

code_block_2 = CodeBlock()
# ---------- code_block_2.designscript (6 lines) ----------
["2016_ortho25",
"2018_ortho25",
"2020_ortho25",
"2022_ortho25",
"2023_ortho25",
"Actueel_ortho25"];
# ----------------------------------------
code_block_3 = CodeBlock()
# ---------- code_block_3.designscript (8 lines) ----------
"https://service.pdok.nl/hwh/luchtfotorgb/";
"wmts/v1_0?&request=GetMap&VERSION=1.3.0";
"&STYLES=&layers=";
"&width=2000&height=2000&format=image/png&crs=EPSG:28992";
"&bbox=";

//view
"gis2bim_luchtfoto";
# ----------------------------------------
concat = String.Concat(string0=code_block_3.out0, string1=code_block_3.out1, string2=code_block_3.out2, string4=code_block_3.out3, string5=code_block_3.out4, string6=GIS2BIM_CreateBoundingBox.Boxstring)  # unwired: string3
map = List.Map(list=code_block_2, function=concat)
GIS2BIM_WebrequestWMS = Custom[GIS2BIM_WebrequestWMS](WMSwebrequest=map, lacing=Longest)  # a webrequest based on WMS-protocol

# group: Find or Create Directory
py = Python()  # "GetCentralOrLocalDirectory.py"; CPython3
# ---------- py.python (20 lines) ----------
import clr
import os 

clr.AddReference('RevitServices')
from RevitServices.Persistence import DocumentManager

clr.AddReference('RevitAPI')
from Autodesk.Revit.DB import *

doc = DocumentManager.Instance.CurrentDBDocument

fileName = '' 
if doc.IsWorkshared:
	cp = doc.GetWorksharingCentralModelPath()
	fileName = ModelPathUtils.ConvertModelPathToUserVisiblePath(cp)
else:
    fileName = doc.PathName

directoryPath = os.path.split(fileName)[0]
OUT = directoryPath
# ----------------------------------------
# note: \\ becomes \ due to escaping
code_block_4 = CodeBlock(path=py) { path + "\\GISDATA\\images\\timelineluchtfoto\\"; }
findOrCreateDirectory = Python(IN[0]=code_block_4)  # CPython3
# ---------- findOrCreateDirectory.python (13 lines) ----------
# Load the Python Standard and DesignScript Libraries
import sys
import os

# The inputs to this node will be stored as a list in the IN variables.
path = IN[0]

# Place your code below this line
if not os.path.exists(path):
    os.makedirs(path)

# Assign your output to the OUT variable.
OUT = path
# ----------------------------------------
images_path = DirectoryObject(path=findOrCreateDirectory)

# group: Place Images on Sheet
code_block_5 = CodeBlock()
# ---------- code_block_5.designscript (10 lines) ----------
// Image Size [mm]
100;
100;
// Image Gap Distance [mm]
20;
// Shift [mm]
0;
10;
// Frame [mm]
30;
# ----------------------------------------
code_block_6 = CodeBlock(imageWidth=code_block_5.out0) { imageWidth / 1000; }
sheets = Sheets("luchtfototijdreis")
sheet_totitleblock = Custom[Sheet ToTitleBlock](sheet=sheets)  # package Genius Loci; Retrieves the titleblock from the given sheet in the active or given document.
annotation_boundingbox = Custom[Annotation BoundingBox](element=sheet_totitleblock)  # package Genius Loci; Get the BoundingBox of the view specific element. (Text, tag, etc)
minPoint = BoundingBox.MinPoint(boundingBox=annotation_boundingbox.BoundingBox)
maxPoint = BoundingBox.MaxPoint(boundingBox=annotation_boundingbox.BoundingBox)
string = StringInput("\")
code_block_7 = CodeBlock(path=images_path, slash=string, name=code_block_2) { path+slash+name+".png"; }
GIS2BIM_ImageToFile = Custom[GIS2BIM_ImageToFile](ImageObject=GIS2BIM_WebrequestWMS, FileNamePath=code_block_7, lacing=Longest)  # package GIS2BIM for Dynamo 2.x; Write Image to file
count = List.Count(list=GIS2BIM_ImageToFile)
py_2 = Python(IN[0]=minPoint, IN[1]=maxPoint, IN[2]=code_block_5.out0, IN[3]=code_block_5.out1, IN[4]=count, IN[5]=code_block_5.out2, IN[6]=code_block_5.out3, IN[7]=code_block_5.out4, IN[8]=code_block_5.out5)  # "CalculateSheetPositions.py"; CPython3
# ---------- py_2.python (55 lines) ----------
# Load the Python Standard and DesignScript Libraries
import sys
import clr
clr.AddReference('ProtoGeometry')
from Autodesk.DesignScript.Geometry import *

import math

# The inputs to this node will be stored as a list in the IN variables.
bboxMin = IN[0]
bboxMax = IN[1]
imageWidth = IN[2]
imageHeight = IN[3]
imageCount = IN[4]
gapDistance = IN[5]
shiftX = IN[6]
shiftY = IN[7]
minFrame = IN[8]

frameWidth = abs(bboxMax.X - bboxMin.X)
frameHeight = abs(bboxMax.Y - bboxMin.Y)

maxItemsPerRow = math.floor((frameWidth - 2 * minFrame + gapDistance) / (imageWidth + gapDistance))
maxItemsPerCol = math.floor((frameHeight - 2 * minFrame + gapDistance) / (imageHeight + gapDistance))

rowCount = min(maxItemsPerCol, math.ceil(imageCount / maxItemsPerRow))
colCount = min(maxItemsPerRow, math.ceil(imageCount / maxItemsPerCol))

contentWidth = colCount * imageWidth + (colCount - 1) * gapDistance
contentHeight = rowCount * imageHeight + (rowCount - 1) * gapDistance

actualFrameWidth = (frameWidth - contentWidth) / 2
actualFrameHeight = (frameHeight - contentHeight) / 2

positionsX = []
positionsY = []
currentRow = 0
currentCol = 0
for i in range(imageCount):
    x = actualFrameWidth + currentCol * (imageWidth + gapDistance) + imageWidth / 2
    y = actualFrameHeight + currentRow * (imageHeight + gapDistance) + imageHeight / 2
    
    positionsX.append(x + bboxMin.X + shiftX)
    positionsY.append(bboxMax.Y - y + shiftY)
    
    currentCol += 1
    
    if currentCol >= maxItemsPerRow:
        currentCol = 0
        currentRow += 1
        
    if currentRow >= maxItemsPerCol:
        break
 
OUT = [positionsX, positionsY]
# ----------------------------------------
code_block_8 = CodeBlock(result=py_2) { result; deltaXs = result[0]; deltaYs = result[1]; }

# group: Scale on Sheet
div = code_block.bbox / code_block_6
floor = Math.Floor(number=div)
code_block_9 = CodeBlock(scale=floor) { "1:" + scale; }
watch = Watch(code_block_9)

# group: Add Titles
py_3 = Python(IN[0]=py_2, IN[1]=code_block_5.out1)  # "CalculateTitlePositions.py"; CPython3
# ---------- py_3.python (28 lines) ----------
# Load the Python Standard and DesignScript Libraries
import sys
import clr
clr.AddReference('ProtoGeometry')
from Autodesk.DesignScript.Geometry import *

# The inputs to this node will be stored as a list in the IN variables.
imagePositions = IN[0]
imageHeight = IN[1]

# Place your code below this line
positionsX = imagePositions[0]
positionsY = imagePositions[1]

MARGIN = 3

points = []
for index, imgX in enumerate(positionsX):
    imgY = positionsY[index]
    
    x = imgX - imageHeight / 2
    y = imgY - imageHeight / 2 - MARGIN
    
    points.append(Point.ByCoordinates(x, y, 0))


# Assign your output to the OUT variable.
OUT = points
# ----------------------------------------
select_horizontal_text_alignment = HorizontalAlignment("Left")
byLocation = TextNote.ByLocation(view=sheets, location=py_3, text=code_block_2, alignment=select_horizontal_text_alignment)

GIS2BIM_ImportImageInView = Custom[GIS2BIM_ImportImageInView](ImageWidthMeters=code_block_6, view=sheets, ImagePath=GIS2BIM_ImageToFile, DeltaX=code_block_8.deltaXs, DeltaY=code_block_8.deltaYs, lacing=Longest)  # package GIS2BIM for Dynamo 2.x; Import rasterimage in view
watch_2 = Watch(images_path)
code_block_10 = CodeBlock()
# ---------- code_block_10.designscript (11 lines) ----------
["2016_ortho25",
"2017_ortho25",
"2018_ortho25",
"2019_ortho25",
"2020_ortho25",
"2021_orthoHR",
"2022_ortho25",
"2022_orthoHR",
"2023_ortho25",
"2024_quickorthoHR",
"Actueel_ortho25"];
# ----------------------------------------
