# Dynamo graph GIS2BIM_Natura2000.dyn (Dynamo 2.19.3.6394)
# packages: GIS2BIM for Dynamo 2.x 0.11.25, Clockwork for Dynamo 2.x 2.3.0, GIS2BIM for Dynamo 2.x 0.12.0, GIS2BIM for Dynamo 2.x 0.12.1, spring nodes 210.1.1

# group: bbox
afmeting_boundingbox_in_meters = IntegerSlider(20000, range=100..25000 step 1)  # "Afmeting boundingbox in meters(breedte, hoogte)"; graph input
code_block = CodeBlock { "4326"; "28992"; "D3IE5e05fHLTJDHoVr8D"; }
GIS2BIM_GetRevitSiteLocation = Custom[GIS2BIM_GetRevitSiteLocation]()  # package GIS2BIM for Dynamo 2.x; Gets the properties of the current Site Location of the active Revit Project
GIS2BIM_TransformCRS_epsg = Custom[GIS2BIM_TransformCRS_epsg](SourceCRS=code_block.out0, TargetCRS=code_block.out1, xCoordinate=GIS2BIM_GetRevitSiteLocation.Lon, yCoordinate=GIS2BIM_GetRevitSiteLocation.Lat, ApiKey=code_block.out2)  # package GIS2BIM for Dynamo 2.x; Uses the API of http://epsg.io to transform Coordinate Reference Systems
GIS2BIM_CreateBoundingBox = Custom[GIS2BIM_CreateBoundingBox](CoordinateX=GIS2BIM_TransformCRS_epsg.Xtransformed, CoordinateY=GIS2BIM_TransformCRS_epsg.Ytransformed, BoxWidth=afmeting_boundingbox_in_meters, BoxHeight=afmeting_boundingbox_in_meters)  # package GIS2BIM for Dynamo 2.x; create boundingboxstring for webrequests based on coördinates and dimensions

code_block_2 = CodeBlock { "GIS2BIM_natura2000_overzicht"; }
MLA_SelectByName = Custom[View.MLA_SelectByName](Viewname=code_block_2)  # Select a view by its name

# group: create images
code_block_3 = CodeBlock(bbox=GIS2BIM_CreateBoundingBox.Boxstring)
# ---------- code_block_3.designscript (11 lines) ----------
link="https://service.pdok.nl/rvo/natura2000/wms/v1_0?";
request="request=GetMap&service=wms&VERSION=1.3.0";
layer="&STYLES=&layers=Natura2000";
params="&width=2500&height=2500&format=image/png&crs=EPSG:28992&bbox=";
link+request+layer+params+bbox;

link1="https://service.pdok.nl/hwh/luchtfotorgb/wms/v1_0?";
request1="&request=GetMap&VERSION=1.3.0";
layer1="&STYLES=&layers=Actueel_orthoHR";
params1="&width=2500&height=2500&format=image/png&crs=EPSG:28992&bbox=";
link1+request1+layer1+params1+bbox;
# ----------------------------------------
GIS2BIM_WebrequestWMS = Custom[GIS2BIM_WebrequestWMS](WMSwebrequest=code_block_3.out9)  # package GIS2BIM for Dynamo 2.x; a webrequest based on WMS-protocol
GIS2BIM_WebrequestWMS_2 = Custom[GIS2BIM_WebrequestWMS](WMSwebrequest=code_block_3.out4)
GIS2BIM_ImageMakeTransparant = Custom[GIS2BIM_ImageMakeTransparant](Bitmap=GIS2BIM_WebrequestWMS_2)  # package GIS2BIM for Dynamo 2.x; Makes a System.Drawing.Bitmap transparant
list_create = List.Create(item0=GIS2BIM_WebrequestWMS, item1=GIS2BIM_ImageMakeTransparant)
GIS2BIM_MergeImages = Custom[GIS2BIM_MergeImages](images=list_create)  # package GIS2BIM for Dynamo 2.x; Merges a list of images to 1 image
watch_image = WatchImageCore(image=GIS2BIM_WebrequestWMS)
watch_image_2 = WatchImageCore(image=GIS2BIM_ImageMakeTransparant)
watch_image_3 = WatchImageCore(image=GIS2BIM_MergeImages)
python_script = Python(IN[0]=GIS2BIM_WebrequestWMS_2)  # CPython3
# ---------- python_script.python (17 lines) ----------
import sys
sys.path.append("C:\Users\joche\AppData\Local\python-3.9.12-embed-amd64\Lib")

import clr
import Pillow

clr.AddReference("System.Drawing")
clr.AddReference("System")
from System.Drawing import Image
from System.Drawing import Bitmap
from System.Drawing import Graphics
img= IN[0]

bmp2 = Bitmap(img)
bmp2.MakeTransparent()

OUT = bmp2
# ----------------------------------------

# group: Afbeelding inladen
code_block_4 = CodeBlock(bboxWidth=afmeting_boundingbox_in_meters) { scale = 1000; width = bboxWidth/scale; }
filePaths = Custom[FilePaths]()  # Gets the filepaths from the model.
code_block_5 = CodeBlock(path=filePaths.04_imagedir) { path+"/natura2000.png"; }
writeToFile = Image.WriteToFile(path=code_block_5, image=GIS2BIM_MergeImages)
passthrough = Custom[Passthrough](passThrough=code_block_5, waitFor=writeToFile)  # package Clockwork for Dynamo 2.x; Forces a sequential order of execution. The node wired into the output of the Passthrough node will be executed *after* the node wired into the waitFor input (e.g. important for some Revit operations). The value of the passThrough input will be passed on to the node wired into the output port of the Passthrough node.
GIS2BIM_ImportImageInView = Custom[GIS2BIM_ImportImageInView](ImageWidthMeters=code_block_4.width, view=MLA_SelectByName, ImagePath=passthrough)  # package GIS2BIM for Dynamo 2.x; Import rasterimage in view

byCoordinates = Point.ByCoordinates()

# group: natura2000 gebieden
code_block_6 = CodeBlock(bbox=GIS2BIM_CreateBoundingBox.Boxstring, rdx=GIS2BIM_TransformCRS_epsg.Xtransformed, rdy=GIS2BIM_TransformCRS_epsg.Ytransformed)
# ---------- code_block_6.designscript (8 lines) ----------
link="https://service.pdok.nl/rvo/natura2000/wfs/v1_0?";
request="service=wfs&version=2.0.0&request=GetFeature";
layer="&typeName=Natura2000&bbox=";
link+request+layer+bbox;
//XPATHSTRING
XPATHSTRING: string=".//{http://www.opengis.net/gml/3.2}posList";
rdx;
rdy;
# ----------------------------------------
web_request = WebRequest(url=code_block_6.out3)
GIS2BIM_CreatePointsPolygonFromGMLxy = Custom[GIS2BIM_CreatePointsPolygonFromGMLxy](XML=web_request, XPATHSTRING=code_block_6.XPATHSTRING, DeltaX=code_block_6.rdx, DeltaY=code_block_6.rdy, lacing=CrossProduct)  # package GIS2BIM for Dynamo 2.x; Create point and polygons from a GML-file

byPatch = Surface.ByPatch(closedCurve=GIS2BIM_CreatePointsPolygonFromGMLxy.PolyCurves)
closestPointTo = Geometry.ClosestPointTo(geometry=byPatch, other=byCoordinates)
byStartPointEndPoint = Line.ByStartPointEndPoint(startPoint=byCoordinates, endPoint=closestPointTo)
length = Curve.Length(curve=byStartPointEndPoint)
minimumItem = List.MinimumItem(list=length)
byCenterPointRadius = Circle.ByCenterPointRadius(centerPoint=byCoordinates, radius=minimumItem)
code_block_7 = CodeBlock { "MLA_lijn_1"; }
GIS2BIM_CreateDetailLinesFromPolygons = Custom[GIS2BIM_CreateDetailLinesFromPolygons](view=MLA_SelectByName, PolyCurves=byCenterPointRadius, Linestyle=code_block_7)  # package GIS2BIM for Dynamo 2.x; Create detaillines from polygons in a view
categories = Categories("OST_ProjectInformation")
all_elements_of_category = ElementsOfCategory(Category=categories)
code_block_8 = CodeBlock(afstandinmeters=minimumItem) { "natura2000_afstand"; Math.Round(afstandinmeters); }
setParameterByName = Element.SetParameterByName(element=all_elements_of_category, parameterName=code_block_8.out0, value=code_block_8.out1)
code_block_9 = CodeBlock { "MLA_DP_natura2000"; }
byName = FilledRegionType.ByName(name=code_block_9)
ꟿ_filledregion_bycurves = Custom[ꟿ FilledRegion.ByCurves+](view=MLA_SelectByName, type=byName, curveLoops=GIS2BIM_CreatePointsPolygonFromGMLxy.PolyCurves)  # package spring nodes; Fully utilizes the FilledRegion.Create api method, unlike the OOTB node. You must provide a list with sublist of curve loops.
