# Dynamo graph GIS2BIM_OSM_V5.dyn (Dynamo 3.3.0.6316)
# packages: LunchBox for Dynamo 2018.7.6, Genius Loci 2021.2.3, archi-lab.net 2020.23.13, spring nodes 203.1.0, Clockwork for Dynamo 2.x 2.1.2, GIS2BIM for Dynamo 2.x 0.11.24, Elk 1.1.0

# group: Input
filePaths = Custom[FilePaths]()  # Gets the filepaths from the model.
code_block = CodeBlock(path=filePaths.06_OSMfiles) { path+"/map.osm"; }
watch = Watch(filePaths.06_OSMfiles)

location = Elk.OSM.Location(filePath=code_block)
features = Elk.OSM.Features()

# group: Control
code_block_2 = CodeBlock(features=features)
# ---------- code_block_2.designscript (4 lines) ----------
List.GetItemAtIndex(features,[[11],[15], [5]]);
subfeatures = [[0..31], [0..31], [0..51]];
List.GetItemAtIndex(features,[[11]]);
subfeatures1 = [[0..31]];
# ----------------------------------------
code_block_3 = CodeBlock(a=code_block_2.out0, b=code_block_2.subfeatures) { a; b; }

subFeatures = Elk.OSM.SubFeatures(feature=code_block_3.a, subIndexes=code_block_3.b, lacing=Longest)

# group: get osm data regions
code_block_4 = CodeBlock { 1; }
flatten = List.Flatten(list=subFeatures.selected, amount=code_block_4)
flatten_2 = List.Flatten(list=code_block_3.a, amount=code_block_4)
code_block_5 = CodeBlock(a=flatten_2, b=flatten) { List.Flatten(a+":"+b); }

OSMData = Elk.OSM.OSMData(OSM=location.OSM, File=location.XML, featureType=code_block_3.a, subTypes=flatten)

# group: To Revit
X = Point.X(point=OSMData.Points)
code_block_6 = CodeBlock { 1000; 0; }
mul = X * code_block_6.out0
Y = Point.Y(point=OSMData.Points)
mul_2 = Y * code_block_6.out0
byCoordinates = Point.ByCoordinates(x=mul, y=mul_2, z=code_block_6.out1)

# group: osm data list filtered > only objects with points
code_block_7 = CodeBlock { 1; 2; }
flatten_3 = List.Flatten(list=OSMData.Keys@L2, amount=code_block_7.out1)
flatten_4 = List.Flatten(list=byCoordinates@L3, amount=code_block_7.out0)
count = List.Count(list=flatten_4@@L2)
gt = count > code_block_7.out0
filterByBoolMask = List.FilterByBoolMask(list=flatten_3, mask=gt)
filterByBoolMask_2 = List.FilterByBoolMask(list=flatten_4, mask=gt)
code_block_8 = CodeBlock { 1; }
pruneDuplicates = Point.PruneDuplicates(points=filterByBoolMask_2.in, tolerance=code_block_8)

generates_the_names_for_the = Python(IN[0]=filterByBoolMask.in, IN[1]=code_block_5)  # "generates the names for the regions"; CPython3
# ---------- generates_the_names_for_the.python (21 lines) ----------
# Load the Python Standard and DesignScript Libraries
import sys
import clr
clr.AddReference('ProtoGeometry')
from Autodesk.DesignScript.Geometry import *

# The inputs to this node will be stored as a list in the IN variables.
dataEnteringNode = IN

aOsmdata = IN[0]
aSubFeatures = IN[1]
aDebug = []
aOutPut = []

for item in aOsmdata:
	for subitem in item:
		for subfeautere in aSubFeatures:
			if str(subfeautere) == str(subitem):
				aOutPut.append("osm_"+subfeautere.replace(":", "_"))
# Assign your output to the OUT variable.
OUT = aOutPut
# ----------------------------------------

# group: create polygons / filled regions
code_block_9 = CodeBlock { "gis2bim_osm"; }
selectByName = Custom[SelectByName](Viewname=code_block_9)  # Select a view by its name
byName = FilledRegionType.ByName(name=generates_the_names_for_the)
code_block_10 = CodeBlock(view=selectByName, aRegion=byName) { Elements.Element.Id(view); Elements.Element.Id(aRegion); }
code_block_11 = CodeBlock { true; }
byPoints = PolyCurve.ByPoints(points=pruneDuplicates@@L3, connectLastToFirst=code_block_11)
closeWithLine = PolyCurve.CloseWithLine(polyCurve=byPoints)
explode = Geometry.Explode(geometry=closeWithLine)
code_block_12 = CodeBlock { 1; }
flatten_5 = List.Flatten(list=explode, amount=code_block_12)
python_script = Python(IN[0]=code_block_10.out1, IN[1]=code_block_10.out0, IN[2]=flatten_5)  # IronPython2; frozen
# ---------- python_script.python (52 lines) ----------
import clr

clr.AddReference('RevitAPI')
from Autodesk.Revit.DB import *
import System.Collections.Generic
from System.Collections.Generic import List

clr.AddReference('RevitNodes')
import Revit
clr.ImportExtensions(Revit.GeometryConversion)

clr.AddReference('RevitServices')
from RevitServices.Transactions import TransactionManager
from RevitServices.Persistence import DocumentManager

doc = DocumentManager.Instance.CurrentDBDocument

afilledType = IN[0]
iViewId = ElementId(IN[1])
aOSMcurves = IN[2]
aDebug = []
aFilledregions = []

def create_filledregions(boundariesLoop, ifilledType):
	for i in range(1):
		print("this is just genius")
	TransactionManager.Instance.EnsureInTransaction(doc)
	filled = FilledRegion.Create(doc, ifilledType, iViewId, boundariesLoop)
	TransactionManager.Instance.TransactionTaskDone()
	aFilledregions.append(filled)

i=-1
for aPolycurvelist in aOSMcurves:
	i=i+1
	ifilledType = ElementId(afilledType[i])
	if aPolycurvelist>1:
		aBoundariesLoop = []
		aCurves = []
		for aCurvelist in aPolycurvelist:
			aCurves.Add(aCurvelist.ToRevitType())
		aBoundariesLoop.Add(CurveLoop.Create(aCurves))
		create_filledregions(aBoundariesLoop, ifilledType)
	else:
		for aPolycurvelist in aSubfeatures:
			aCurves = []
			aBoundariesLoop = []
			for aCurvelist in aPolycurvelist:
				aCurves.Add(aCurvelist.ToRevitType())
			aBoundariesLoop.Add(CurveLoop.Create(aCurves))
			create_filledregions(aBoundariesLoop, ifilledType)
				
OUT = aDebug
# ----------------------------------------
byCurves = FilledRegion.ByCurves(view=selectByName, boundary=flatten_5, regionType=byName)

features_2 = Elk.OSM.Features()  # frozen

# group: get osm test
code_block_13 = CodeBlock(features=features_2) { List.GetItemAtIndex(features,[2]); subfeatures = [0..31]; }

subFeatures_2 = Elk.OSM.SubFeatures(feature=code_block_13.out0, subIndexes=code_block_13.subfeatures, lacing=Longest)  # frozen

# group (continued): get osm test
code_block_14 = CodeBlock(l=code_block_13.out0, P=subFeatures_2.all) { l[0]; P[0][10]; }
watch_2 = Watch(code_block_14.out1)
watch_3 = Watch(code_block_14.out0)
watch_4 = Watch(subFeatures_2.all)

# group: create filled patterns
element_types = ElementTypes("FilledRegionType")
all_elements_of_type = ElementsOfType(element_type=element_types)
code_block_15 = CodeBlock(l=all_elements_of_type) { l[0]; }
code_block_16 = CodeBlock(a=watch_3, b=watch_4) { List.Flatten("osm_"+a+"_"+b); }
ꟿ_elementtype_duplicate = Custom[ꟿ ElementType.Duplicate](elementType=code_block_15, newName=code_block_16, lacing=Longest)  # package spring nodes; Create duplicate element types. If the type exists, it will be appended instead.

# group: filled pattern parameters
code_block_17 = CodeBlock { "Type Comments"; }
name = Element.Name(element=ꟿ_elementtype_duplicate)
setParameterByName = Element.SetParameterByName(element=ꟿ_elementtype_duplicate, parameterName=code_block_17, value=name)

# group: place filled patterns on legend
code_block_18 = CodeBlock { true; }
ꟿ_document_activeview = Custom[ꟿ Document.ActiveView](refresh=code_block_18)  # package spring nodes; Selects the current document's active view. Supports more view types than the built-in option. Will be depreciated once the bult in node works with all plan types.
code_block_19 = CodeBlock { 100; }  # frozen
code_block_20 = CodeBlock(n=code_block_19) { 0..n*20..n; 0; }
byCoordinates_2 = Point.ByCoordinates(x=code_block_20.out0, y=code_block_20.out0, z=code_block_20.out1, lacing=CrossProduct)
code_block_21 = CodeBlock { 50; [0,0.5]; }
byCenterPointRadius = Circle.ByCenterPointRadius(centerPoint=byCoordinates_2, radius=code_block_21.out0)
code_block_22 = CodeBlock { 4; }
regularPolygon = Polygon.RegularPolygon(circle=byCenterPointRadius, numberSides=code_block_22)
byCurves_2 = FilledRegion.ByCurves(view=ꟿ_document_activeview, boundary=regularPolygon, regionType=ꟿ_elementtype_duplicate)

# group: Control
code_block_23 = CodeBlock { 216; 216; 216; }
byARGB = Color.ByARGB(red=code_block_23.out0, green=code_block_23.out1, blue=code_block_23.out2)
filledregion_properties_change = Custom[FilledRegion Properties Change](FilledRegion_OrType=ꟿ_elementtype_duplicate, ForegroundPatternColor=byARGB, lacing=Longest)  # package Genius Loci; Assigns Pattern, Color and Line Weight to the given Filled Region or to a Filled Region Type. Note : Prior to Revit 2019, the materials have only one surface pattern and one cut pattern.

features_3 = Elk.OSM.Features()

# group: get osm data points
code_block_24 = CodeBlock(features=features_3) { List.GetItemAtIndex(features,[[2]]); subfeatures = [17]; }
code_block_25 = CodeBlock(a=code_block_24.out0, b=code_block_24.subfeatures) { a; b; }
code_block_26 = CodeBlock { 1; }
flatten_6 = List.Flatten(list=code_block_25.a, amount=code_block_26)

subFeatures_3 = Elk.OSM.SubFeatures(feature=code_block_25.a, subIndexes=code_block_25.b, lacing=Longest)

# group (continued): get osm data points
flatten_7 = List.Flatten(list=subFeatures_3.selected, amount=code_block_26)
code_block_27 = CodeBlock(a=flatten_6, b=flatten_7) { List.Flatten("00_MLA_SYM_GIS_"+a+"_"+b); }

OSMData_2 = Elk.OSM.OSMData(OSM=location.OSM, File=location.XML, featureType=code_block_25.a, subTypes=flatten_7)

# group: osm data list filtered > only objects with points
code_block_28 = CodeBlock { 1; 2; }  # frozen
flatten_8 = List.Flatten(list=OSMData_2.Points@L3, amount=code_block_28.out0)
count_2 = List.Count(list=flatten_8@@L2)
lt = count_2 < code_block_28.out1
filterByBoolMask_3 = List.FilterByBoolMask(list=flatten_8, mask=lt)

# group: place families on points
byPoint = FamilyInstance.ByPoint(point=filterByBoolMask_3.in)  # unwired: familyType
code_block_29 = CodeBlock { "00_MLA_SYM_GIS_busstation"; }  # frozen
byName_2 = FamilyType.ByName(name=code_block_29)
boolean = BoolSelector(false)
ꟿ_document_activeview_2 = Custom[ꟿ Document.ActiveView](refresh=boolean)
byPointInView = Custom[FamilyInstance.ByPointInView](point=filterByBoolMask_3.in, familyType=byName_2, view=ꟿ_document_activeview_2)  # package Clockwork for Dynamo 2.x; Places a family instance at a given point in a given view (e.g. a detail component).

code_block_30 = CodeBlock { 1000; 28992; }  # frozen
GIS2BIM_GetSharedCoordinate = Custom[GIS2BIM_GetSharedCoordinate]()  # frozen; package GIS2BIM for Dynamo 2.x; Get the current shared coordinate

# group: Import Public Transport Stations (OSM Overpass)
code_block_31 = CodeBlock(bbox=code_block_30.out0, targetEPSG=code_block_30.out1) { bbox; targetEPSG; }
py = Python(IN[0]=code_block_31.bbox, IN[1]=code_block_31.targetEPSG)  # "GetOPNVStationsOverpass.py"; CPython3
# ---------- py.python (105 lines) ----------
# Load the Python Standard and DesignScript Libraries
import sys
import clr
clr.AddReference('ProtoGeometry')
from Autodesk.DesignScript.Geometry import *

from urllib.request import Request, urlopen
import json
import re


# INPUT PARAMETERS
bbox = IN[0]
targetEPSG = IN[1]


# GOBALS
WSG84_EPSG = 4326 


# FUNCTIONS
def transformEPSG(source, target, x, y):
    convUrl = "http://epsg.io/trans?&s_srs={source}&t_srs={target}&x={x}&y={y}&format=json&trans=1".format(source=source, target=target, x=x, y=y)
    try:
        request = Request(convUrl)
        # Add some credibility to our request
        request.add_header('user-agent', 'Revit Dynamo')
        convResponse = urlopen(request)
        convData = json.loads(convResponse.read())
        return [convData['x'], convData['y']]
    except Exception as error:
        print('ERROR transforming coordinates:', error)
        return [x, y]
        
def extractType(tags):
    keys = tags.keys()
    if 'subway' in keys and tags['subway'] == 'yes':
        return 'subway'
    if 'tram' in keys and tags['tram'] == 'yes':
        return 'tram'
    if 'bus' in keys and tags['bus'] == 'yes':
        return 'bus'        

def extractLocation(lat, lon):
   return transformEPSG(WSG84_EPSG, targetEPSG, lon, lat)


# SCRIPT
# Step 1: Translate BBox to WSG84 Sperical
bboxElements = bbox.split(',')
bboxWSG84Start = transformEPSG(targetEPSG, WSG84_EPSG, bboxElements[0], bboxElements[1])
bboxWSG84End = transformEPSG(targetEPSG, WSG84_EPSG, bboxElements[2], bboxElements[3])
bboxWSG84 = "{xMin},{yMin},{xMax},{yMax}".format(xMin=bboxWSG84Start[1],yMin=bboxWSG84Start[0],xMax=bboxWSG84End[1],yMax=bboxWSG84End[0])


# Step 2: Construct Query
query = '[out:json];(node["public_transport"="stop_position"]({bbox});node["public_transport"="platform"]({bbox}););out;'.format(bbox=bboxWSG84)


# Step 3: Construct URL and make request
url = 'https://z.overpass-api.de/api/interpreter?data={query}'.format(query=query)

print('OVERPASS URL', url)

request = Request(url)
request.add_header('user-agent', 'Revit Dynamo')
response = urlopen(request)

data = json.loads(response.read())


# Step 4: Parse Data and Transform Back to Target EPSG
stations = []
nodes = data['elements']
for node in nodes:

    if 'name' not in node['tags'].keys():
        continue
    
    name = node['tags']['name']
    type = extractType(node['tags'])
    location = extractLocation(node['lat'], node['lon'])
    
    if not type:
        continue

    # Skip Duplicate stations/platforms
    exists = False;
    for station in stations:
        if station['name'] == name and station['type'] == type:
            exists = True
            break
            
    if exists:
        continue
            
    stations.append({
        'name': name,
        'location': location,
        'type': type,
    })
 

# OUTPUT
OUT = stations
# ----------------------------------------
code_block_32 = CodeBlock(PLocationX=GIS2BIM_GetSharedCoordinate.EastWest, PLocationY=GIS2BIM_GetSharedCoordinate.NorthSouth)
# ---------- code_block_32.designscript (15 lines) ----------
PLocationX;
PLocationY;
ScaleFactor = 1000;
StationRadii = {
	"bus": 150,
	"subway": 250,
	"tram": 200,
	"other": 150
};
StationMaterials = {
	"bus": "MLA_green",
	"subway": "MLA_blue",
	"tram": "MLA_yellow",
	"other": "MLA_gray"
};
# ----------------------------------------
py_2 = Python(IN[0]=py, IN[1]=code_block_32.PLocationX, IN[2]=code_block_32.PLocationY, IN[3]=code_block_32.ScaleFactor, IN[4]=code_block_32.StationRadii, IN[5]=code_block_32.StationMaterials)  # "PrepareStationData.py"; CPython3
# ---------- py_2.python (61 lines) ----------
# Load the Python Standard and DesignScript Libraries
import sys
import clr
clr.AddReference('ProtoGeometry')
from Autodesk.DesignScript.Geometry import *

# The inputs to this node will be stored as a list in the IN variables.
stations = IN[0]
centerX = IN[1]
centerY = IN[2]
scaleFactor = IN[3]
stationRadii = IN[4]
stationMaterials = IN[5]

# Place your code below this line

availableStationRadii = stationRadii.keys()
def getStationRadius(type):
    if type in availableStationRadii:
        return stationRadii[type]
    else:
        return stationRadii['other']

availableMaterials = stationMaterials.keys()
def getStationMaterial(type):
    if type in availableMaterials:
        return stationMaterials[type]
    else:
        return stationMaterials['other']
    

points = []
circles = []
boundaries = []
names = []
materials = []

for station in stations:
    x = (float(station['location'][0]) - centerX) * scaleFactor
    y = (float(station['location'][1]) - centerY) * scaleFactor
    point = Point.ByCoordinates(x, y, 0)
    
    type = station['type']
    
    points.append(point)
    
    # Draw SemiCircles for Revit DetailCurve
    normal = Vector.ByCoordinates(0,0,1)
    #circles.append(Arc.ByCenterPointRadiusAngle(point, 1 * scaleFactor, 0, 180, normal))
    #circles.append(Arc.ByCenterPointRadiusAngle(point, 1 * scaleFactor, 180, 360, normal))
    circles.append(Circle.ByCenterPointRadius(point, 1.5 * scaleFactor))
    
    
    # Draw full circle for filled region boundaries
    boundaries.append(Circle.ByCenterPointRadius(point, getStationRadius(type) * scaleFactor))
    
    names.append(station['name'])
    materials.append(getStationMaterial(type))
    
# Assign your output to the OUT variable.
OUT = points, circles, boundaries, names, materials
# ----------------------------------------

# group: change boundery edges
flatten_9 = List.Flatten(list=byCurves)
get_all_line_styles = Custom[Get All Line Styles]()  # package archi-lab.net; This node will return all available line styles.
removeNulls = Lists.Manage.RemoveNulls(Data=get_all_line_styles)
name_2 = Element.Name(element=removeNulls.Cleaned)
code_block_33 = CodeBlock { "OSM_boundery"; }
contains = String.Contains(string=name_2, searchFor=code_block_33)
filterByBoolMask_4 = List.FilterByBoolMask(list=removeNulls.Cleaned, mask=contains)
filledregion_linestyle_change = Custom[FilledRegion LineStyle Change](filledRegion=flatten_9@L1, lineStyle=filterByBoolMask_4.in, lacing=Longest)  # package Genius Loci; Change the linestyle of the boundaries of a Filled Region to another given linestyle.

code_block_34 = CodeBlock { 100; }
flatten_10 = List.Flatten(list=filledregion_linestyle_change, amount=code_block_34)
removeNulls_2 = Lists.Manage.RemoveNulls(Data=flatten_10)
byElements = Group.ByElements(elements=removeNulls_2.Cleaned)
