# Dynamo graph GIS2BIM_OSM_download_V5.dyn (Dynamo 3.3.0.6316)
# packages: GIS2BIM for Dynamo 2.x 0.11.15, Clockwork for Dynamo 2.x 2.6.0

# group: create boundingbox
getRevitSiteLocation = Custom[GIS2BIM.GetRevitSiteLocation]()  # package GIS2BIM for Dynamo 2.x; Gets the properties of the current Site Location of the active Revit Project
code_block = CodeBlock(lon=getRevitSiteLocation.Lat, lat=getRevitSiteLocation.Lon) { dLon = String.ToNumber(lon); dLat = String.ToNumber(lat); bbox =500; bboxtranslate = bbox/2*-1000; }
createBoundingBoxLATLONG = Custom[GIS2BIM.CreateBoundingBoxLATLONG](Latitude=code_block.dLon, Longitude=code_block.dLat, WidthMeters=code_block.bbox)  # package GIS2BIM for Dynamo 2.x; create boundingbox with from lat/long coordinate in degrees

filePaths = Custom[FilePaths]()  # Gets the filepaths from the model.
string_from_object = FromObject(obj=filePaths.06_OSMfiles)

# group: download osm
GIS2BIM_DownloadOSM = Custom[GIS2BIM_DownloadOSM](West=createBoundingBoxLATLONG.West, East=createBoundingBoxLATLONG.East, North=createBoundingBoxLATLONG.North, South=createBoundingBoxLATLONG.South, DirectoryLocation=string_from_object)  # package GIS2BIM for Dynamo 2.x; Download OSM data within a boundingbox

sendTo = Custom[Clipboard.SendTo](str=GIS2BIM_DownloadOSM.DownloadlinkOSM)  # package Clockwork for Dynamo 2.x; Copies a string to the clipboard.
