# Dynamo graph GIS2BIM_Topo_Tijdreis_v7.dyn (Dynamo 2.19.3.6394)
# packages: GIS2BIM for Dynamo 2.x 0.12.1, Genius Loci 2024.5.29

# group: Prerequisites
# note: This script needs the following pip packages:
# - request
# - xmltodict
# They need to be installed once using this script:
# W:\Toolbox NL projects\000 Tekenafspraken\DYNAMO\MLA_scripts\00_MLA_pipinstall.dyn
# Also the sheetname needs to be set to an existing sheet. Currently that's "Timeline".
# add syspath:
# import os
# localapp = os.getenv(r'LOCALAPPDATA')
# sys.path.append(os.path.join(localapp, r'python-3.9.12-embed-amd64\Lib\site-packages'))

how_wmts_works = CodeBlock()
# ---------- how_wmts_works.designscript (3 lines) ----------
"Well-known scale set Nederland";
"https://www.geonovum.nl/uploads/documents/nederlandse_richtlijn_tiling_-_versie_1.1.pdf";
"Zoomlevel,Resolutie(m/pixel), scaleDenominator, numberofTiles)";
# ----------------------------------------
all_available_layers = CodeBlock()
# ---------- all_available_layers.designscript (12 lines) ----------
//https://tiles.arcgis.com/tiles/nSZVuSZjHpEZZbRo/arcgis/rest/services/
years = ["1815", "1820", "1821", "1823_1829", "1830_1849", "1850",
"1857", "1858", "1861", "1862", "1865", "1866", "1868", "1870", "1871",
"1872", "1880", "1883", "1886", "1888", "1889", "1893", "1899", "1900",
"1901", "1902", "1904", "1908", "1909", "1910", "1912", "1915", "1918",
"1919", "1920", "1922", "1925", "1929", "1931", "1935", "1937", "1940",
"1942", "1943", "1947", "1948", "1949", "1950", "1951", "1952", "1953",
"1955", "1962", "1963", "1965", "1970", "1971", "1973", "1975", "1976",
"1978", "1980", "1984", "1988", "1990", "1994", "1995", "1996", "1997",
"1999", "2000", "2001", "2002", "2003", "2004", "2005", "2006", "2007",
"2008", "2009", "2010", "2011", "2012", "2013", "2014", "2015", "2016",
"2017", "2018", "2019"];
# ----------------------------------------
get_capabilities = CodeBlock()  # //https://tiles.arcgis.com/tiles/nSZVuSZjHpEZZbRo/arcgis/rest/services/Historische_tijdreis_1950/MapServer/WMTS/1.0.0/WMTSCapabilities.xml
working_link = CodeBlock()  # //https://tiles.arcgis.com/tiles/nSZVuSZjHpEZZbRo/arcgis/rest/services/Historische_tijdreis_2011/MapServer/WMTS/tile/1.0.0/Historische_tijdreis_2011/default/default028mm/0/37/37
working_link_2 = CodeBlock()  # //https://tiles.arcgis.com/tiles/nSZVuSZjHpEZZbRo/arcgis/rest/services/Historische_tijdreis_2011/MapServer/tile/8/9426/9432?blankTile=false
string = StringInput("Historische_tijdreis_")

# group: Selected Years
code_block = CodeBlock()
# ---------- code_block.designscript (6 lines) ----------
["1900",
"1938",
"1958",
"1975",
"1990",
"2011"];
# ----------------------------------------

py = Python(IN[0]=string, IN[1]=code_block)  # "ConcatLayers.py"; CPython3
# ---------- py.python (17 lines) ----------
# Load the Python Standard and DesignScript Libraries
import sys
import clr
clr.AddReference('ProtoGeometry')
from Autodesk.DesignScript.Geometry import *

# The inputs to this node will be stored as a list in the IN variables.
base = IN[0]
years = IN[1]

# Place your code below this line
layers = []
for year in years:
    layers.append(base + year)

# Assign your output to the OUT variable.
OUT = layers
# ----------------------------------------
code_block_2 = CodeBlock(layers=py, labels=code_block) { layers; labels; }

# group: Extract Data from Capabilities
code_block_3 = CodeBlock(timelineLayers=code_block_2.layers) { timelineLayers; }
py_2 = Python(IN[0]=code_block_3)  # "GetWMTSURLTemplate.py"; CPython3
# ---------- py_2.python (49 lines) ----------
# Load the Python Standard and DesignScript Libraries
import sys
import clr
clr.AddReference('ProtoGeometry')
from Autodesk.DesignScript.Geometry import *
import os
localapp = os.getenv(r'LOCALAPPDATA')
sys.path.append(os.path.join(localapp, r'python-3.9.12-embed-amd64\Lib\site-packages'))
import re
import requests
import xmltodict

# The inputs to this node will be stored as a list in the IN variables.
timelineLayers = IN[0]

# Function wrapper for automatic lacing
def getLevelsForLayer(timelineLayer):
    
    # STEP 1: Download Capabilites XML
    URL_TEMPLATE = "https://tiles.arcgis.com/tiles/nSZVuSZjHpEZZbRo/arcgis/rest/services/{layer}/MapServer/WMTS/1.0.0/WMTSCapabilities.xml"
    
    url = URL_TEMPLATE.format(layer = timelineLayer)
    xml = requests.get(url).content
    
    data = xmltodict.parse(xml)
    
    # STEP 2: Parse Capabilities
    templateURL = data['Capabilities']['Contents']['Layer']['ResourceURL']['@template']
    defaultStyle = data['Capabilities']['Contents']['Layer']['Style']['ows:Identifier']
    tileMatrixSet = data['Capabilities']['Contents']['Layer']['TileMatrixSetLink']['TileMatrixSet']    
      
    # print('URL', templateURL, defaultStyle, tileMatrixSet)
    
    templateURL = re.sub('{Style}', defaultStyle, templateURL)
    templateURL = re.sub('{TileMatrixSet}', tileMatrixSet, templateURL)
    
    # print('URL', templateURL, defaultStyle, tileMatrixSet)
    
    return templateURL
    
if type(timelineLayers) == list:
    layerTemplates = []
    for layer in timelineLayers:
        layerTemplates.append(getLevelsForLayer(layer))
else:
    layerTemplates = getLevelsForLayer(timelineLayers)

# STEP 3: Return Zoom Levels
OUT = layerTemplates
# ----------------------------------------
py_3 = Python(IN[0]=code_block_3)  # "GetWMTSZoomLevels.py"; CPython3
# ---------- py_3.python (75 lines) ----------
# Load the Python Standard and DesignScript Libraries
import sys
import clr
clr.AddReference('ProtoGeometry')
from Autodesk.DesignScript.Geometry import *

import os
localapp = os.getenv(r'LOCALAPPDATA')
sys.path.append(os.path.join(localapp, r'python-3.9.12-embed-amd64\Lib\site-packages'))

import requests
import xmltodict

# The inputs to this node will be stored as a list in the IN variables.
timelineLayers = IN[0]

# Function wrapper for automatic lacing
def getLevelsForLayer(timelineLayer):
    # STEP 1: Download Capabilites XML
    
    URL_TEMPLATE = "https://tiles.arcgis.com/tiles/nSZVuSZjHpEZZbRo/arcgis/rest/services/{layer}/MapServer/WMTS/1.0.0/WMTSCapabilities.xml"
    
    url = URL_TEMPLATE.format(layer = timelineLayer)
    xml = requests.get(url).content
    
    data = xmltodict.parse(xml)
    
    
    # STEP 2: Parse Capabilities
    tileMatrices = data['Capabilities']['Contents']['TileMatrixSet']['TileMatrix']
    
    pixelSize = 0.00028 # meter per pixel
    
    zoomLevels = []
    for tileMatrix in tileMatrices:
        
        identifier = tileMatrix['ows:Identifier']
        scaleDenominator = float(tileMatrix['ScaleDenominator'])
        rowOrigin = float(tileMatrix['TopLeftCorner'].split(' ')[1])
        columnOrigin = float(tileMatrix['TopLeftCorner'].split(' ')[0])
        tileWidth = int(tileMatrix['TileWidth'])
        tileHeight = int(tileMatrix['TileHeight'])
        matrixWidth = int(tileMatrix['MatrixWidth'])
        matrixHeight = int(tileMatrix['MatrixHeight'])
        
        # calculate additional attributes
        tileResolution = pixelSize * scaleDenominator
        tileContentSize = tileWidth * tileResolution
        
        zoomLevel = {
            'identifier': identifier,
            'scaleDenominator': scaleDenominator,
            'rowOrigin': rowOrigin,
            'columnOrigin': columnOrigin,
            'tileWidth': tileWidth,
            'tileHeight': tileHeight,
            'matrixWidth': matrixWidth,
            'matrixHeight': matrixHeight,
            'resolution': tileResolution,
            'tileContentSize': tileContentSize,
        }
        
        zoomLevels.append(zoomLevel)
        
    return zoomLevels
    
if type(timelineLayers) == list:
    layerLevels = []
    for layer in timelineLayers:
        layerLevels.append(getLevelsForLayer(layer))
else:
    layerLevels = getLevelsForLayer(timelineLayers)

# STEP 3: Return Zoom Levels
OUT = layerLevels
# ----------------------------------------

# group: BBOX
GIS2BIM_GetSharedCoordinate = Custom[GIS2BIM_GetSharedCoordinate]()  # package GIS2BIM for Dynamo 2.x; Get the current shared coordinate
code_block_4 = CodeBlock(RDx=GIS2BIM_GetSharedCoordinate.EastWest, RDy=GIS2BIM_GetSharedCoordinate.NorthSouth)
# ---------- code_block_4.designscript (5 lines) ----------
RDx;
RDy;
bbox = 1000;
imageSize = 100;
 //in mm;
# ----------------------------------------

py_4 = Python(IN[0]=code_block_4.bbox)  # "SheetResolution.py"; CPython3
# ---------- py_4.python (19 lines) ----------
# Load the Python Standard and DesignScript Libraries
import sys
import clr
clr.AddReference('ProtoGeometry')
from Autodesk.DesignScript.Geometry import *

# The inputs to this node will be stored as a list in the IN variables.
bboxDiameter = IN[0]

IMAGE_WIDTH_ON_SHEET = 100
MM_IN_INCH = 25.4
TARGET_PRINT_RESOLUTION = 300 # dpi

pixelsPerImage = TARGET_PRINT_RESOLUTION * IMAGE_WIDTH_ON_SHEET / MM_IN_INCH

metersPerPixel = bboxDiameter / pixelsPerImage

# Assign your output to the OUT variable.
OUT = metersPerPixel
# ----------------------------------------
code_block_5 = CodeBlock(resolution=py_4)
# ---------- code_block_5.designscript (5 lines) ----------
// target resolution
// in meter per pixel
0.1;
// based on bbox as 10cm on sheet
resolution;
# ----------------------------------------

# group: Select ZoomLevel
code_block_6 = CodeBlock(zoomLevels=py_3, targetResolution=code_block_5.resolution) { zoomLevels; targetResolution; }
py_5 = Python(IN[0]=code_block_6.zoomLevels, IN[1]=code_block_6.targetResolution)  # "selectZoomLevel.py"; CPython3
# ---------- py_5.python (29 lines) ----------
# Load the Python Standard and DesignScript Libraries
import sys
import clr
clr.AddReference('ProtoGeometry')
from Autodesk.DesignScript.Geometry import *

# The inputs to this node will be stored as a list in the IN variables.
zoomLevelsPerLayer = IN[0]
targetResolution = IN[1] # m/pixel ~ 1.6 = 3000px for 500m

def pickZoomLevel(zoomLevels):
    selectedZoomLevel = zoomLevels[-1]
    for zoomLevel in zoomLevels:
        resolution = zoomLevel['resolution']
        if resolution < targetResolution:
            selectedZoomLevel = zoomLevel
            break;

    return selectedZoomLevel

if type(zoomLevelsPerLayer[0]) == list:
    selectedLevels = []
    for layer in zoomLevelsPerLayer:
        selectedLevels.append(pickZoomLevel(layer))
else:
    selectedLevels = pickZoomLevel(zoomLevels)

# Assign your output to the OUT variable.
OUT = selectedLevels
# ----------------------------------------

# group: Prepare Tile URLs
code_block_7 = CodeBlock(urlTemplates=py_2, zoomLevels=py_5, RDx=code_block_4.RDx, RDy=code_block_4.RDy, bboxDiameter=code_block_4.bbox) { urlTemplates; zoomLevels; RDx; RDy; bboxDiameter; }
py_6 = Python(IN[0]=code_block_7.urlTemplates, IN[1]=code_block_7.zoomLevels, IN[2]=code_block_7.RDx, IN[3]=code_block_7.RDy, IN[4]=code_block_7.bboxDiameter)  # "CreateTileURLs.py"; CPython3
# ---------- py_6.python (76 lines) ----------
# Load the Python Standard and DesignScript Libraries
import sys
import clr
clr.AddReference('ProtoGeometry')
from Autodesk.DesignScript.Geometry import *

import math

# The inputs to this node will be stored as a list in the IN variables.
urlTemplates = IN[0]
zoomLevels = IN[1]
X = int(IN[2])
Y = int(IN[3])
bboxRadius = float(IN[4]) / 2


def getURLsForLayerAndLevel(urlTemplate, zoomLevel):

    # WMTS URL Template - Pass as option?
    #URL_TEMPLATE = "https://tiles.arcgis.com/tiles/nSZVuSZjHpEZZbRo/arcgis/rest/services/{timelineLayer}/MapServer/tile/{matrix}/{row}/{column}?blankTile=false"
    
    # Calculate BBox Extends
    bboxTop = Y + bboxRadius
    bboxBottom = Y - bboxRadius
    bboxLeft = X - bboxRadius
    bboxRight = X + bboxRadius
    
    # Calculate Tile Coordinates
    rowBase = zoomLevel['rowOrigin']
    colBase = zoomLevel['columnOrigin']
    tileContentSize = zoomLevel['tileContentSize']
    tileMatrix = zoomLevel['identifier']
    tilePixelSize = zoomLevel['tileWidth']
    
    tileRowMinParam = (rowBase - bboxTop) / tileContentSize
    tileColumnMinParam = (bboxLeft - colBase) / tileContentSize
    tileRowMaxParam = (rowBase - bboxBottom) / tileContentSize
    tileColumnMaxParam = (bboxRight - colBase) / tileContentSize
    
    tileRowMin = math.floor(tileRowMinParam)
    tileColumnMin = math.floor(tileColumnMinParam)
    tileRowMax = math.floor(tileRowMaxParam)
    tileColumnMax = math.floor(tileColumnMaxParam)
    
    rowTileNumbers = range(tileRowMin, tileRowMax + 1)
    colTileNumbers = range(tileColumnMin, tileColumnMax + 1)
    
    # Prepare URLs
    urls = []
    for row in rowTileNumbers:
        for column in colTileNumbers:
            urls.append(urlTemplate.format(TileMatrix = tileMatrix, TileRow = row, TileCol = column))
    
    # Get Cropping Information in pixels
    topDiff = (tileRowMinParam - tileRowMin) * tilePixelSize
    leftDiff = (tileColumnMinParam - tileColumnMin) * tilePixelSize
    bottomDiff = (1 - (tileRowMaxParam - tileRowMax)) * tilePixelSize
    rightDiff = (1 - (tileColumnMaxParam - tileColumnMax)) * tilePixelSize
    
    cropDiffs = [topDiff, leftDiff, bottomDiff, rightDiff]

    return [len(rowTileNumbers), len(colTileNumbers), tilePixelSize, cropDiffs, urls]


if type(urlTemplates) == list:
    urlLists = []
    for index, template in enumerate(urlTemplates):
        urlLists.append(getURLsForLayerAndLevel(template, zoomLevels[index]))
else:
    urlLists = getURLsForLayerAndLevel(urlTemplates, zoomLevels)


# Return URL(s)
OUT = urlLists

# print('TILE COORDINATES', tileRowMin, tileRowMax, tileColumnMin, tileColumnMax, tileMatrix)
# ----------------------------------------

# group: Download and Process Images
py_7 = Python(IN[0]=py_6)  # "DownloadAndCombineWMTSTiles.py"; CPython3
# ---------- py_7.python (67 lines) ----------
import sys
sys.path.append("C:\Program Files (x86)\IronPython 2.7\Lib")

import clr
clr.AddReference("System.Drawing")
clr.AddReference("System")
from System.Drawing import Image
from System.Drawing import Image
from System.Drawing import Bitmap
from System.Drawing import Graphics
from System.Net import WebRequest

# The inputs to this node will be stored as a list in the IN variables.
urlResults = IN[0]

def downloadWMTSTiles(urls):
    bitmaps = []
    for i in urls:
    	request = WebRequest.Create(i)
    	request.Accept = "text/html"
    	request.UserAgent = "Mozilla/5.0"
    	response = request.GetResponse()
    	bitmaps.append(Image.FromStream(response.GetResponseStream()))
    
    return bitmaps

def combineTiles(tiles, rowCount, colCount, pixels, cropDiffs):
    topDiff, leftDiff, bottomDiff, rightDiff = cropDiffs

    totalHeight = rowCount * pixels - topDiff - bottomDiff
    totalWidth = colCount * pixels - leftDiff - rightDiff
    
    # create image object for the new image
    combinedImage = Bitmap(totalWidth, totalHeight)
    combinedImageGraphics = Graphics.FromImage(combinedImage)
    
    rowPositions = []
    colPositions = []
    
    for i in range(rowCount):
        for j in range(colCount):
            rowPositions.append(i * pixels - topDiff) # Move "out" of image to crop
            colPositions.append(j * pixels - leftDiff)
    
    # print('DEBUG', len(bitmaps), rowCount, colCount, rowPositions, colPositions, totalHeight, totalWidth)
    
    for image, x, y in zip(tiles, colPositions, rowPositions):
    	combinedImageGraphics.DrawImage(image, x, y, pixels, pixels)
    
    return combinedImage


if type(urlResults[0]) == list:
    images = []
    for urlResult in urlResults:
        rowCount = urlResult[0]
        columnCount = urlResult[1]
        pixels = urlResult[2]
        cropDiffs = urlResult[3]
        urls = urlResult[4]
        tiles = downloadWMTSTiles(urls)
        images.append(combineTiles(tiles, rowCount, columnCount, pixels, cropDiffs))
else:
    images = downloadAndCombine(urlResults) 

# Assign your output to the OUT variable.
OUT = images
# ----------------------------------------

# group: Preview Image
number_slider = DoubleSlider(5, range=0..5 step 1)
getItemAtIndex = List.GetItemAtIndex(list=py_7, index=number_slider)
watch_image = WatchImageCore(image=getItemAtIndex)

# group: Find or Create Directory
py_8 = Python()  # "GetCentralOrLocalDirectory.py"; CPython3
# ---------- py_8.python (20 lines) ----------
import clr
import os 

clr.AddReference('RevitServices')
from RevitServices.Persistence import DocumentManager

clr.AddReference('RevitAPI')
from Autodesk.Revit.DB import *

doc = DocumentManager.Instance.CurrentDBDocument

fileName = '' 
if doc.IsWorkshared:
	cp = doc.GetWorksharingCentralModelPath()
	fileName = ModelPathUtils.ConvertModelPathToUserVisiblePath(cp)
else:
    fileName = doc.PathName

directoryPath = os.path.split(fileName)[0]
OUT = directoryPath
# ----------------------------------------
# note: \\ becomes \ due to escaping
code_block_8 = CodeBlock(path=py_8) { path + "\\GISDATA\\images\\timeline\\"; }
findOrCreateDirectory = Python(IN[0]=code_block_8)  # CPython3
# ---------- findOrCreateDirectory.python (13 lines) ----------
# Load the Python Standard and DesignScript Libraries
import sys
import os

# The inputs to this node will be stored as a list in the IN variables.
path = IN[0]

# Place your code below this line
if not os.path.exists(path):
    os.makedirs(path)

# Assign your output to the OUT variable.
OUT = path
# ----------------------------------------
images_path = DirectoryObject(path=findOrCreateDirectory)

# group: Place Images on Sheet
code_block_9 = CodeBlock()
# ---------- code_block_9.designscript (11 lines) ----------
// Image Size [mm]
100;
100;
// Image Gap Distance h/v [mm]
20;
14;
// Shift [mm]
0;
10;
// Frame [mm]
30;
# ----------------------------------------
code_block_10 = CodeBlock(imageWidth=code_block_9.out0) { imageWidth / 1000; }
sheets = Sheets("Topotijdreis")
sheet_totitleblock = Custom[Sheet ToTitleBlock](sheet=sheets)  # package Genius Loci; Retrieves the titleblock from the given sheet in the active or given document.
annotation_boundingbox = Custom[Annotation BoundingBox](element=sheet_totitleblock)  # package Genius Loci; Get the BoundingBox of the view specific element. (Text, tag, etc)
minPoint = BoundingBox.MinPoint(boundingBox=annotation_boundingbox.BoundingBox)
maxPoint = BoundingBox.MaxPoint(boundingBox=annotation_boundingbox.BoundingBox)
string_2 = StringInput("\")
code_block_11 = CodeBlock(path=images_path, slash=string_2, name=code_block_2.layers) { path+slash+name+".png"; }
GIS2BIM_ImageToFile = Custom[GIS2BIM_ImageToFile](ImageObject=py_7, FileNamePath=code_block_11, lacing=Longest)  # package GIS2BIM for Dynamo 2.x; Write Image to file
count = List.Count(list=GIS2BIM_ImageToFile)
py_9 = Python(IN[0]=minPoint, IN[1]=maxPoint, IN[2]=code_block_9.out0, IN[3]=code_block_9.out1, IN[4]=count, IN[5]=code_block_9.out2, IN[6]=code_block_9.out3, IN[7]=code_block_9.out4, IN[8]=code_block_9.out5, IN[9]=code_block_9.out6)  # "CalculateSheetPositions.py"; CPython3
# ---------- py_9.python (56 lines) ----------
# Load the Python Standard and DesignScript Libraries
import sys
import clr
clr.AddReference('ProtoGeometry')
from Autodesk.DesignScript.Geometry import *

import math

# The inputs to this node will be stored as a list in the IN variables.
bboxMin = IN[0]
bboxMax = IN[1]
imageWidth = IN[2]
imageHeight = IN[3]
imageCount = IN[4]
gapDistanceh = IN[5]
gapDistancev = IN[6]
shiftX = IN[7]
shiftY = IN[8]
minFrame = IN[9]

frameWidth = abs(bboxMax.X - bboxMin.X)
frameHeight = abs(bboxMax.Y - bboxMin.Y)

maxItemsPerRow = math.floor((frameWidth - 2 * minFrame + gapDistanceh) / (imageWidth + gapDistanceh))
maxItemsPerCol = math.floor((frameHeight - 2 * minFrame + gapDistancev) / (imageHeight + gapDistancev))

rowCount = min(maxItemsPerCol, math.ceil(imageCount / maxItemsPerRow))
colCount = min(maxItemsPerRow, math.ceil(imageCount / maxItemsPerCol))

contentWidth = colCount * imageWidth + (colCount - 1) * gapDistanceh
contentHeight = rowCount * imageHeight + (rowCount - 1) * gapDistancev

actualFrameWidth = (frameWidth - contentWidth) / 2
actualFrameHeight = (frameHeight - contentHeight) / 2

positionsX = []
positionsY = []
currentRow = 0
currentCol = 0
for i in range(imageCount):
    x = actualFrameWidth + currentCol * (imageWidth + gapDistanceh) + imageWidth / 2
    y = actualFrameHeight + currentRow * (imageHeight + gapDistanceh) + imageHeight / 2
    
    positionsX.append(x + bboxMin.X + shiftX)
    positionsY.append(bboxMax.Y - y + shiftY)
    
    currentCol += 1
    
    if currentCol >= maxItemsPerRow:
        currentCol = 0
        currentRow += 1
        
    if currentRow >= maxItemsPerCol:
        break
 
OUT = [positionsX, positionsY]
# ----------------------------------------
code_block_12 = CodeBlock(result=py_9) { result; deltaXs = result[0]; deltaYs = result[1]; }

# group: Scale on Sheet
div = code_block_4.bbox / code_block_10
floor = Math.Floor(number=div)
code_block_13 = CodeBlock(scale=floor) { "1:" + scale; }
watch = Watch(code_block_13)

# group: Add Titles
py_10 = Python(IN[0]=py_9, IN[1]=code_block_9.out1)  # "CalculateTitlePositions.py"; CPython3
# ---------- py_10.python (28 lines) ----------
# Load the Python Standard and DesignScript Libraries
import sys
import clr
clr.AddReference('ProtoGeometry')
from Autodesk.DesignScript.Geometry import *

# The inputs to this node will be stored as a list in the IN variables.
imagePositions = IN[0]
imageHeight = IN[1]

# Place your code below this line
positionsX = imagePositions[0]
positionsY = imagePositions[1]

MARGIN = 3

points = []
for index, imgX in enumerate(positionsX):
    imgY = positionsY[index]
    
    x = imgX - imageHeight / 2
    y = imgY - imageHeight / 2 - MARGIN
    
    points.append(Point.ByCoordinates(x, y, 0))


# Assign your output to the OUT variable.
OUT = points
# ----------------------------------------
select_horizontal_text_alignment = HorizontalAlignment("Left")
byLocation = TextNote.ByLocation(view=sheets, location=py_10, text=code_block_2.labels, alignment=select_horizontal_text_alignment)

# group: Aerial Photo Years & Layers
code_block_14 = CodeBlock()
# ---------- code_block_14.designscript (17 lines) ----------
["Luchtfoto_2006",
"Luchtfoto_2007",
"Luchtfoto_2008",
"Luchtfoto_2009",
"Luchtfoto_2010",
"Luchtfoto_2011",
"LuchtfotoNL50cm_2012",
"LuchtfotoNL50cm_2013",
"LuchtfotoNL_50_cm_2014",
"LuchtfotoNL_2015_50_cm",
"Luchtfoto_2016",
"Luchtfoto_2017",
"Luchtfoto_2018",
"Luchtfoto_2019",
"Luchtfoto_2020",
"HR_Luchtfoto_2021",
"HR_Luchtfoto_Actueel"];
# ----------------------------------------
code_block_15 = CodeBlock()
# ---------- code_block_15.designscript (17 lines) ----------
["2006",
"2007",
"2008",
"2009",
"2010",
"2011",
"2012",
"2013",
"2014",
"2015",
"2016",
"2017",
"2018",
"2019",
"2020",
"2021",
"2022"];
# ----------------------------------------

GIS2BIM_ImportImageInView = Custom[GIS2BIM_ImportImageInView](ImageWidthMeters=code_block_10, view=sheets, ImagePath=GIS2BIM_ImageToFile, DeltaX=code_block_12.deltaXs, DeltaY=code_block_12.deltaYs, lacing=Longest)  # package GIS2BIM for Dynamo 2.x; Import rasterimage in view
watch_2 = Watch(py_2)
