# Dynamo graph GIS2BIM_analyze.dyn (Dynamo 2.19.3.6394)
# packages: Genius Loci 2024.5.29, GIS2BIM for Dynamo 2.x 0.12.1

select_face = DSFaceSelection()  # 1 picked in the model

# group: prepare surface
code_block = CodeBlock(l=select_face) { l[0]; 0; }
code_block_2 = CodeBlock(geometry=code_block.out0) { geometry; }
ZAxis = Vector.ZAxis()
translate = Geometry.Translate(geometry=code_block.out0, direction=ZAxis, distance=code_block.out1)
watch = Watch(translate)
code_block_3 = CodeBlock { gridsize=512; xy=Math.Sqrt(gridsize); 0..1..#xy; }
pointAtParameter = Surface.PointAtParameter(surface=watch, u=code_block_3.out2, v=code_block_3.out2, lacing=CrossProduct)
flatten = List.Flatten(list=pointAtParameter)
UVParameterAtPoint = Surface.UVParameterAtPoint(surface=watch, point=flatten)

filePaths = Custom[FilePaths]()  # Gets the filepaths from the model.
string = StringInput("\")
code_block_4 = CodeBlock(pathofimages=filePaths.04_imagedir, slash=string) { pathofimages+slash+"gis2bim_woz.png"; pathofimages+slash+"gis2bim_geluidscontouren_alle_bronnen.png"; }

# group: Sound analyses (img)
fromPath = FileObject(path=code_block_4.out1)  # "File.FromPath"
readFromFile = Image.ReadFromFile(file=fromPath)
pixels = Image.Pixels(image=readFromFile, xSamples=code_block_3.xy, ySamples=code_block_3.xy)
flatten_2 = List.Flatten(list=pixels)
red = Color.Red(color=flatten_2)
green = Color.Green(color=flatten_2)
blue = Color.Blue(color=flatten_2)
code_block_5 = CodeBlock()
# ---------- code_block_5.designscript (10 lines) ----------
legend=[[[255,255,255],"geen geluid van wegen"],
[[255,255,178],"45-50dB (goed)"],
[[255,255,0],"50-55dB (redelijk)"],
[[255,210,0],"55-60dB (matig)"],
[[255,165,0],"60-65dB slecht)"],
[[255,0,0],"65-70dB (zeer slecht)"],
[[192,0,0],"70-75dB (bebouwing niet mogelijk)"],
[[128,0,0],"> 75dB (bebouwing niet mogelijk)"]];
maxvalueaddition = 1;
0..maxvalueaddition..1/DSCore.List.Count(legend);
# ----------------------------------------
python_script = Python(IN[0]=red, IN[1]=green, IN[2]=blue, IN[3]=code_block_5.legend, IN[4]=code_block_5.maxvalueaddition)  # CPython3
# ---------- python_script.python (68 lines) ----------
# Enable Python support and load DesignScript library
import clr
clr.AddReference('ProtoGeometry')
from Autodesk.DesignScript.Geometry import *
import numpy as np

# inputs
dataEnteringNode = IN
aLegend = IN[3]
aLegendOmschrijvingen = []
iMaxValueAdition = float(IN[4])
#aImagePixelColors = []

#functions

def flatten_extend(matrix):
    flat_list = []
    for row in matrix:
        flat_list.extend(row)
    return flat_list

def CombineRGB():
    aImagePixelColors = [] 
    aImagePixelColorsr = IN[0]
    aImagePixelColorsg = IN[1]
    aImagePixelColorsb = IN[2]
    for index, r in enumerate(aImagePixelColorsr):
        g=aImagePixelColorsg[index]
        b=aImagePixelColorsb[index]
        aImagePixelColors.append([r,g,b])
    #print(aImagePixelColors)
    return aImagePixelColors
    
def closest(colors,color, aValues):
    colors = np.array(colors)
    aValues = np.array(aValues)
    color = np.array(color)
    distances = np.sqrt(np.sum((colors-color)**2,axis=1))
    index_of_smallest = np.where(distances==np.amin(distances))
    smallest_distance = colors[index_of_smallest]
    iValues = float(aValues[index_of_smallest][0])
    return iValues 
               
def CheckImageColors():
    aLegendColors = []
    aValues = np.arange(0, iMaxValueAdition, iMaxValueAdition/len(aLegend)).tolist()
    aValues.reverse()
    #maak eerst twee lists van de legend
    for item in aLegend:
        iLegendColor= item[0]
        aLegendColors.append(iLegendColor)
        sLegendomschrijving = item[1]
        aLegendOmschrijvingen.append(sLegendomschrijving)
    #print(aLegendColors)
    #maak een lijst met de rgb waarde per punt in de afbeelding
    aImagePixelColors = CombineRGB()
    aValuePerPoint = []
    for iColor in aImagePixelColors:
        #print(iColor)
        iValue=closest(aLegendColors,iColor,aValues)
        aValuePerPoint.append(iValue)

    return aValuePerPoint
        
Output = CheckImageColors()
    	
#outputs
OUT = Output
# ----------------------------------------

GIS2BIM_GetSharedCoordinate = Custom[GIS2BIM_GetSharedCoordinate]()  # package GIS2BIM for Dynamo 2.x; Get the current shared coordinate
code_block_6 = CodeBlock { 1000; }
createBoundingBox = Custom[GIS2BIM.CreateBoundingBox](CoordinateX=GIS2BIM_GetSharedCoordinate.EastWest, CoordinateY=GIS2BIM_GetSharedCoordinate.NorthSouth, BoxWidth=code_block_6, BoxHeight=code_block_6)  # package GIS2BIM for Dynamo 2.x; create boundingboxstring for webrequests based on coördinates and dimensions
code_block_7 = CodeBlock { 28992; }
GIS2BIM_GetSharedCoordinate_2 = Custom[GIS2BIM_GetSharedCoordinate]()

# group: Import Public Transport Stations (OSM Overpass)
code_block_8 = CodeBlock(bbox=createBoundingBox.Boxstring, targetEPSG=code_block_7) { bbox; targetEPSG; }
py = Python(IN[0]=code_block_8.bbox, IN[1]=code_block_8.targetEPSG)  # "GetOPNVpublictransportOverpass.py"; CPython3
# ---------- py.python (105 lines) ----------
# Load the Python Standard and DesignScript Libraries
import sys
import clr
clr.AddReference('ProtoGeometry')
from Autodesk.DesignScript.Geometry import *

from urllib.request import Request, urlopen
import json
import re


# INPUT PARAMETERS
bbox = IN[0]
targetEPSG = IN[1]


# GOBALS
WSG84_EPSG = 4326 


# FUNCTIONS
def transformEPSG(source, target, x, y):
    convUrl = "http://epsg.io/trans?&s_srs={source}&t_srs={target}&x={x}&y={y}&format=json&trans=1".format(source=source, target=target, x=x, y=y)
    try:
        request = Request(convUrl)
        # Add some credibility to our request
        request.add_header('user-agent', 'Revit Dynamo')
        convResponse = urlopen(request)
        convData = json.loads(convResponse.read())
        return [convData['x'], convData['y']]
    except Exception as error:
        print('ERROR transforming coordinates:', error)
        return [x, y]
        
def extractType(tags):
    keys = tags.keys()
    if 'subway' in keys and tags['subway'] == 'yes':
        return 'subway'
    if 'tram' in keys and tags['tram'] == 'yes':
        return 'tram'
    if 'bus' in keys and tags['bus'] == 'yes':
        return 'bus'        

def extractLocation(lat, lon):
   return transformEPSG(WSG84_EPSG, targetEPSG, lon, lat)


# SCRIPT
# Step 1: Translate BBox to WSG84 Sperical
bboxElements = bbox.split(',')
bboxWSG84Start = transformEPSG(targetEPSG, WSG84_EPSG, bboxElements[0], bboxElements[1])
bboxWSG84End = transformEPSG(targetEPSG, WSG84_EPSG, bboxElements[2], bboxElements[3])
bboxWSG84 = "{xMin},{yMin},{xMax},{yMax}".format(xMin=bboxWSG84Start[1],yMin=bboxWSG84Start[0],xMax=bboxWSG84End[1],yMax=bboxWSG84End[0])


# Step 2: Construct Query
query = '[out:json];(node["public_transport"="stop_position"]({bbox});node["public_transport"="platform"]({bbox}););out;'.format(bbox=bboxWSG84)


# Step 3: Construct URL and make request
url = 'https://z.overpass-api.de/api/interpreter?data={query}'.format(query=query)

print('OVERPASS URL', url)

request = Request(url)
request.add_header('user-agent', 'Revit Dynamo')
response = urlopen(request)

data = json.loads(response.read())


# Step 4: Parse Data and Transform Back to Target EPSG
stations = []
nodes = data['elements']
for node in nodes:

    if 'name' not in node['tags'].keys():
        continue
    
    name = node['tags']['name']
    type = extractType(node['tags'])
    location = extractLocation(node['lat'], node['lon'])
    
    if not type:
        continue

    # Skip Duplicate stations/platforms
    exists = False;
    for station in stations:
        if station['name'] == name and station['type'] == type:
            exists = True
            break
            
    if exists:
        continue
            
    stations.append({
        'name': name,
        'location': location,
        'type': type,
    })
 

# OUTPUT
OUT = stations, url
# ----------------------------------------
code_block_9 = CodeBlock(L=py) { URL=L[1]; OUTPUT=L[0]; }
code_block_10 = CodeBlock(RDX=GIS2BIM_GetSharedCoordinate_2.EastWest, RDY=GIS2BIM_GetSharedCoordinate_2.NorthSouth)
# ---------- code_block_10.designscript (15 lines) ----------
RDX;
RDY;
ScaleFactor = 1000;
StationRadii = {
	"bus": 250,
	"subway": 1000,
	"tram": 1000,
	"other": 250
};
StationMaterials = {
	"bus": "gis2bim_env_green",
	"subway": "gis2bim_env_blue",
	"tram": "gis2bim_env_yellow",
	"other": "gis2bim_env_gray"
};
# ----------------------------------------
py_2 = Python(IN[0]=code_block_9.OUTPUT, IN[1]=code_block_10.RDX, IN[2]=code_block_10.RDY, IN[3]=code_block_10.ScaleFactor, IN[4]=code_block_10.StationRadii, IN[5]=code_block_10.StationMaterials)  # "PrepareStationData.py"; CPython3
# ---------- py_2.python (60 lines) ----------
# Load the Python Standard and DesignScript Libraries
import sys
import clr
clr.AddReference('ProtoGeometry')
from Autodesk.DesignScript.Geometry import *

# The inputs to this node will be stored as a list in the IN variables.
stations = IN[0]
centerX = IN[1]
centerY = IN[2]
scaleFactor = IN[3]
stationRadii = IN[4]
stationMaterials = IN[5]

# Place your code below this line

availableStationRadii = stationRadii.keys()
def getStationRadius(type):
    if type in availableStationRadii:
        return stationRadii[type]
    else:
        return stationRadii['other']

availableMaterials = stationMaterials.keys()
def getStationMaterial(type):
    if type in availableMaterials:
        return stationMaterials[type]
    else:
        return stationMaterials['other']
    

points = []
#circles = []
boundaries = []
names = []
materials = []
types = []

for station in stations:
    x = (float(station['location'][0]) - centerX) * scaleFactor
    y = (float(station['location'][1]) - centerY) * scaleFactor
    type = station['type']
    radius = getStationRadius(type)
    point = Point.ByCoordinates(x, y, radius)
    type = station['type']

    # make geometry for analyses
    # Draw SemiCircles for Revit DetailCurve
    # normal = Vector.ByCoordinates(0,0,1)
    # circles.append(Circle.ByCenterPointRadius(point, 1.5 * scaleFactor))
    # Draw full circle for filled region boundaries
    boundaries.append(Circle.ByCenterPointRadius(point, getStationRadius(type) * scaleFactor))
        
    points.append(point)
    names.append(station['name'])
    materials.append(getStationMaterial(type))   
    types.append(type)
        
# Assign your output to the OUT variable.
OUT = points, names, materials, types, boundaries
# ----------------------------------------

# group: place families and update parameters
code_block_11 = CodeBlock(L=py_2) { points=L[0]; ["subfeature", "omschrijving"]; [L[3],L[2]]; }
code_block_12 = CodeBlock { "00_3BM_places"; }
byName = FamilyType.ByName(name=code_block_12)
byPoint = FamilyInstance.ByPoint(familyType=byName, point=code_block_11.points)
setParameterByName = Element.SetParameterByName(element=byPoint, parameterName=code_block_11.out1, value=code_block_11.out2)

python_script_2 = Python(IN[0]=GIS2BIM_GetSharedCoordinate.EastWest, IN[1]=GIS2BIM_GetSharedCoordinate.NorthSouth, IN[2]=flatten, IN[3]=code_block_11.points)  # CPython3
# ---------- python_script_2.python (43 lines) ----------
# Load the Python Standard and DesignScript Libraries
import sys
import clr
clr.AddReference('ProtoGeometry')
from Autodesk.DesignScript.Geometry import *
import math
# The inputs to this node will be stored as a list in the IN variables.
dataEnteringNode = IN

RDX=IN[0]
RDY=IN[1]
RevitPoints = IN[2]
PoiPoints = IN[3]
extravalue = 0.5
# Place your code below this line
    
def is_inside_a_circle(point, circles):
    for circle in circles:
        if (point[0]-circle[0])**2 + (point[1]-circle[1])**2 < circle[2]**2:
            return extravalue
    return 0

def TransformPointToRD(point):
    x=point.X
    y=point.Y
    pointRDX=x+RDX*1000
    pointRDY=y+RDY*1000
    PointCoordinateRD=[pointRDX,pointRDY]
    return PointCoordinateRD

circles = []
for PoiPoint in PoiPoints:
    #letop dirty functie de z value wordt misbruikt voor de radius
    circle=[PoiPoint.X,PoiPoint.Y,PoiPoint.Z*1000]
    circles.append(circle)

values = []  
for point in RevitPoints:
    point=[point.X,point.Y]
    values.append(is_inside_a_circle(point, circles))

# Assign your output to the OUT variable.
OUT = values
# ----------------------------------------

# group: create analyses
code_block_13 = CodeBlock(surface=code_block_2, samplelocations=UVParameterAtPoint, a=python_script, b=python_script_2) { "3D_analyse"; surface; samplelocations; values=a+b; "woningbouw"; "analyse"; null; }
view_byname = Custom[View ByName](ViewName=code_block_13.out0)  # package Genius Loci; Collect views by given name in the active or given document. Based on a Christian Gartland's script.
byViewFacePointsAndValues = Revit.AnalysisDisplay.FaceAnalysisDisplay.ByViewFacePointsAndValues(view=view_byname, surface=code_block_13.surface, sampleLocations=code_block_13.samplelocations, samples=code_block_13.values, name=code_block_13.out4, description=code_block_13.out5, unitType=code_block_13.out6)

# group: unique colors (run if new legend /script needs to be created)
file_path = Filename("C:\Users\JochemKolthof\Desktop\Book1.xlsx")
code_block_14 = CodeBlock { "Sheet1"; 0; true; true; }
flatten_3 = List.Flatten(list=flatten_2)  # frozen
uniqueItems = List.UniqueItems(list=flatten_3)
exportToExcel = Data.ExportToExcel(filePath=file_path, sheetName=code_block_14.out0, startRow=code_block_14.out1, startColumn=code_block_14.out1, data=uniqueItems, overWrite=code_block_14.out2, writeAsString=code_block_14.out3)  # frozen

watch_image = WatchImageCore(image=readFromFile)
