# Dynamo graph GIS2BIM_analyze_2.dyn (Dynamo 2.19.3.6394)

select_face = DSFaceSelection()  # 1 picked in the model

# group: prepare surface
code_block = CodeBlock(l=select_face) { l[0]; 0; }
ZAxis = Vector.ZAxis()
translate = Geometry.Translate(geometry=code_block.out0, direction=ZAxis, distance=code_block.out1)
watch = Watch(translate)
code_block_2 = CodeBlock { gridsize=32; xy=Math.Sqrt(gridsize); 0..1..#xy; }
pointAtParameter = Surface.PointAtParameter(surface=watch, u=code_block_2.out2, v=code_block_2.out2, lacing=CrossProduct)
flatten = List.Flatten(list=pointAtParameter)
UVParameterAtPoint = Surface.UVParameterAtPoint(surface=watch, point=flatten)
code_block_3 = CodeBlock(geometry=watch) { geometry; }

code_block_4 = CodeBlock(l=flatten) { List.Count(l); 0; 100; 5; }
randomList = Math.RandomList(amount=code_block_4.out0, value1=code_block_4.out1, value2=code_block_4.out2, seed=code_block_4.out3)

# group: create analyses
current = Document.Current()
activeView = Document.ActiveView(document=current)
code_block_5 = CodeBlock(surface=code_block_3, samplelocations=UVParameterAtPoint) { "{3D}"; surface; samplelocations; values=a+b; "woningbouw"; "versie_1"; null; }  # unwired: a, b
byViewFacePointsAndValues = Revit.AnalysisDisplay.FaceAnalysisDisplay.ByViewFacePointsAndValues(view=activeView, surface=select_face, sampleLocations=UVParameterAtPoint, samples=randomList, name=code_block_5.out4, description=code_block_5.out5, unitType=code_block_5.out6)
