# Dynamo graph GIS2BIM_analyze_test_osm.dyn (Dynamo 2.19.3.6394)
# packages: GIS2BIM for Dynamo 2.x 0.12.1, Clockwork for Dynamo 2.x 2.6.0

GIS2BIM_GetSharedCoordinate = Custom[GIS2BIM_GetSharedCoordinate]()  # package GIS2BIM for Dynamo 2.x; Get the current shared coordinate
code_block = CodeBlock { 2000; }
createBoundingBox = Custom[GIS2BIM.CreateBoundingBox](CoordinateX=GIS2BIM_GetSharedCoordinate.EastWest, CoordinateY=GIS2BIM_GetSharedCoordinate.NorthSouth, BoxWidth=code_block, BoxHeight=code_block)  # package GIS2BIM for Dynamo 2.x; create boundingboxstring for webrequests based on coördinates and dimensions
code_block_2 = CodeBlock { 28992; }
GIS2BIM_GetSharedCoordinate_2 = Custom[GIS2BIM_GetSharedCoordinate]()

# group: Import Public Transport Stations (OSM Overpass)
code_block_3 = CodeBlock(bbox=createBoundingBox.Boxstring, targetEPSG=code_block_2) { bbox; targetEPSG; }
py = Python(IN[0]=code_block_3.bbox, IN[1]=code_block_3.targetEPSG)  # "GetOPNVpublictransportOverpass.py"; CPython3
# ---------- py.python (105 lines) ----------
# Load the Python Standard and DesignScript Libraries
import sys
import clr
clr.AddReference('ProtoGeometry')
from Autodesk.DesignScript.Geometry import *

from urllib.request import Request, urlopen
import json
import re


# INPUT PARAMETERS
bbox = IN[0]
targetEPSG = IN[1]


# GOBALS
WSG84_EPSG = 4326 


# FUNCTIONS
def transformEPSG(source, target, x, y):
    convUrl = "http://epsg.io/trans?&s_srs={source}&t_srs={target}&x={x}&y={y}&format=json&trans=1".format(source=source, target=target, x=x, y=y)
    try:
        request = Request(convUrl)
        # Add some credibility to our request
        request.add_header('user-agent', 'Revit Dynamo')
        convResponse = urlopen(request)
        convData = json.loads(convResponse.read())
        return [convData['x'], convData['y']]
    except Exception as error:
        print('ERROR transforming coordinates:', error)
        return [x, y]
        
def extractType(tags):
    keys = tags.keys()
    if 'subway' in keys and tags['subway'] == 'yes':
        return 'subway'
    if 'tram' in keys and tags['tram'] == 'yes':
        return 'tram'
    if 'bus' in keys and tags['bus'] == 'yes':
        return 'bus'        

def extractLocation(lat, lon):
   return transformEPSG(WSG84_EPSG, targetEPSG, lon, lat)


# SCRIPT
# Step 1: Translate BBox to WSG84 Sperical
bboxElements = bbox.split(',')
bboxWSG84Start = transformEPSG(targetEPSG, WSG84_EPSG, bboxElements[0], bboxElements[1])
bboxWSG84End = transformEPSG(targetEPSG, WSG84_EPSG, bboxElements[2], bboxElements[3])
bboxWSG84 = "{xMin},{yMin},{xMax},{yMax}".format(xMin=bboxWSG84Start[1],yMin=bboxWSG84Start[0],xMax=bboxWSG84End[1],yMax=bboxWSG84End[0])


# Step 2: Construct Query
query = '[out:json];(node["building"="house"]({bbox});node["building"="school"]({bbox}););out;'.format(bbox=bboxWSG84)


# Step 3: Construct URL and make request
url = 'https://z.overpass-api.de/api/interpreter?data={query}'.format(query=query)

print('OVERPASS URL', url)

request = Request(url)
request.add_header('user-agent', 'Revit Dynamo')
response = urlopen(request)

data = json.loads(response.read())


# Step 4: Parse Data and Transform Back to Target EPSG
stations = []
nodes = data['elements']
for node in nodes:

    if 'name' not in node['tags'].keys():
        continue
    
    name = node['tags']['name']
    type = extractType(node['tags'])
    location = extractLocation(node['lat'], node['lon'])
    
    if not type:
        continue

    # Skip Duplicate stations/platforms
    exists = False;
    for station in stations:
        if station['name'] == name and station['type'] == type:
            exists = True
            break
            
    if exists:
        continue
            
    stations.append({
        'name': name,
        'location': location,
        'type': type,
    })
 

# OUTPUT
OUT = stations, url
# ----------------------------------------
code_block_4 = CodeBlock(L=py) { URL=L[1]; OUTPUT=L[0]; }
code_block_5 = CodeBlock(RDX=GIS2BIM_GetSharedCoordinate_2.EastWest, RDY=GIS2BIM_GetSharedCoordinate_2.NorthSouth)
# ---------- code_block_5.designscript (15 lines) ----------
RDX;
RDY;
ScaleFactor = 1000;
StationRadii = {
	"bus": 250,
	"subway": 1000,
	"tram": 1000,
	"other": 250
};
StationMaterials = {
	"bus": "gis2bim_env_green",
	"subway": "gis2bim_env_blue",
	"tram": "gis2bim_env_yellow",
	"other": "gis2bim_env_gray"
};
# ----------------------------------------
py_2 = Python(IN[0]=code_block_4.OUTPUT, IN[1]=code_block_5.RDX, IN[2]=code_block_5.RDY, IN[3]=code_block_5.ScaleFactor, IN[4]=code_block_5.StationRadii, IN[5]=code_block_5.StationMaterials)  # "PrepareStationData.py"; CPython3
# ---------- py_2.python (60 lines) ----------
# Load the Python Standard and DesignScript Libraries
import sys
import clr
clr.AddReference('ProtoGeometry')
from Autodesk.DesignScript.Geometry import *

# The inputs to this node will be stored as a list in the IN variables.
stations = IN[0]
centerX = IN[1]
centerY = IN[2]
scaleFactor = IN[3]
stationRadii = IN[4]
stationMaterials = IN[5]

# Place your code below this line

availableStationRadii = stationRadii.keys()
def getStationRadius(type):
    if type in availableStationRadii:
        return stationRadii[type]
    else:
        return stationRadii['other']

availableMaterials = stationMaterials.keys()
def getStationMaterial(type):
    if type in availableMaterials:
        return stationMaterials[type]
    else:
        return stationMaterials['other']
    

points = []
#circles = []
boundaries = []
names = []
materials = []
types = []

for station in stations:
    x = (float(station['location'][0]) - centerX) * scaleFactor
    y = (float(station['location'][1]) - centerY) * scaleFactor
    type = station['type']
    radius = getStationRadius(type)
    point = Point.ByCoordinates(x, y, radius)
    type = station['type']

    # make geometry for analyses
    # Draw SemiCircles for Revit DetailCurve
    # normal = Vector.ByCoordinates(0,0,1)
    # circles.append(Circle.ByCenterPointRadius(point, 1.5 * scaleFactor))
    # Draw full circle for filled region boundaries
    boundaries.append(Circle.ByCenterPointRadius(point, getStationRadius(type) * scaleFactor))
        
    points.append(point)
    names.append(station['name'])
    materials.append(getStationMaterial(type))   
    types.append(type)
        
# Assign your output to the OUT variable.
OUT = points, names, materials, types, boundaries
# ----------------------------------------

# group: place families and update parameters
code_block_6 = CodeBlock { "00_3BM_places"; }
byName = FamilyType.ByName(name=code_block_6)
code_block_7 = CodeBlock { points=L[0]; ["subfeature", "omschrijving"]; [L[3],L[2]]; }  # unwired: L
byPoint = FamilyInstance.ByPoint(familyType=byName, point=code_block_7.points)
setParameterByName = Element.SetParameterByName(element=byPoint, parameterName=code_block_7.out1, value=code_block_7.out2)

sendTo = Custom[Clipboard.SendTo](str=code_block_4.URL)  # package Clockwork for Dynamo 2.x; Copies a string to the clipboard.
