# Dynamo graph GIS2BIM_analyze_zonuren.dyn (Dynamo 2.19.3.6394)
# packages: archi-lab.net 2023.213.1523

# group: Develop surface for analysis
face_to_test = DSFaceSelection()  # 1 picked in the model; graph input
code_block = CodeBlock { [0,1]; }
getIsoline = Surface.GetIsoline(surface=face_to_test, isoDirection=code_block, lacing=Longest)
tile_grote = DoubleInput(1000)
code_block_2 = CodeBlock(crv=getIsoline, s=tile_grote)
# ---------- code_block_2.designscript (21 lines) ----------
//Function to get params
def GetParams(crv,s)
{
len = Curve.Length(crv)/s;
cei = Math.Ceiling(len);
spc = 1/cei;
cel = Curve.Length(crv)/cei;
seq = spc/2..1-spc/2..#cei;
return [seq,cel];
};

p1 = GetParams(crv[0],s);
p2 = GetParams(crv[1],s);

//Parameters
p1[0];
p2[0];

//Final Cell size
p1[1];
p2[1];
# ----------------------------------------
pointAtParameter = Surface.PointAtParameter(surface=face_to_test, u=code_block_2.out2, v=code_block_2.out3, lacing=CrossProduct)
flatten = List.Flatten(list=pointAtParameter)
doesIntersect = Geometry.DoesIntersect(geometry=face_to_test, other=flatten, lacing=Longest)
filterByBoolMask = List.FilterByBoolMask(list=flatten, mask=doesIntersect)
code_block_3 = CodeBlock(pts=filterByBoolMask.in) { pts; }
code_block_4 = CodeBlock { 0.5; }
normalAtParameter = Surface.NormalAtParameter(surface=face_to_test, u=code_block_4, v=code_block_4)
offset_from_surface = DoubleInput(100)  # graph input
translate = Geometry.Translate(geometry=code_block_3, direction=normalAtParameter, distance=offset_from_surface, lacing=Longest)
byOriginNormal = Plane.ByOriginNormal(origin=translate, normal=normalAtParameter, lacing=Longest)
byWidthLength = Rectangle.ByWidthLength(plane=byOriginNormal, width=code_block_2.out4, length=code_block_2.out5, lacing=Longest)

corners = Polygon.Corners(polygon=byWidthLength)
panel_type = FamilyTypes("00_3BM_bezonningspaneel:bezonning")  # graph input
byPoints = AdaptiveComponent.ByPoints(points=corners, familyType=panel_type)
code_block_5 = CodeBlock { "zonuren"; }

# group: datum en tijd
code_block_6 = CodeBlock()
# ---------- code_block_6.designscript (14 lines) ----------
tijdvakken = 30.0;
seq = 0..60..#(60/tijdvakken)+1;
aantaltijdvakken = List.Count(seq);
aantaltijdvakken-2;

List.RemoveItemAtIndex(seq,[aantaltijdvakken-1]);
jaar = 2024;
maand= 10;
dag = 28;
start=9.0;
eind=19.0;

start..eind..1;
eind-start;
# ----------------------------------------

# group: select view
views = Views("{3D}")  # graph input

# group: Make datetime and naming convention
byDateAndTime = DateTime.ByDateAndTime(year=code_block_6.jaar, month=code_block_6.maand, day=code_block_6.dag, hour=code_block_6.out10, minute=code_block_6.out4, lacing=CrossProduct)
code_block_7 = CodeBlock(datetimes=byDateAndTime, excess=code_block_6.out3) { times = List.Flatten(datetimes); ind   = List.Count(times) - excess; List.TakeItems(times, ind); }

# group: Make shadow settings and get vector
get_view_from_sun_vector = Python(IN[0]=views, IN[1]=code_block_7.out2)  # CPython3
# ---------- get_view_from_sun_vector.python (72 lines) ----------
import clr
import sys
import System
from System import DateTime

clr.AddReference('ProtoGeometry')
from Autodesk.DesignScript.Geometry import *
import Autodesk.DesignScript.Geometry as DS

#import Revit API
clr.AddReference('RevitAPI')
import Autodesk
from Autodesk.Revit.DB import *
import Autodesk.Revit.DB as DB

clr.AddReference('RevitNodes')
import Revit
clr.ImportExtensions(Revit.Elements)
clr.ImportExtensions(Revit.GeometryConversion)
clr.ImportExtensions(Revit.GeometryReferences)

#import transactionManager and DocumentManager (RevitServices is specific to Dynamo)
clr.AddReference('RevitServices')
import RevitServices
from RevitServices.Persistence import DocumentManager
from RevitServices.Transactions import TransactionManager
doc = DocumentManager.Instance.CurrentDBDocument
uiapp = DocumentManager.Instance.CurrentUIApplication
uidoc = uiapp.ActiveUIDocument

def get_Sun_Direction(view, dateTime):
	"""
	get sun direction by date Time
	"""
	sunSettings = view.SunAndShadowSettings
	# set the DateTime
	TransactionManager.Instance.EnsureInTransaction(doc)
	if dateTime.Kind == System.DateTimeKind.Unspecified:
		dateTime = DateTime.SpecifyKind(dateTime, System.DateTimeKind.Local)
	sunSettings.StartDateAndTime = dateTime
	sunSettings.SunAndShadowType = SunAndShadowType.StillImage
	TransactionManager.Instance.TransactionTaskDone()
	uidoc.RefreshActiveView()
	doc.Regenerate()
	# compute the sun direction
	initialDirection = XYZ.BasisY
	altitude = sunSettings.Altitude
	altitude = sunSettings.GetFrameAltitude(sunSettings.ActiveFrame)
	altitudeRotation = Transform.CreateRotation(XYZ.BasisX, altitude)
	altitudeDirection = altitudeRotation.OfVector(initialDirection)
	azimuth = sunSettings.Azimuth
	azimuth = sunSettings.GetFrameAzimuth(sunSettings.ActiveFrame)
	actualAzimuth = 2 * System.Math.PI - azimuth
	azimuthRotation = Transform.CreateRotation( XYZ.BasisZ, actualAzimuth)
	sunDirection = azimuthRotation.OfVector(altitudeDirection)
	return sunDirection

def uwlist(input):
    result = input if isinstance(input, list) else [input]
    return UnwrapElement(result)
	
inputView = UnwrapElement(IN[0])
dateTimes = uwlist(IN[1])

vecs = []

for d in dateTimes:
	sunDirection = get_Sun_Direction(inputView, d)
	v = sunDirection.ToVector().Reverse()
	vecs.append(v)

OUT = vecs
# ----------------------------------------
reverse = Vector.Reverse(vector=get_view_from_sun_vector)
ZAxis = Vector.ZAxis()
projectRotation = Coordinates.ProjectRotation()
rotate = Vector.Rotate(vector=reverse, axis=ZAxis, degrees=projectRotation)

# group: Run and measure raybounce
watch = Watch(code_block_6.tijdvakken)
code_block_8 = CodeBlock { 1; }
byOriginDirection = Revit.References.RayBounce.ByOriginDirection(origin=translate, direction=rotate@L2, maxBounces=code_block_8, view=views, lacing=Longest)
flatten_2 = List.Flatten(list=byOriginDirection.elements@L3)
count = List.Count(list=flatten_2@L2)
max_uren_1_periode_aantal = CodeBlock(max=code_block_6.out11, d=watch, c=count) { (max+d/60) - (c/(60/d)); }  # "max uren + 1 periode - aantal periodes"

setParameterByName = Element.SetParameterByName(element=byPoints, parameterName=code_block_5, value=max_uren_1_periode_aantal)
code_block_9 = CodeBlock { "Workset"; }
worksets = WorksetUi("bezonning")  # graph input
id = archilab.Revit.Elements.Workset.Id(workset=worksets)
setParameterByName_2 = Element.SetParameterByName(element=byPoints, parameterName=code_block_9, value=id)
