# Dynamo graph GIS2BIM_aurius.dyn (Dynamo 2.16.2.5624)
# packages: GIS2BIM for Dynamo 2.x 0.11.25, GIS2BIM for Dynamo 2.x 0.12.1, Clockwork for Dynamo 2.x 2.6.0

# group: Control
select_model_element = DSModelElementSelection()  # 1 picked in the model
geometry = Element.Geometry(element=select_model_element)
code_block = CodeBlock(l=geometry) { l[0]; }
perimeterCurves = Surface.PerimeterCurves(surface=code_block)

# group: bbox
code_block_2 = CodeBlock { "28992"; }
GIS2BIM_GetRevitSiteLocation = Custom[GIS2BIM_GetRevitSiteLocation]()  # package GIS2BIM for Dynamo 2.x; Gets the properties of the current Site Location of the active Revit Project
toNumber = String.ToNumber(string=GIS2BIM_GetRevitSiteLocation.Lon)
toNumber_2 = String.ToNumber(string=GIS2BIM_GetRevitSiteLocation.Lat)
GIS2BIM_TransformCRS_epsg = Custom[GIS2BIM_TransformCRS_epsg](TargetCRS=code_block_2, xCoordinate=toNumber, yCoordinate=toNumber_2)  # package GIS2BIM for Dynamo 2.x; Uses the API of http://epsg.io to transform Coordinate Reference Systems

GIS2BIM_Aerius_PolyGon = Custom[GIS2BIM_Aerius_PolyGon](curves=perimeterCurves, dx=GIS2BIM_TransformCRS_epsg.Xtransformed, dy=GIS2BIM_TransformCRS_epsg.Ytransformed)  # package GIS2BIM for Dynamo 2.x; Create Aerius PolyGon String
sendTo = Custom[Clipboard.SendTo](str=GIS2BIM_Aerius_PolyGon)  # package Clockwork for Dynamo 2.x; Copies a string to the clipboard.
