# Dynamo graph GIS2BIM_basis_info_v7.dyn (Dynamo 2.19.3.6394)
# packages: GIS2BIM for Dynamo 2.x 0.12.1, Clockwork for Dynamo 2.x 2.6.0

# group: Input from revit
siteLocation = SiteLocation()
string_from_object = FromObject(object=siteLocation)
code_block = CodeBlock { ", "; }
split = String.Split(string=string_from_object, separator0=code_block)
code_block_2 = CodeBlock(l=split) { l[0]; 0; 6; }
adres = String.Remove(string=code_block_2.out0, startIndex=code_block_2.out1, count=code_block_2.out2)
code_block_3 = CodeBlock(l=split) { l[1]; 0; 8; }
stad = String.Remove(string=code_block_3.out0, startIndex=code_block_3.out1, count=code_block_3.out2)
code_block_4 = CodeBlock(adres=adres, stad=stad) { adres+", "+stad; }
code_block_5 = CodeBlock { "[0-9]+"; "[A-Z]+"; ""; true; }
findRegularExpression = Custom[Regex.FindRegularExpression](RegEx=code_block_5.out0, str=adres)  # package Clockwork for Dynamo 2.x; Returns all occurences of a regular expression within a string (or list of strings). The syntax for regular expressions is explained at http://ironpython-test.readthedocs.org/en/latest/howto/regex.html
code_block_6 = CodeBlock(l=findRegularExpression) { l[0]; }
substring = String.Substring(string=code_block_3.out0, startIndex=code_block_3.out1, length=code_block_3.out2)
code_block_7 = CodeBlock { " "; ""; }
postcode_short = String.Replace(string=substring, searchFor=code_block_7.out0, replaceWith=code_block_7.out1)
GIS2BIM_GetLocationdataNetherlands = Custom[GIS2BIM_GetLocationdataNetherlands](Housenumber=code_block_6, Postcode=postcode_short)  # package GIS2BIM for Dynamo 2.x; Gives locationdata based on an adress in the Netherlands
watch = Watch(string_from_object)
replaceRegularExpression_straatnaam = Custom[Regex.ReplaceRegularExpression_straatnaam](RegEx=code_block_5.out0, str=adres, Replacement=code_block_5.out2)  # package Clockwork for Dynamo 2.x; Replaces all occurences of a regular expression within a given string (or list of strings) with another string. The syntax for regular expressions is explained at http://ironpython-test.readthedocs.org/en/latest/howto/regex.html
watch_2 = Watch(siteLocation)
