# Dynamo graph GIS2BIM_basis_luchfoto_v7.dyn (Dynamo 2.19.3.6394)
# packages: GIS2BIM for Dynamo 2.x 0.12.1, Clockwork for Dynamo 2.x 2.6.0, spring nodes 210.1.1

# group: Input from revit
siteLocation = SiteLocation()
string_from_object = FromObject(object=siteLocation)
code_block = CodeBlock { ", "; }
split = String.Split(string=string_from_object, separator0=code_block)
code_block_2 = CodeBlock(l=split) { l[0]; 0; 6; }
adres = String.Remove(string=code_block_2.out0, startIndex=code_block_2.out1, count=code_block_2.out2)
code_block_3 = CodeBlock(l=split) { l[1]; 0; 8; }
stad = String.Remove(string=code_block_3.out0, startIndex=code_block_3.out1, count=code_block_3.out2)
code_block_4 = CodeBlock(adres=adres, stad=stad) { adres+", "+stad; }
watch = Watch(string_from_object)
code_block_5 = CodeBlock { "[0-9]+"; "[A-Z]+"; ""; true; }
replaceRegularExpression_straatnaam = Custom[Regex.ReplaceRegularExpression_straatnaam](RegEx=code_block_5.out0, str=adres, Replacement=code_block_5.out2)  # package Clockwork for Dynamo 2.x; Replaces all occurences of a regular expression within a given string (or list of strings) with another string. The syntax for regular expressions is explained at http://ironpython-test.readthedocs.org/en/latest/howto/regex.html
findRegularExpression = Custom[Regex.FindRegularExpression](RegEx=code_block_5.out0, str=adres)  # package Clockwork for Dynamo 2.x; Returns all occurences of a regular expression within a string (or list of strings). The syntax for regular expressions is explained at http://ironpython-test.readthedocs.org/en/latest/howto/regex.html
code_block_6 = CodeBlock(l=findRegularExpression) { l[0]; }
substring = String.Substring(string=code_block_3.out0, startIndex=code_block_3.out1, length=code_block_3.out2)
code_block_7 = CodeBlock { " "; ""; }
postcode_short = String.Replace(string=substring, searchFor=code_block_7.out0, replaceWith=code_block_7.out1)
GIS2BIM_GetLocationdataNetherlands = Custom[GIS2BIM_GetLocationdataNetherlands](Housenumber=code_block_6, Postcode=postcode_short)  # package GIS2BIM for Dynamo 2.x; Gives locationdata based on an adress in the Netherlands
watch_2 = Watch(siteLocation)
code_block_8 = CodeBlock { 0; 8; }
plaatsnaam = String.Remove(string=code_block_3.out0, startIndex=code_block_8.out0, count=code_block_8.out1)

# group: creates directories in folder
boolean = BoolSelector(false)
ꟿ_document_centralpath = Custom[ꟿ Document.CentralPath](refresh=boolean)  # package spring nodes; If the document is workshared, the node returns the path to the central document as a string. Otherwise a null value will be returned.
directoryName = FileSystem.DirectoryName(path=ꟿ_document_centralpath)
string = StringInput("\")
code_block_9 = CodeBlock(path=directoryName, slash=string) { path + slash + "GISDATA" + slash; }
directory_from_path = DirectoryObject(path=code_block_9)
GIS2BIM_GetMortonCodeCoordinate = Custom[GIS2BIM_GetMortonCodeCoordinate](X=GIS2BIM_GetLocationdataNetherlands.RDcoordinateXmeters, Y=GIS2BIM_GetLocationdataNetherlands.RDcoordinateYmeters)  # package GIS2BIM for Dynamo 2.x; Get mortoncode(bitshifting) given 2 coordinates and tiledimension
ꟿ_number_tostring = Custom[ꟿ Number.ToString](num=GIS2BIM_GetMortonCodeCoordinate)  # package spring nodes; Converts the input number(s) to string. You can optionally limit the number of digits.
code_block_10 = CodeBlock(gispath=directory_from_path, mortoncode=ꟿ_number_tostring) { gispath + mortoncode; gispath + "ahn"; gispath + "images"; gispath + "obj"; gispath + "osm"; }
mortoncode_path = DirectoryObject(path=code_block_10.out0)
ahn_path = DirectoryObject(path=code_block_10.out1)
obj_path = DirectoryObject(path=code_block_10.out3)
obj_path_2 = DirectoryObject(path=code_block_10.out4)
images_path = DirectoryObject(path=code_block_10.out2)

# group: coordinates
code_block_11 = CodeBlock(RDX=GIS2BIM_GetLocationdataNetherlands.RDcoordinateXmeters, RDY=GIS2BIM_GetLocationdataNetherlands.RDcoordinateYmeters) { RDX; RDY; }
code_block_12 = CodeBlock(eastwest=code_block_11.RDX, northsouth=code_block_11.RDY) { eastwest; northsouth; [50,50]; }
GIS2BIM_CreateBoundingBox = Custom[GIS2BIM_CreateBoundingBox](CoordinateX=code_block_12.eastwest, CoordinateY=code_block_12.northsouth, BoxWidth=code_block_12.out2, BoxHeight=code_block_12.out2)  # package GIS2BIM for Dynamo 2.x; create boundingboxstring for webrequests based on coördinates and dimensions
code_block_13 = CodeBlock(l=GIS2BIM_CreateBoundingBox.Boxstring, l1=GIS2BIM_CreateBoundingBox.PolygonString, l2=code_block_12.out2, RDX=code_block_11.RDX, RDY=code_block_11.RDY) { bboxstringsmall=l[0]; boxstringbig=l[1]; polygonstringbig=l1[1]; bbox=l2[1]; RDX; RDY; }
bbox_small = Watch(code_block_13.bboxstringsmall)
bbox_big = Watch(code_block_13.boxstringbig)

watch_3 = Watch(GIS2BIM_GetLocationdataNetherlands.URLWebrequest)
sendTo = Custom[Clipboard.SendTo](str=GIS2BIM_GetLocationdataNetherlands.URLWebrequest)  # package Clockwork for Dynamo 2.x; Copies a string to the clipboard.
geoservicesLibraryNetherlands_JK = Custom[GIS2BIM.GeoservicesLibraryNetherlands_JK](BoundingBoxEPSG28992=bbox_big, BoundingBoxBigEPSG28992=bbox_big)  # GeoservicesLibraryNetherlands_JK

# group: wms foto`s test /handmatig
code_block_14 = CodeBlock(width=code_block_12.out2) { width[1]; }
code_block_15 = CodeBlock(l=geoservicesLibraryNetherlands_JK.03_WMS_request_list, ll=geoservicesLibraryNetherlands_JK.03_WMS_view_list) { l[0]; ll[0]; }
selectByName = Custom[View.SelectByName](Viewname=code_block_15.out1, lacing=Longest)  # Select a view by its name
GIS2BIM_WebrequestWMS = Custom[GIS2BIM_WebrequestWMS](WMSwebrequest=code_block_15.out0, lacing=Longest)  # package GIS2BIM for Dynamo 2.x; a webrequest based on WMS-protocol
string_2 = StringInput("\")
code_block_16 = CodeBlock(path=images_path, slash=string_2, name=code_block_15.out1) { path+slash+name+".png"; }
GIS2BIM_ImageToFile = Custom[GIS2BIM_ImageToFile](ImageObject=GIS2BIM_WebrequestWMS, FileNamePath=code_block_16, lacing=Longest)  # package GIS2BIM for Dynamo 2.x; Write Image to file
GIS2BIM_ImportImageInView = Custom[GIS2BIM_ImportImageInView](ImageWidthMeters=code_block_14, view=selectByName, ImagePath=GIS2BIM_ImageToFile, lacing=Longest)  # package GIS2BIM for Dynamo 2.x; Import rasterimage in view
sendTo_2 = Custom[Clipboard.SendTo](str=code_block_15.out0)
watch_image = WatchImageCore(image=GIS2BIM_WebrequestWMS)
