# Dynamo graph GIS2BIM_clean_v7.dyn (Dynamo 3.3.0.6316)
# packages: archi-lab.net 2023.213.1523, Genius Loci 2024.5.29

# group: groups
element_types = ElementTypes("Group")
all_elements_of_type = ElementsOfType(element_type=element_types)

# group: elements of categories
categories = Categories("OST_Topography")
categories_2 = Categories("OST_GenericModel")
categories_3 = Categories("OST_Mass")
categories_4 = Categories("OST_Planting")
categories_5 = Categories("OST_DetailComponents")
categories_6 = Categories("OST_Site")
categories_7 = Categories("OST_LightingFixtures")
categories_8 = Categories("OST_Lines")
list_create = List.Create(item0=categories, item1=categories_2, item2=categories_3, item3=categories_4, item4=categories_5, item5=categories_6, item6=categories_7, item7=categories_8)
all_elements_of_category = ElementsOfCategory(Category=list_create)
element_workset = Custom[Element Workset](element=all_elements_of_category, lacing=Longest)  # package Genius Loci; Returns the workset of the given element.
code_block = CodeBlock { "Legend"; }
contains = String.Contains(string=element_workset.Workset_Name, searchFor=code_block)
filterByBoolMask = List.FilterByBoolMask(list=all_elements_of_category, mask=contains)

# group: images
element_types_2 = ElementTypes("ImageInstance")
all_elements_of_type_2 = ElementsOfType(element_type=element_types_2)
name = Element.Name(element=all_elements_of_type_2)
code_block_2 = CodeBlock { "legend"; true; }
contains_2 = String.Contains(string=name, searchFor=code_block_2.out0, ignoreCase=code_block_2.out1)
filterByBoolMask_2 = List.FilterByBoolMask(list=all_elements_of_type_2, mask=contains_2)

# group: delete
list_create_2 = List.Create(item0=all_elements_of_type, item1=filterByBoolMask.out, item2=filterByBoolMask_2.out)
delete = archilab.Revit.Elements.Elements.Delete(element=list_create_2)

watch = Watch(all_elements_of_type)
delete_2 = archilab.Revit.Elements.Elements.Delete(element=filterByBoolMask_2.out)
watch_2 = Watch(filterByBoolMask.in)
code_block_3 = CodeBlock { "legend"; }
python_script = Python(IN[0]=code_block_3)  # IronPython2
# ---------- python_script.python (56 lines) ----------
import clr
clr.AddReference("RevitServices")
from RevitServices.Persistence import DocumentManager
from RevitServices.Transactions import TransactionManager

clr.AddReference("RevitAPI")
from Autodesk.Revit.DB import (
    FilteredElementCollector,
    ImageType,
    BuiltInParameter
)

doc = DocumentManager.Instance.CurrentDBDocument

prefix = IN[0].strip()  # bv: "legend"

def get_image_typename(img):
    # De *echte* naam zit hier
    p = img.get_Parameter(BuiltInParameter.SYMBOL_NAME_PARAM)
    if p:
        return p.AsString() or ""
    return ""

# Alle ImageTypes ophalen
images = FilteredElementCollector(doc).OfClass(ImageType).ToElements()

to_keep = []
to_delete = []

for img in images:
    name = get_image_typename(img)
    if name.lower().startswith(prefix.lower()):
        to_keep.append(name)
    else:
        to_delete.append((img, name))

# Verwijderen
TransactionManager.Instance.EnsureInTransaction(doc)

deleted = []
failed = []

for img, name in to_delete:
    try:
        doc.Delete(img.Id)
        deleted.append(name)
    except:
        failed.append(name)

TransactionManager.Instance.TransactionTaskDone()

OUT = {
    "kept": to_keep,
    "deleted": deleted,
    "failed": failed
}
# ----------------------------------------
