# Dynamo graph GIS2BIM_prepare_location_v5.dyn (Dynamo 2.16.2.5624)
# packages: GIS2BIM for Dynamo 2.x 0.12.1, Clockwork for Dynamo 2.x 2.6.0, spring nodes 210.1.1

# group: Input from revit
siteLocation = SiteLocation()
string_from_object = FromObject(object=siteLocation)
watch = Watch(string_from_object)
code_block = CodeBlock { ", "; }
split = String.Split(string=string_from_object, separator0=code_block)
code_block_2 = CodeBlock(l=split) { l[1]; 0; 8; }
remove = String.Remove(string=code_block_2.out0, startIndex=code_block_2.out1, count=code_block_2.out2)
code_block_3 = CodeBlock { "[0-9]+"; "[A-Z]+"; ""; true; "[ ]+"; }
code_block_4 = CodeBlock(l=split) { l[0]; 0; 6; }
remove_2 = String.Remove(string=code_block_4.out0, startIndex=code_block_4.out1, count=code_block_4.out2)
replaceRegularExpression = Custom[Regex.ReplaceRegularExpression](RegEx=code_block_3.out0, str=remove_2, Replacement=code_block_3.out2)  # package Clockwork for Dynamo 2.x; Replaces all occurences of a regular expression within a given string (or list of strings) with another string. The syntax for regular expressions is explained at http://ironpython-test.readthedocs.org/en/latest/howto/regex.html
replaceRegularExpression_2 = Custom[Regex.ReplaceRegularExpression](RegEx=code_block_3.out1, str=remove_2, Replacement=code_block_3.out2, ignoreCase=code_block_3.out3)
replaceRegularExpression_3 = Custom[Regex.ReplaceRegularExpression](RegEx=code_block_3.out4, str=replaceRegularExpression_2, Replacement=code_block_3.out2, ignoreCase=code_block_3.out3)
GIS2BIM_GetLocationdataNetherlands = Custom[GIS2BIM_GetLocationdataNetherlands](City=remove, Streetname=replaceRegularExpression, Housenumber=replaceRegularExpression_3)  # package GIS2BIM for Dynamo 2.x; Gives locationdata based on an adress in the Netherlands
code_block_5 = CodeBlock(adres=remove_2, stad=remove) { adres+", "+stad; }
code_block_6 = CodeBlock(adres=remove_2, stad=code_block_2.out0) { adres+", "+stad; }

# group: creates directories in folder
GIS2BIM_GetMortonCodeCoordinate = Custom[GIS2BIM_GetMortonCodeCoordinate](X=GIS2BIM_GetLocationdataNetherlands.RDcoordinateXmeters, Y=GIS2BIM_GetLocationdataNetherlands.RDcoordinateYmeters)  # package GIS2BIM for Dynamo 2.x; Get mortoncode(bitshifting) given 2 coordinates and tiledimension
boolean = BoolSelector(false)
ꟿ_document_centralpath = Custom[ꟿ Document.CentralPath](refresh=boolean)  # package spring nodes; If the document is workshared, the node returns the path to the central document as a string. Otherwise a null value will be returned.
directoryName = FileSystem.DirectoryName(path=ꟿ_document_centralpath)
string = StringInput("\")
code_block_7 = CodeBlock(path=directoryName, slash=string) { path + slash + "GISDATA" + slash; }
directory_from_path = DirectoryObject(path=code_block_7)
ꟿ_number_tostring = Custom[ꟿ Number.ToString](num=GIS2BIM_GetMortonCodeCoordinate)  # package spring nodes; Converts the input number(s) to string. You can optionally limit the number of digits.
code_block_8 = CodeBlock(gispath=directory_from_path, mortoncode=ꟿ_number_tostring) { gispath + mortoncode; gispath + "ahn"; gispath + "images"; gispath + "obj"; gispath + "osm"; }
obj_path = DirectoryObject(path=code_block_8.out3)
images_path = DirectoryObject(path=code_block_8.out2)
ahn_path = DirectoryObject(path=code_block_8.out1)
mortoncode_path = DirectoryObject(path=code_block_8.out0)
osm_path = DirectoryObject(path=code_block_8.out4)

# group: To Revit set parameters
categories = Categories("OST_ProjectInformation")
all_elements_of_category = ElementsOfCategory(Category=categories)
code_block_9 = CodeBlock(sectie=GIS2BIM_GetLocationdataNetherlands.SectieKadaster, perceelnummer=GIS2BIM_GetLocationdataNetherlands.PerceelKadaster)
# ---------- code_block_9.designscript (6 lines) ----------
["Project Address",
"Project Name",
"sitename",
"mortoncode"];
"sectie: " + sectie + " / perceelnummer: "
 + perceelnummer;
# ----------------------------------------
string_from_object_2 = FromObject(object=GIS2BIM_GetMortonCodeCoordinate)
list_create = List.Create(item0=code_block_5, item1=replaceRegularExpression, item2=code_block_9.out1, item3=string_from_object_2)
element_setparameterbyname_adres = Element.SetParameterByName(element=all_elements_of_category, parameterName=code_block_9.out0, value=list_create, lacing=Longest)

# group: move surveypoint
categories_2 = Categories("OST_SharedBasePoint")  # graph input
all_elements_of_category_2 = ElementsOfCategory(Category=categories_2)
code_block_10 = CodeBlock(x=all_elements_of_category_2) { x[0]; }
surveyPoint = Coordinates.SurveyPoint()
code_block_11 = CodeBlock(x=GIS2BIM_GetLocationdataNetherlands.RDcoordinateXmeters, y=GIS2BIM_GetLocationdataNetherlands.RDcoordinateYmeters) { x*-1000; y*-1000; }
byCoordinates = Point.ByCoordinates(x=code_block_11.out0, y=code_block_11.out1)
byTwoPoints = Vector.ByTwoPoints(start=surveyPoint, end=byCoordinates)
start = Revit.Transaction.Transaction.Start(input=byTwoPoints)
moveByVector = Element.MoveByVector(element=code_block_10, vector=start)
end = Revit.Transaction.Transaction.End(input=moveByVector)

# group: coordinates
code_block_12 = CodeBlock(RDX=GIS2BIM_GetLocationdataNetherlands.RDcoordinateXmeters, RDY=GIS2BIM_GetLocationdataNetherlands.RDcoordinateYmeters) { RDX; RDY; }
code_block_13 = CodeBlock(eastwest=code_block_12.RDX, northsouth=code_block_12.RDY) { eastwest; northsouth; [100,1000]; }
GIS2BIM_CreateBoundingBox = Custom[GIS2BIM_CreateBoundingBox](CoordinateX=code_block_13.eastwest, CoordinateY=code_block_13.northsouth, BoxWidth=code_block_13.out2, BoxHeight=code_block_13.out2)  # package GIS2BIM for Dynamo 2.x; create boundingboxstring for webrequests based on coördinates and dimensions
code_block_14 = CodeBlock(l=GIS2BIM_CreateBoundingBox.Boxstring, l1=GIS2BIM_CreateBoundingBox.PolygonString, l2=code_block_13.out2, RDX=code_block_12.RDX, RDY=code_block_12.RDY) { watchboxstringsmall=l[0]; boxstringbig=l[1]; polygonstringbig=l1[1]; bbox=l2[1]; RDX; RDY; }

GIS2BIM_SetRevitSiteLocation = Custom[GIS2BIM_SetRevitSiteLocation](lat=GIS2BIM_GetLocationdataNetherlands.Latitude, lon=GIS2BIM_GetLocationdataNetherlands.Longitude, name=code_block_6)  # package GIS2BIM for Dynamo 2.x; Sets the properties of the current Site Location of the active Revit Project
