# Dynamo graph GIS2BIM_situatietekeningen_naar_legend.dyn (Dynamo 2.19.3.6394)
# packages: GIS2BIM for Dynamo 2.x 0.12.1, Clockwork for Dynamo 2.x 2.6.0

# group: Input from revit
code_block = CodeBlock { "27"; "3037VP"; }
GIS2BIM_GetLocationdataNetherlands = Custom[GIS2BIM_GetLocationdataNetherlands](Housenumber=code_block.out0, Postcode=code_block.out1)  # package GIS2BIM for Dynamo 2.x; Gives locationdata based on an adress in the Netherlands

# group: coordinates
code_block_2 = CodeBlock(RDX=GIS2BIM_GetLocationdataNetherlands.RDcoordinateXmeters, RDY=GIS2BIM_GetLocationdataNetherlands.RDcoordinateYmeters) { RDX; RDY; }
code_block_3 = CodeBlock(eastwest=code_block_2.RDX, northsouth=code_block_2.RDY) { eastwest; northsouth; [200,200]; }
GIS2BIM_CreateBoundingBox = Custom[GIS2BIM_CreateBoundingBox](CoordinateX=code_block_3.eastwest, CoordinateY=code_block_3.northsouth, BoxWidth=code_block_3.out2, BoxHeight=code_block_3.out2)  # package GIS2BIM for Dynamo 2.x; create boundingboxstring for webrequests based on coördinates and dimensions
code_block_4 = CodeBlock(l=GIS2BIM_CreateBoundingBox.Boxstring, l1=GIS2BIM_CreateBoundingBox.PolygonString, l2=code_block_3.out2, RDX=code_block_2.RDX, RDY=code_block_2.RDY) { bboxstringsmall=l[0]; boxstringbig=l[1]; polygonstringbig=l1[1]; bbox=l2[1]; RDX; RDY; }
bbox_big = Watch(code_block_4.boxstringbig)
bbox_small = Watch(code_block_4.bboxstringsmall)

geoservicesLibraryNetherlands_JK = Custom[GIS2BIM.GeoservicesLibraryNetherlands_JK](BoundingBoxEPSG28992=bbox_big, BoundingBoxBigEPSG28992=bbox_big)  # GeoservicesLibraryNetherlands_JK

# group: kadaster percelen
views = Views("Situatietekening n.33")
code_block_5 = CodeBlock(l=geoservicesLibraryNetherlands_JK.00_kadaster_en_BAG_list_OGC_WFS)
# ---------- code_block_5.designscript (10 lines) ----------
//huisnummers
l[0];
//straatnamen
l[1];
//perceelnummer
l[2];
//kadastralegrens
l[3];
//bagpanden
l[4];
# ----------------------------------------
MLA_paging = Custom[GIS2BIM.MLA_paging](query=code_block_5.out3)  # Page the response of a GML request
string = StringInput(".//{http://www.opengis.net/gml/3.2}posList")  # graph input
code_block_6 = CodeBlock(deltaX=code_block_4.RDX, deltaY=code_block_4.RDY) { deltaX; deltaY; }
boolean = BoolSelector(false)  # graph input
GIS2BIM_CreatePointsPolygonFromGMLxy = Custom[GIS2BIM_CreatePointsPolygonFromGMLxy](XML=MLA_paging.xml, XPATHSTRING=string, DeltaX=code_block_6.deltaX, DeltaY=code_block_6.deltaY, Connectpolygon=boolean, lacing=CrossProduct)  # package GIS2BIM for Dynamo 2.x; Create point and polygons from a GML-file
curves = PolyCurve.Curves(polyCurve=GIS2BIM_CreatePointsPolygonFromGMLxy.PolyCurves)
byCurve = DetailCurve.ByCurve(view=views, curve=curves)
flatten = List.Flatten(list=byCurve)
byElements = Group.ByElements(elements=flatten)
MLA_paging_2 = Custom[GIS2BIM.MLA_paging](query=code_block_5.out4)
boolean_2 = BoolSelector(true)  # graph input
GIS2BIM_CreatePointsPolygonFromGMLxyz = Custom[GIS2BIM_CreatePointsPolygonFromGMLxyz](XML=MLA_paging_2.xml, XPATHSTRING=string, DeltaX=code_block_6.deltaX, DeltaY=code_block_6.deltaY, Connectpolygon=boolean_2, lacing=CrossProduct)  # package GIS2BIM for Dynamo 2.x; Create points and polygons from a xml/gml-file with x,y and z value
explode = Geometry.Explode(geometry=GIS2BIM_CreatePointsPolygonFromGMLxyz.PolyCurves)
filledregiontypebag_pand = FilledRegionTypes("FR_DP_solid grijs")  # graph input
byCurves = FilledRegion.ByCurves(view=views, boundary=explode, regionType=filledregiontypebag_pand)
flatten_2 = List.Flatten(list=byCurves)
byElements_2 = Group.ByElements(elements=flatten_2)
code_block_7 = CodeBlock { "1.8 mm zwart"; "2.5 mm zwart"; }
GIS2BIM_KadasterPercelen = Custom[GIS2BIM_KadasterPercelen](DeltaX=code_block_6.deltaX, DeltaY=code_block_6.deltaY, view=views, TextTypePerceel=code_block_7.out0, UrlWebrequestKadasterPerceel=code_block_5.out2)  # package GIS2BIM for Dynamo 2.x; Draw propertylines and place streetnames and housenumbers from the dutch kadaster
list_create = List.Create(item0=code_block_5.out0, item1=code_block_5.out1)
GIS2BIM_KadasterHouseNumbers = Custom[GIS2BIM_KadasterHouseNumbers](UrlWebrequestKadasterAnnotation=list_create, DeltaX=code_block_6.deltaX, DeltaY=code_block_6.deltaY, view=views, TextTypeHousenumber=code_block_7.out0, TextTypeStreetname=code_block_7.out1)  # package GIS2BIM for Dynamo 2.x; Draw propertylines and place streetnames and housenumbers from the dutch kadaster
list_create_2 = List.Create(item0=GIS2BIM_KadasterPercelen, item1=GIS2BIM_KadasterHouseNumbers.TextNote0, item2=GIS2BIM_KadasterHouseNumbers.TextNote1)
flatten_3 = List.Flatten(list=list_create_2)
byElements_3 = Group.ByElements(elements=flatten_3)

sendTo = Custom[Clipboard.SendTo](str=GIS2BIM_GetLocationdataNetherlands.URLWebrequest)  # package Clockwork for Dynamo 2.x; Copies a string to the clipboard.
