# Dynamo graph GIS2BIM_test.dyn (Dynamo 2.16.2.5624)
# packages: GIS2BIM for Dynamo 2.x 0.12.1, Clockwork for Dynamo 2.x 2.6.0

# group: Input from revit
siteLocation = SiteLocation()
string_from_object = FromObject(object=siteLocation)
watch = Watch(string_from_object)
code_block = CodeBlock { ", "; }
split = String.Split(string=string_from_object, separator0=code_block)
code_block_2 = CodeBlock(l=split) { l[0]; 0; 6; }
remove = String.Remove(string=code_block_2.out0, startIndex=code_block_2.out1, count=code_block_2.out2)
code_block_3 = CodeBlock(l=split) { l[1]; 0; 0; }
remove_2 = String.Remove(string=code_block_3.out0, startIndex=code_block_3.out1, count=code_block_3.out2)
code_block_4 = CodeBlock(adres=remove, stad=remove_2) { adres+", "+stad; }
code_block_5 = CodeBlock { "[0-9]+"; "[A-Z]+"; ""; true; "[ ]+"; }
replaceRegularExpression = Custom[Regex.ReplaceRegularExpression](RegEx=code_block_5.out0, str=remove, Replacement=code_block_5.out2)  # package Clockwork for Dynamo 2.x; Replaces all occurences of a regular expression within a given string (or list of strings) with another string. The syntax for regular expressions is explained at http://ironpython-test.readthedocs.org/en/latest/howto/regex.html
replaceRegularExpression_2 = Custom[Regex.ReplaceRegularExpression](RegEx=code_block_5.out1, str=remove, Replacement=code_block_5.out2, ignoreCase=code_block_5.out3)
replaceRegularExpression_3 = Custom[Regex.ReplaceRegularExpression](RegEx=code_block_5.out4, str=replaceRegularExpression_2, Replacement=code_block_5.out2, ignoreCase=code_block_5.out3)
GIS2BIM_GetLocationdataNetherlands = Custom[GIS2BIM_GetLocationdataNetherlands](City=remove_2, Streetname=replaceRegularExpression, Housenumber=replaceRegularExpression_3)  # package GIS2BIM for Dynamo 2.x; Gives locationdata based on an adress in the Netherlands

GIS2BIM_GeoservicesDatabase = Custom[GIS2BIM_GeoservicesDatabase]()  # package GIS2BIM for Dynamo 2.x; Returns a actual list of WFS/WMS/WCS services and requests from the Github-repository of GIS2BIM.
code_block_6 = CodeBlock(l=GIS2BIM_GeoservicesDatabase) { l[1][11]; }
code_block_7 = CodeBlock { "serverrequestprefix"; }
valueAtKey = DesignScript.Builtin.Dictionary.ValueAtKey(dictionary=code_block_6, key=code_block_7)

# group: coordinates
code_block_8 = CodeBlock(RDX=GIS2BIM_GetLocationdataNetherlands.RDcoordinateXmeters, RDY=GIS2BIM_GetLocationdataNetherlands.RDcoordinateYmeters) { RDX; RDY; }
code_block_9 = CodeBlock(eastwest=code_block_8.RDX, northsouth=code_block_8.RDY) { eastwest; northsouth; [250,750]; }
GIS2BIM_CreateBoundingBox = Custom[GIS2BIM_CreateBoundingBox](CoordinateX=code_block_9.eastwest, CoordinateY=code_block_9.northsouth, BoxWidth=code_block_9.out2, BoxHeight=code_block_9.out2)  # package GIS2BIM for Dynamo 2.x; create boundingboxstring for webrequests based on coördinates and dimensions
code_block_10 = CodeBlock(l=GIS2BIM_CreateBoundingBox.Boxstring, l1=GIS2BIM_CreateBoundingBox.PolygonString, l2=code_block_9.out2, RDX=code_block_8.RDX, RDY=code_block_8.RDY) { bboxstringsmall=l[0]; boxstringbig=l[1]; polygonstringbig=l1[1]; bbox=l2[1]; RDX; RDY; }

code_block_11 = CodeBlock(link=valueAtKey, bbox=code_block_10.bboxstringsmall) { link+bbox; }

# group: wms foto`s test /handmatig
GIS2BIM_WebrequestWMS = Custom[GIS2BIM_WebrequestWMS](WMSwebrequest=code_block_11)  # package GIS2BIM for Dynamo 2.x; a webrequest based on WMS-protocol
watch_image = WatchImageCore(image=GIS2BIM_WebrequestWMS)

geoservicesLibraryNetherlands_MLA = Custom[GIS2BIM.GeoservicesLibraryNetherlands_MLA](BoundingBoxEPSG28992=code_block_10.bboxstringsmall)  # GeoservicesLibraryNetherlands_MLA
sendTo = Custom[Clipboard.SendTo](str=geoservicesLibraryNetherlands_MLA.03_WMS_request_list)  # package Clockwork for Dynamo 2.x; Copies a string to the clipboard.
watch_2 = Watch(code_block_11)
web_request = WebRequest(url=watch_2)
watch_3 = Watch(web_request)
code_block_12 = CodeBlock { 23; }
watch_4 = Watch(GIS2BIM_GeoservicesDatabase)
geoservicesLibraryNetherlands_MLA_2 = Custom[GIS2BIM.GeoservicesLibraryNetherlands_MLA](BoundingBoxEPSG28992=code_block_10.bboxstringsmall)
watch_5 = Watch(geoservicesLibraryNetherlands_MLA_2.03_WMS_request_list)
watch_6 = Watch(geoservicesLibraryNetherlands_MLA.03_WMS_request_list)
