# Dynamo graph GIS2BIM_wmts_google_v7.dyn (Dynamo 2.19.3.6394)
# packages: GIS2BIM for Dynamo 2.x 0.11.24

siteLocation = SiteLocation()
latitude = DynamoUnits.Location.Latitude(location=siteLocation)
longitude = DynamoUnits.Location.Longitude(location=siteLocation)
desired_width_in_meters = CodeBlock { 250; }
GIS2BIM_CreateBoundingBoxLATLONG = Custom[GIS2BIM_CreateBoundingBoxLATLONG](Latitude=latitude, Longitude=longitude, WidthMeters=desired_width_in_meters)  # package GIS2BIM for Dynamo 2.x; create boundingbox with from lat/long coordinate in degrees
zoomlevel = CodeBlock { 21; }
TMSGetTileNumbersFromBboxLATLON = Custom[GIS2BIM.TMSGetTileNumbersFromBboxLATLON](West=GIS2BIM_CreateBoundingBoxLATLONG.West, East=GIS2BIM_CreateBoundingBoxLATLONG.East, North=GIS2BIM_CreateBoundingBoxLATLONG.North, South=GIS2BIM_CreateBoundingBoxLATLONG.South, Zoomlevel=zoomlevel, BoundingboxWidth=desired_width_in_meters)  # package GIS2BIM for Dynamo 2.x; Get the Tilenumbers in X and Y in the TMS Webprotocol based on a given Boundingbox in LAT/LON
TMSWebServices = Custom[GIS2BIM.TMSWebServices](TileX=TMSGetTileNumbersFromBboxLATLON.TileX, TileY=TMSGetTileNumbersFromBboxLATLON.TileY, Zoomlevel=zoomlevel)  # package GIS2BIM for Dynamo 2.x; Library With TMS Webservices
boolean = BoolSelector(false)  # graph input
GIS2BIM_TMS_WMTS_WebrequestAndCombineIma = Custom[GIS2BIM_TMS_WMTS_WebrequestAndCombineImages](URLlist=TMSWebServices.URL_Google_Earth_Satellite, UniqueTileNumbersColumnX=TMSGetTileNumbersFromBboxLATLON.TileXUnique, UniqueTileNumbersRowY=TMSGetTileNumbersFromBboxLATLON.TileYUnique, WMTSorTMS=boolean)  # package GIS2BIM for Dynamo 2.x; Webrequest for list of WMTS or TMS/Google webrequests for tiles. Combines them to 1 image.
downloaded_image = WatchImageCore(image=GIS2BIM_TMS_WMTS_WebrequestAndCombineIma.Image)

# group: Crop and Move Image
dimensions = Image.Dimensions(image=GIS2BIM_TMS_WMTS_WebrequestAndCombineIma.Image)
code_block = CodeBlock(image=GIS2BIM_TMS_WMTS_WebrequestAndCombineIma.Image, curentImageSize=dimensions.width, currentWidth=TMSGetTileNumbersFromBboxLATLON.WidthM, targetWidth=desired_width_in_meters, deltaX=TMSGetTileNumbersFromBboxLATLON.DeltaXmm, deltaY=TMSGetTileNumbersFromBboxLATLON.DeltaYmm) { image; curentImageSize; currentWidth; targetWidth; deltaX; deltaY; }
py = Python(IN[0]=code_block.image, IN[1]=code_block.curentImageSize, IN[2]=code_block.currentWidth, IN[3]=code_block.targetWidth, IN[4]=code_block.deltaX, IN[5]=code_block.deltaY)  # "CropImage.py"; CPython3
# ---------- py.python (33 lines) ----------
# Load the Python Standard and DesignScript Libraries
import sys
import clr
clr.AddReference("System.Drawing")
clr.AddReference("System")
from System.Drawing import Image
from System.Drawing import Bitmap
from System.Drawing import Graphics

# The inputs to this node will be stored as a list in the IN variables.
image = IN[0]
currentImageSize = IN[1]
currentWidth = IN[2]
targetWidth = IN[3]
deltaXmm = IN[4]
deltaYmm = IN[5]

# Place your code below this line

resolution = currentImageSize / currentWidth # px per meter
targetSize = targetWidth * resolution
sizeDifference = currentImageSize - targetSize

resultImage = Bitmap(targetSize, targetSize)
resultImageGraphics = Graphics.FromImage(resultImage)

xPixelPos = -1 * sizeDifference / 2 + (deltaXmm * resolution / 1000)
yPixelPos = -1 * sizeDifference / 2 - (deltaYmm * resolution / 1000)

resultImageGraphics.DrawImage(image, xPixelPos, yPixelPos, currentImageSize, currentImageSize)

# Assign your output to the OUT variable.
OUT = resultImage
# ----------------------------------------

cropped_image = WatchImageCore(image=py)

# group: Get FileName
filePaths = Custom[FilePaths]()  # Gets the filepaths from the model.
directory_from_path = DirectoryObject(path=filePaths.04_imagedir)
string = StringInput("\")
string_2 = StringInput("google_wmts.png")
code_block_2 = CodeBlock(path=directory_from_path, slash=string, file=string_2) { path+slash+file; }

# group: Place Cropped Image in View
code_block_3 = CodeBlock { "GIS2BIM_WMTS_google"; }
selectByName = Custom[SelectByName](Viewname=code_block_3)  # Select a view by its name
GIS2BIM_ImageToFile = Custom[GIS2BIM_ImageToFile](ImageObject=py, FileNamePath=code_block_2)  # package GIS2BIM for Dynamo 2.x; Write Image to file
GIS2BIM_ImportImageInView = Custom[GIS2BIM_ImportImageInView](ImageWidthMeters=desired_width_in_meters, view=selectByName, ImagePath=GIS2BIM_ImageToFile, lacing=Longest)  # package GIS2BIM for Dynamo 2.x; Import rasterimage in view

# group: Get FileName
filePaths_2 = Custom[FilePaths]()  # frozen
directory_from_path_2 = DirectoryObject(path=filePaths_2.04_imagedir)
string_3 = StringInput("\")
string_4 = StringInput("google_wmts_full.png")
code_block_4 = CodeBlock(path=directory_from_path_2, slash=string_3, file=string_4) { path+slash+file; }

# group: Place Large Image in View with Offset
views = Views("GIS2BIM_int_aerial")
GIS2BIM_ImageToFile_2 = Custom[GIS2BIM_ImageToFile](ImageObject=GIS2BIM_TMS_WMTS_WebrequestAndCombineIma.Image, FileNamePath=code_block_4)
GIS2BIM_ImportImageInView_2 = Custom[GIS2BIM_ImportImageInView](ImageWidthMeters=TMSGetTileNumbersFromBboxLATLON.WidthM, view=views, ImagePath=GIS2BIM_ImageToFile_2, DeltaX=TMSGetTileNumbersFromBboxLATLON.DeltaXmm, DeltaY=TMSGetTileNumbersFromBboxLATLON.DeltaYmm, lacing=Longest)
