# Dynamo graph MLA_GIS2BIM_OSM_download_v7.dyn (Dynamo 2.19.3.6394)

# group: create boundingbox
getRevitSiteLocation = Custom[GIS2BIM.GetRevitSiteLocation]()  # Gets the properties of the current Site Location of the active Revit Project
code_block = CodeBlock(lon=getRevitSiteLocation.Lon, lat=getRevitSiteLocation.Lat) { dLon = String.ToNumber(lon); dLat = String.ToNumber(lat); bbox =1000; bboxtranslate = bbox/2*-1000; }
createBoundingBoxLATLONG = Custom[GIS2BIM.CreateBoundingBoxLATLONG](Latitude=code_block.dLat, Longitude=code_block.dLon, WidthMeters=code_block.bbox)  # create boundingbox with from lat/long coordinate in degrees

filePaths = Custom[FilePaths]()  # Gets the filepaths from the model.

# group: download osm
GIS2BIM_DownloadOSM = Custom[GIS2BIM_DownloadOSM](West=createBoundingBoxLATLONG.West, East=createBoundingBoxLATLONG.East, North=createBoundingBoxLATLONG.North, South=createBoundingBoxLATLONG.South, DirectoryLocation=filePaths.06_OSMfiles)  # Download OSM data within a boundingbox
